# Grasshopper definition UrbGEN_0.1.15.gh (Grasshopper 1.0.8)
# plug-ins: Pufferfish

curve = Curve(<curve referenced from the Rhino model>)
curve_2 = Curve(<curve referenced from the Rhino model>)
curve_3 = Curve(<curve referenced from the Rhino model>)
curve_4 = Curve(<curve referenced from the Rhino model>)
curve_5 = Curve(<curve referenced from the Rhino model>)
curve_6 = Curve(<curve referenced from the Rhino model>)
curve_7 = Curve(<curve referenced from the Rhino model>)
curve_8 = Curve(<curve referenced from the Rhino model>)
curve_9 = Curve(<curve referenced from the Rhino model>)
curve_10 = Curve(<curve referenced from the Rhino model>)
# Note:
# 
# The computation and generative process time
# depends on the number of sites being processed.
# With the current template, running the full workflow
# for multiple sites takes approximately 2minutes.
# Processing a single site will generally be faster.
# 
# For quick testing, you can reduce the number of
# siteCrv inputs to decrease the computation time.
# URBGEN — Generative Urban Massing Tool
# 
# URBGEN is a GhPython-based generative urban
# massing tool for Grasshopper/Rhino that
# automatically generates 3D building
# configurations from site boundaries and planning
# constraints. The tool enables rapid exploration of
# seven building typologies while targeting FAR
# and BCR requirements, supporting early-stage
# 
# urban design and design-space exploration.
# 
# 
# 
# Developed by: Trong-Tin Tran, Ying-Chieh Chan
# 
# Email: trongtintr@outlook.com/ D14521024@ntu.edu.tw
# 
# Lab: Ying-Chieh Chan's Lab, National Taiwan University
# INPUT SITE BOUNDARY
curve_11 = Curve(<curve referenced from the Rhino model>)
merge = Merge(
    Data1=curve_11,
    Data2=curve_5,
    Data3=curve_6,
    Data4=curve_7,
    Data5=curve,
    Data6=curve_8,
    Data7=curve_2,
    Data8=curve_3,
    Data9=curve_9,
    Data10=curve_10,
    Data11=curve_4)

curve_12 = Curve(<curve referenced from the Rhino model>)

# ---- group: Run it...
boolean_toggle = BooleanToggle(True)

# ----
curve_13 = Curve(curve_12)
curve_14 = Curve()
count = Slider(0, range=0..10000)
mode = Slider(3, range=0..10)
jitter = Slider(0, range=0..1)
angle = Slider(83, range=0..100)
curve_15 = Curve(<curve referenced from the Rhino model>)
area = Area(Geometry=merge)  # -> Area, Centroid
boundary_surfaces = BoundarySurfaces(Edges=merge)
# FAR
far = GenePool(Decimals=0, Maximum=7, Minimum=1, Value=[1, 2, 3, 4, 5, 6, 7, 6, 5, 4, 3])
# BCR
bcr = GenePool(Decimals=1, Maximum=0.6, Minimum=0.3, Value=[0.3, 0.45, 0.5, 0.4, 0.4, 0.6, 0.6, 0.5, 0.45, 0.4, 0.45])
# TYPOLOGY
typologies = GenePool(Decimals=0, Maximum=7, Minimum=0, Value=[7, 0, 3.5, 1, 3.5, 5, 3.5, 6, 3, 2, 6])
# HEIGHT VARIATION
height_variation = GenePool(Decimals=1, Maximum=0.7, Minimum=0.1, Value=[0.1, 0.4, 0.5, 0.2, 0.3, 0.6, 0.2, 0.5, 0.4, 0.3, 0.5])
list_indices = ListIndices(List=merge)
urbgen_populate_region = PopulateByDistance(Crv=curve_13, Count=count, Mode=mode, Jitter=jitter, Angle=angle, MinDist=Slider(5, range=0..10), Holes=curve_15)  # -> Pts; inputs Crv: Curve, Count: Int32, Mode: Double, Jitter: Double, Seed: Int32, MinDist: Double, Holes: list of Curve
#   port Crv: Closed planar boundary (site outline). Open or non-planar curves return empty.
#   port Count: Target number of points. In grid modes this is approximate — spacing is solved automatically to within ±2%
#   port Mode: 0 = Random · 1 = Regular grid · 2 = Jittered grid · 3 = Staggered grid (triangular). Default 0
#   port Angle: Grid rotation about the curve plane's Z axis, in radians. Modes 1–3 only. Use a Degrees→Radians component if working in degrees.
#   port Seed: Random seed. Same seed → same result. Affects Mode 0 and 2 only. Default 0.
#   port MinDist: (Optional) Minimum spacing between points (model units). Mode 0 only. Set around 0.55·√(A/Count); above 0.7·√(A/Count) the count will fall short. Leave empty to disable.
#   port Holes: Closed inner curves to exclude (courtyards, existing blocks, easements). Subtracted from area when solving grid spacing.
#   port Pts: Points inside the boundary. Ordered by grid row (Modes 1–3) or by generation order (Mode 0).
# ---------- urbgen_populate_region: Python ----------
# -*- coding: utf-8 -*-
"""UrbGEN_PopulateRegion - rai diem trong closed curve.
Che do tu nhan theo input:
  - Count > 0  : THEO SO LUONG. Giu nguyen Mode (grid tu giai buoc luoi de sat Count).
                 MinDist (neu co) la rang buoc khoang cach toi thieu.
  - Count trong: THEO KHOANG CACH. So diem ~ dien tich / MinDist^2, tu doi theo boundary.
Mode: 0=random (by count) / Poisson disk (by distance)  1=grid  2=jittered grid  3=staggered (hex)
Inputs : Crv, Count, Mode, Jitter, Angle, Seed, MinDist, Holes
Outputs: Pts, Info
"""
import Rhino.Geometry as rg
import scriptcontext as sc
import random, math

MAX_PTS = 500000
N_BANDS = 256
SQ2 = math.sqrt(2.0)
SQ3 = math.sqrt(3.0)
# o lan can cho spatial hash (bo 4 goc: khoang cach >= r)
_NB = [(i, j) for i in range(-2, 3) for j in range(-2, 3) if abs(i) + abs(j) < 4]


# ---------- MAT PHANG & CHUYEN CURVE -> POLYGON 2D ----------
def _plane(crv, tol, angle):
    ok, pl = crv.TryGetPlane(tol)
    if not ok:
        pl = rg.Plane.WorldXY
    # curve nam ngang -> neo vao goc toa do the gioi: luoi khong troi khi sua boundary
    if pl.ZAxis.IsParallelTo(rg.Vector3d.ZAxis, 1e-3) != 0:
        pl = rg.Plane(rg.Point3d(0, 0, pl.Origin.Z), rg.Vector3d.XAxis, rg.Vector3d.YAxis)
    if angle:
        pl.Rotate(angle, pl.ZAxis, pl.Origin)
    return pl


def _loop2d(crv, pl, tol):
    ok, pln = crv.TryGetPolyline()
    if not ok:
        pc = crv.ToPolyline(tol, 0.05, 0.0, 0.0)
        if pc is None:
            return None
        ok, pln = pc.TryGetPolyline()
        if not ok:
            return None
    pts = []
    for i in range(pln.Count):
        ok, q = pl.RemapToPlaneSpace(pln[i])
        pts.append((q.X, q.Y, q.Z))
    if len(pts) > 1 and abs(pts[0][0] - pts[-1][0]) < 1e-12 and abs(pts[0][1] - pts[-1][1]) < 1e-12:
        pts.pop()
    return pts if len(pts) >= 3 else None


# ---------- VUNG 2D: point-in-polygon chia bang theo Y ----------
class _Region(object):
    """loops[0] = bien ngoai, loops[1:] = holes. Moi lan kiem tra chi duyet canh trong 1 bang."""

    def __init__(self, loops):
        xs = [p[0] for p in loops[0]]
        ys = [p[1] for p in loops[0]]
        self.x0, self.x1, self.y0, self.y1 = min(xs), max(xs), min(ys), max(ys)
        self.bh = max((self.y1 - self.y0) / N_BANDS, 1e-9)
        self.bands = {}
        self.area = 0.0
        for lid, L in enumerate(loops):
            n = len(L)
            a = 0.0
            for i in range(n):
                ax, ay = L[i][0], L[i][1]
                bx, by = L[(i + 1) % n][0], L[(i + 1) % n][1]
                a += ax * by - bx * ay
                if ay == by:
                    continue
                e = (ax, ay, by, (bx - ax) / (by - ay), lid)
                for b in range(self._b(min(ay, by)), self._b(max(ay, by)) + 1):
                    self.bands.setdefault(b, []).append(e)
            self.area += abs(a) * 0.5 if lid == 0 else -abs(a) * 0.5
        self.area = max(self.area, 0.0)

    def _b(self, y):
        return int(math.floor((y - self.y0) / self.bh))

    def contains(self, x, y):
        if x < self.x0 or x > self.x1 or y < self.y0 or y > self.y1:
            return False
        es = self.bands.get(self._b(y))
        if not es:
            return False
        par = set()                      # chan/le theo tung loop
        for ax, ay, by, k, lid in es:
            if (ay > y) != (by > y) and x < ax + (y - ay) * k:
                if lid in par:
                    par.remove(lid)
                else:
                    par.add(lid)
        return 0 in par and len(par) == 1


# ---------- SPATIAL HASH cho rang buoc MinDist ----------
class _Hash(object):
    def __init__(self, r, x0, y0):
        self.r2 = r * r
        self.inv = SQ2 / r
        self.x0, self.y0 = x0, y0
        self.g = {}

    def key(self, u, v):
        return (int((u - self.x0) * self.inv), int((v - self.y0) * self.inv))

    def free(self, u, v):
        i, j = self.key(u, v)
        g, r2 = self.g, self.r2
        for di, dj in _NB:
            q = g.get((i + di, j + dj))
            if q is not None:
                dx, dy = q[0] - u, q[1] - v
                if dx * dx + dy * dy < r2:
                    return False
        return True

    def add(self, u, v):
        self.g[self.key(u, v)] = (u, v)


# ---------- MODE 0 ----------
def _poisson(R, r, rnd, k=30):
    """Theo khoang cach: Poisson disk (Bridson), phu kin vung."""
    x0, x1, y0, y1 = R.x0, R.x1, R.y0, R.y1
    H = _Hash(r, x0, y0)
    out, active = [], []
    uni, rr, TWO_PI = rnd.uniform, rnd.random, 2.0 * math.pi

    def ok(u, v):
        return (x0 <= u <= x1 and y0 <= v <= y1) and H.free(u, v) and R.contains(u, v)

    while True:
        seeded = False                   # gieo mam moi cho vung bi holes chia cat
        for _ in range(300):
            u, v = uni(x0, x1), uni(y0, y1)
            if ok(u, v):
                H.add(u, v); out.append((u, v)); active.append((u, v))
                seeded = True
                break
        if not seeded:
            break
        while active:
            idx = int(rr() * len(active))
            u, v = active[idx]
            for _ in range(k):
                a = TWO_PI * rr()
                d = r * math.sqrt(1.0 + 3.0 * rr())      # vanh khuyen [r, 2r]
                cu, cv = u + d * math.cos(a), v + d * math.sin(a)
                if ok(cu, cv):
                    H.add(cu, cv); out.append((cu, cv)); active.append((cu, cv))
                    break
            else:
                active[idx] = active[-1]
                active.pop()
    return out


def _random(R, count, md, rnd, max_try_factor=200):
    """Theo so luong: ngau nhien deu, tuy chon MinDist."""
    x0, x1, y0, y1 = R.x0, R.x1, R.y0, R.y1
    H = _Hash(md, x0, y0) if md > 0 else None
    out, tries, max_try = [], 0, int(count * max_try_factor)
    uni = rnd.uniform
    while len(out) < count and tries < max_try:
        tries += 1
        u, v = uni(x0, x1), uni(y0, y1)
        if not R.contains(u, v):
            continue
        if H:
            if not H.free(u, v):
                continue
            H.add(u, v)
        out.append((u, v))
    return out


# ---------- MODE 1-3: LUOI NEO CO DINH ----------
def _h01(seed, a, b):
    """so gia ngau nhien [0,1) gan voi o luoi (nhanh hon tao Random moi o)."""
    h = ((seed * 2654435761) ^ (a * 73856093) ^ (b * 19349663)) & 0xFFFFFFFF
    h = ((h ^ (h >> 15)) * 2246822519) & 0xFFFFFFFF
    h = ((h ^ (h >> 13)) * 3266489917) & 0xFFFFFFFF
    h ^= h >> 16
    return (h & 0xFFFFFF) / 16777216.0


def _lattice(R, step, mode, jit, seed):
    stagger = (mode == 3)
    dy = step * SQ3 / 2.0 if stagger else step
    x0, x1, y0, y1 = R.x0, R.x1, R.y0, R.y1
    pad = 0.5 * jit * step
    out = []
    contains = R.contains
    for jj in range(int(math.floor((y0 - pad) / dy)), int(math.ceil((y1 + pad) / dy)) + 1):
        yv = jj * dy
        off = 0.5 * step if (stagger and jj % 2) else 0.0
        for ii in range(int(math.floor((x0 - off - pad) / step)),
                        int(math.ceil((x1 - off + pad) / step)) + 1):
            xv, yj = ii * step + off, yv
            if jit > 0:
                xv += (_h01(seed, ii, jj) - 0.5) * jit * step
                yj += (_h01(seed + 7919, ii, jj) - 0.5) * jit * dy
            if contains(xv, yj):
                out.append((xv, yj))
    return out


def _lattice_count(R, count, mode, jit, seed, md):
    """Theo so luong: giai buoc luoi (so diem ~ 1/step^2) de sat Count."""
    s = math.sqrt(R.area / float(count))
    if mode == 3:
        s *= math.sqrt(2.0 / SQ3)
    s_min = md / (1.0 - jit) if md > 0 else 0.0
    s = max(s, s_min)
    best, best_s = None, s
    tol_n = max(1, int(count * 0.02))
    for _ in range(10):
        pts = _lattice(R, s, mode, jit, seed)
        if best is None or abs(len(pts) - count) < abs(len(best) - count):
            best, best_s = pts, s
        if abs(len(pts) - count) <= tol_n:
            break
        s_new = s * 0.5 if not pts else s * math.sqrt(len(pts) / float(count))
        s_new = max(s_new, s_min)
        if abs(s_new - s) <= 1e-9 * s:
            break                        # cham rang buoc MinDist -> chap nhan thieu
        s = s_new
    return best, best_s


# ---------- MAIN ----------
def populate_region(crv, count=0, min_dist=0.0, holes=None, mode=0,
                    seed=0, jitter=0.0, angle=0.0):
    tol = sc.doc.ModelAbsoluteTolerance if sc.doc else 0.001
    if crv is None:
        return [], "No input"
    if not crv.IsClosed:
        return [], "Curve khong kin"
    count = int(count) if count and count > 0 else 0
    md = float(min_dist) if min_dist and min_dist > 0 else 0.0
    if not count and not md:
        return [], "Can Count > 0 (theo so luong) hoac MinDist > 0 (theo khoang cach)"
    mode = int(mode) if mode in (0, 1, 2, 3) else 0
    jit = min(max(float(jitter or 0.0), 0.0), 0.9) if mode == 2 else 0.0

    pl = _plane(crv, tol, angle)
    outer = _loop2d(crv, pl, tol)
    if outer is None:
        return [], "Khong chuyen duoc Crv sang polyline"
    loops = [outer]
    for h in (holes or []):
        if h and h.IsClosed:
            L = _loop2d(h, pl, tol)
            if L:
                loops.append(L)
    z = sum(p[2] for p in outer) / len(outer)
    R = _Region(loops)
    if R.area <= 0:
        return [], "Area = 0"
    rnd = random.Random(seed)
    names = {1: "grid", 2: "jittered grid", 3: "staggered grid"}

    if count:  # ===== THEO SO LUONG =====
        if count > MAX_PTS:
            return [], "Count qua lon"
        if mode == 0:
            uv, tag = _random(R, count, md, rnd), "random"
        else:
            uv, s = _lattice_count(R, count, mode, jit, seed, md)
            if len(uv) > count:          # cat bot ngau nhien cho dung Count
                idx = list(range(len(uv)))
                rnd.shuffle(idx)
                uv = [uv[i] for i in sorted(idx[:count])]
            tag = "{0} step={1:.3f}".format(names[mode], s)
        info = "by count | {0} | {1}/{2}".format(tag, len(uv), count)
        if md:
            info += " | d>={0}".format(md)
    else:      # ===== THEO KHOANG CACH =====
        if (R.x1 - R.x0) * (R.y1 - R.y0) / (md * md) > MAX_PTS:
            return [], "MinDist qua nho so voi boundary"
        if mode == 0:
            uv, tag = _poisson(R, md, rnd), "poisson"
        else:
            uv, tag = _lattice(R, md / (1.0 - jit), mode, jit, seed), names[mode]
        info = "by distance | {0} | {1} pts | d>={2}".format(tag, len(uv), md)

    return [pl.PointAt(u, v, z) for u, v in uv], info


# ---------- TOOLTIPS ----------
_TIPS_IN = {
    "Crv": "Closed planar boundary curve (site outline).\n"
           "Points are placed strictly inside it.",
    "Count": "Target number of points.\n"
             "> 0 : run BY COUNT - Mode is kept; grid modes solve the spacing to match Count (within 2%).\n"
             "0 / empty : run BY DISTANCE - count follows boundary area / MinDist^2.",
    "Mode": "Distribution pattern:\n"
            "  0 = Random (by count) / Poisson disk (by distance) (default)\n"
            "  1 = Grid - square lattice\n"
            "  2 = Jittered grid - lattice with random offset (see Jitter)\n"
            "  3 = Staggered grid - hexagonal lattice\n"
            "Modes 1-3 are anchored to world XY: points stay fixed when the boundary is edited.",
    "Jitter": "Random offset strength, Mode 2 only (0 - 0.9, default 0).\n"
              "0 = regular grid, 0.9 = very irregular.\n"
              "When MinDist is set, the step is enlarged to MinDist / (1 - Jitter) so MinDist still holds.",
    "Angle": "Rotation of the pattern in radians around the curve plane's Z axis (default 0).\n"
             "Use it to align grid rows with a street or site edge.",
    "Seed": "Random seed (integer, default 0). Same seed + same inputs = same result.\n"
            "Affects Mode 0 layout and Mode 2 offsets.",
    "MinDist": "Minimum distance between points (model units).\n"
               "By distance (Count empty): required - sets the spacing / density.\n"
               "By count: optional constraint - Mode 0 rejects closer points,\n"
               "Modes 1-3 use it as the smallest grid step. Count may fall short if it is too large.",
    "Holes": "Optional closed curves (list access) excluded from the region,\n"
             "e.g. courtyards, existing blocks, easements.",
}
_TIPS_OUT = {
    "Pts": "Points inside the region. Ordered by grid row (Modes 1-3) or generation order (Mode 0).",
    "Info": "Summary: run type | mode | point count | spacing, or an error message.",
}


def _set_tooltips():
    try:
        comp = ghenv.Component
    except NameError:
        return
    comp.Description = ("Populate a closed region with points.\n"
                        "Count > 0: by count. Count empty: by minimum distance (MinDist).")
    for p in comp.Params.Input:
        t = _TIPS_IN.get(p.NickName)
        if t:
            p.Description = t
    for p in comp.Params.Output:
        t = _TIPS_OUT.get(p.NickName)
        if t:
            p.Description = t


_set_tooltips()

Pts, Info = populate_region(
    Crv,
    Count if Count else 0,
    MinDist if MinDist else 0.0,
    Holes,
    Mode if Mode else 0,
    Seed if Seed is not None else 0,
    Jitter if Jitter else 0.0,
    Angle if Angle else 0.0,
)
# ---------- end urbgen_populate_region ----------
text_tag = TextTag(Location=area.Centroid, Text=list_indices)
number_slider = Slider(1, range=0..1)
movetoboundary = BooleanToggle(True)
movealltosetback = BooleanToggle(True)
aligntowerstoedge = BooleanToggle(True)
edgealignbothorientations = BooleanToggle(True)
movetowertopodiumedge = BooleanToggle(True)
enforceheightregulation = BooleanToggle(False)
heightregulationmode = ValueList({"No limit": 0, "Strict": 1, "70% Flexible": 2}, selected="Strict")
minwidth = Slider(20, range=0..100)
towersizemode = Slider(3, range=0..3)
minfootprintpertower = Slider(500, range=0..2000)
mintowerdistance = Slider(15, range=0..100)
towergrowiterations = Slider(100, range=0..100)
podiumfloors = Slider(1, range=0..10)
podiumminoffset = Slider(1, range=0..20)
podiummaxoffset = Slider(7, range=0..20)
uniformrotationdeg = Slider(98, range=0..180)
maxfootprintpertower = Slider(4000, range=0..10000)
maxlengthwidthratio = Slider(3, range=2..4)
towerbcrpriority = Slider(0.7, range=0..1)
towergrowstep = Slider(10, range=0..10)
seed = Slider(60, range=0..1000)
towertypologymode = Slider(0, range=0..7)
floorheight = Slider(3.6, range=0..10)
globalrotationmode = Slider(0, range=0..2)
heightvariation = Slider(0.3, range=0..1)
maxbuildingheight = Slider(50, range=0..100)
minbuildingheight = Slider(10, range=0..10)
armlengthratio = Slider(1.5, range=0.4..1.6)
setback = Slider(5, range=0..10)
upperbcr = Slider(0.5, range=0.3..0.6)
upperfar = Slider(3, range=0..10)
courtyardcount = Slider(1, range=0..3)
courtyardbreakcount = Slider(4, range=0..10)
courtyardbreakwidth = Slider(5, range=0..30)
courtyardzonegap = Slider(9, range=0..10)
splitangle = Slider(0, range=-45..45)
shift = Slider(50, range=0..360)
courtyardlayoutmode = Slider(1, range=0..1)
urbgen_massing_generator = Python3Script(
    siteCrv=curve_13,
    centroids=urbgen_populate_region,
    setback=setback,
    FAR=upperfar,
    BCR=upperbcr,
    upperBCR=upperbcr,
    minWidth=minwidth,
    towerSizeMode=towersizemode,
    minFootprintPerTower=minfootprintpertower,
    maxFootprintPerTower=maxfootprintpertower,
    maxLengthWidthRatio=maxlengthwidthratio,
    minTowerDistance=mintowerdistance,
    towerBCRPriority=towerbcrpriority,
    towerGrowStep=towergrowstep,
    towerGrowIterations=towergrowiterations,
    seed=seed,
    towerTypologyMode=towertypologymode,
    armLengthRatio=armlengthratio,
    podiumFloors=podiumfloors,
    podiumMinOffset=podiumminoffset,
    podiumMaxOffset=podiummaxoffset,
    floorHeight=floorheight,
    globalRotationMode=globalrotationmode,
    uniformRotationDeg=uniformrotationdeg,
    courtyardCount=courtyardcount,
    courtyardBreakCount=courtyardbreakcount,
    courtyardBreakWidth=courtyardbreakwidth,
    courtyardZoneGap=courtyardzonegap,
    courtyardSplitAngle=splitangle,
    courtyardBreakShift=shift,
    courtyardLayoutMode=courtyardlayoutmode,
    heightVariation=heightvariation,
    enforceHeightRegulation=enforceheightregulation,
    heightRegulationMode=heightregulationmode,
    maxBuildingHeight=maxbuildingheight,
    minBuildingHeight=minbuildingheight,
    moveToBoundary=movetoboundary,
    moveAllToSetback=movealltosetback,
    alignTowersToEdge=aligntowerstoedge,
    edgeAlignBothOrientations=edgealignbothorientations,
    moveTowerToPodiumEdge=movetowertopodiumedge,
    Run=boolean_toggle)  # -> port, TowerFootprints, TowerMasses, PodiumFootprints, PodiumMasses, UnionFootprint, BuildableSite, siteOriginal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; inputs siteCrv: list of Curve, centroids: tree of Point3d, setback: list of Double, FAR: list of Double, BCR: list of Double, upperBCR: list of Double, minWidth: list of Double, towerSizeMode: list of Int32, minFootprintPerTower: list of Double, maxFootprintPerTower: list of Double, maxLengthWidthRatio: list of Double, minTowerDistance: list of Double, towerBCRPriority: list of Double, towerGrowStep: list of Double, towerGrowIterations: list of Int32, seed: list of Int32, towerTypologyMode: list of Int32, armLengthRatio: list of Double, podiumFloors: list of Int32, podiumMinOffset: list of Double, podiumMaxOffset: list of Double, floorHeight: list of Double, globalRotationMode: list of Int32, uniformRotationDeg: list of Double, courtyardCount: list of Int32, courtyardBreakCount: list of Int32, courtyardBreakWidth: list of Double, courtyardZoneGap: list of Double, courtyardSplitAngle: list of Double, courtyardBreakShift: list of Double, courtyardLayoutMode: list of Int32, heightVariation: list of Double, enforceHeightRegulation: list of Boolean, heightRegulationMode: list of Int32, maxBuildingHeight: list of Double, minBuildingHeight: list of Double, moveToBoundary: list of Boolean, moveAllToSetback: list of Boolean, alignTowersToEdge: list of Boolean, edgeAlignBothOrientations: list of Boolean, moveTowerToPodiumEdge: list of Boolean, Run: Boolean
#   port IIIIISITEandPLANNINGTARGET: Site & Planning Targets group
#   port siteCrv: Closed planar site boundary curve. All geometry is generated inside this outline. Must be closed, planar and lie on the WorldXY plane.
#   port centroids: Candidate seed points for tower placement. Points outside the setback line are discarded. Ignored entirely when towerTypologyMode = 7 (Courtyard), which derives its layout from the site outline instead.
#   port setback: Setback distance (m) offset inward from the site boundary. Defines the buildable area; every footprint must sit fully inside it. If the offset fails, the full site boundary is used instead.
#   port FAR: Target Floor Area Ratio. Total GFA (podium + towers) divided by site area. Drives the number of floors assigned to each tower 4=400% 5=500%
#   port IIIIIIIIIIIIIIIIIISIZINGandDENSITY: Tower Sizing & Density group
#   port minWidth: Base width (m) of every tower slab, i.e. the short side of the spine rectangle. Also the fixed band width for Courtyard typology. Values below 2.0 m are clamped.
#   port towerSizeMode: Footprint size strategy. 0 = Compact (small footprints, skewed low), 1 = Medium (mid range), 2 = Maximized (large footprints, skewed high), 3 = Random uniform. For Courtyard typology this instead controls break-point density and building length on the ring.
#   port minFootprintPerTower: Minimum allowed footprint area (m²) per tower. Candidates below this are rejected during placement. Minimum 20 m².
#   port maxFootprintPerTower: Maximum allowed footprint area (m²) per tower, including all attached arm modules. Caps spine length growth. Forced to be at least minFootprintPerTower + 30.
#   port maxLengthWidthRatio: Maximum slenderness of a tower: spine length ÷ width. Prevents excessively elongated slabs. Minimum 2.0.
#   port minTowerDistance: Minimum clear distance (m) between any two building footprints. Enforced during placement, growth, rotation and all move operations.
#   port towerBCRPriority: Share of the BCR target (0–1) to be carried by tower footprints before the podium is generated. Higher = taller/thicker towers and a thinner podium; lower = a larger podium skirt.
#   port towerGrowStep: Length increment (m) added to a tower's spine per growth attempt while converging on the tower BCR target. Smaller = finer convergence but slower.
#   port seed: Random seed controlling point ordering, rotation angles, size sampling, podium noise and height distribution. Same seed = identical result. Taken modulo 10000.
#   port IIIIIIIIIIIIIIIIIIIIIIIIIIIIIIITYPOLOGY: Building Typology group
#   port towerTypologyMode: Building footprint shape. 0 = I (plain rectangle), 1 = L, 2 = T, 3 = H, 4 = C/U, 5 = Plus (+), 6 = Random per tower (picks 0–5), 7 = Courtyard (perimeter ring blocks; uses the site outline instead of centroids).
#   port armLengthRatio: Length of each attached arm module as a multiple of minWidth. Only affects typologies 1–5. Auto-tuned by ±30% if the tower BCR target is missed. Minimum 0.3.
#   port podiumFloors: Number of podium floors. Podium height = podiumFloors × floorHeight. Towers are extruded starting from the top of the podium.
#   port podiumMinOffset: Lower bound (m) for the podium offset search. The podium is the tower footprints offset outward by this distance, unioned, then clipped to the setback line.
#   port podiumMaxOffset: Upper bound (m) for the podium offset search. Additionally capped at 35% of √(site area). Forced to be at least podiumMinOffset + 0.5.
#   port IIIIIIIIIIIIIIIIIIIIIIIIIIIIIIIROTATION: Rotation group
#   port globalRotationMode: Rotation strategy. 0 = per-tower random angle from a candidate set, 1 = uniform fixed angle for all towers (uses uniformRotationDeg), 2 or 3 = one randomly chosen angle from 0/45/90/135/180 applied to all towers.
#   port uniformRotationDeg: Rotation angle in degrees applied to every tower when globalRotationMode = 1. Ignored in all other modes. Clamped 0–180.
#   port IIIIIIIIIIIIIIIIIIIIIIIIIIIICOURTYARD: Courtyard setting group
#   port courtyardCount: Number of separate courtyard zones the site is split into. Each zone produces its own ring of perimeter buildings around an open central void. Minimum 1.
#   port courtyardBreakCount: Base number of gaps cut into each courtyard ring. Adjusted by towerSizeMode: Compact adds gaps (more, shorter blocks), Maximized removes them (fewer, longer blocks).
#   port courtyardZoneGap: Clear distance (m) left between adjacent courtyard zones so separate rings never touch. Only applies when courtyardCount > 1.
#   port courtyardSplitAngle: Rotation (degrees) of the zone-splitting axis relative to the site's longer bounding-box axis. 0 = split strictly along that axis. Clamped −45 to +45.
#   port courtyardBreakShift: Distance (m) to shift break/cluster positions clockwise along the ring perimeter; wraps around. Used in Cluster layout and in the smooth-boundary fallback of Corner layout.
#   port courtyardLayoutMode: Ring layout strategy. 0 = Corner: one building anchored at each polygon corner growing outward along both edges, gaps land mid-edge (courtyardBreakShift ignored). 1 = Cluster: all buildings grouped into one contiguous run separated by courtyardBreakWidth, shifted around the ring by courtyardBreakShift.
#   port IIIIIIIIIIIIIIIIIIIIIIIIIIPOSITIONING: Post-Placement Positioning Group
#   port moveToBoundary: Push each tower outward along the direction from the site centroid through the tower, until it reaches the setback line or is blocked by another building. Radial spread; creates an open centre. Skipped for Courtyard typology.
#   port moveAllToSetback: Push every building along the shortest (perpendicular) direction to the nearest point on the setback line, rather than radially from the centre. Produces buildings hugging the site edges. Skipped for Courtyard typology.
#   port alignTowersToEdge: Rotate each building in place, centre unchanged, so it lines up with the nearest boundary edge. Applied both at initial placement and again after the move steps, so alignment reflects each tower's final position. Skipped for Courtyard typology, which already follows the boundary.
#   port edgeAlignBothOrientations: Fallback behaviour for edge alignment. True = if the long-edge-parallel rotation is blocked (leaves the site, overlaps, or breaks minTowerDistance), try the perpendicular orientation instead. False = only attempt the parallel orientation, otherwise keep the existing angle. Long-edge alignment is always attempted for every building before any short-edge fallback.
#   port moveTowerToPodiumEdge: After the podium is built, slide each tower inside its own podium footprint toward the podium edge nearest the setback line, without changing the podium shape. Result: the tower sits flush on the street side while the podium stays wider behind it. Requires podium offset > 0.
#   port TowerFootprints: Ground footprint curve of each tower/block
#   port TowerMasses: 3D tower solids, extruded from the podium top level
#   port PodiumFootprints: Podium outlines after boolean union and clipping to the setback line
#   port PodiumMasses: 3D podium solids
#   port BuildableSite: Site boundary after applying setback
#   port siteOriginal: The original input site boundary
#   port TowerCentroids: Final centres after all move operations
#   port TowerAngles: Final rotation angle (degrees) after the align step
#   port TowerTypologies: Typology code 0–7
#   port TowerTypologyNames: Typology name: I / L / T / H / C / Plus / Courtyard
#   port TowerLengthUsed: Actual spine length used per tower
#   port TowerWidthUsed: Slab width (= clamped minWidth)
#   port TowerSizeRatio: Length / width ratio per tower
#   port NumTowers: Final tower/block count
#   port TowerTotalArea: Total ground area covered by towers
#   port UnionArea: Total covered area and its coverage ratio
#   port UnionBCR: Total covered area and its coverage ratio
#   port TowerCoverageRatio: Share of the target BCR area achieved
#   port PodiumCoverageRatio: Share of the target BCR area achieved
#   port TowerAreaPercentOfSite: Share of the site area covered
#   port PodiumAreaPercentOfSite: Share of the site area covered
#   port TotalBuildingHeights: Total height including the podium
#   port HeightVariationOutputs: Full bundle: min/max/avg, StdDev, CV, Q1/Median/Q3/IQR, per-tower HeightDetails
# ---------- urbgen_massing_generator: Python ----------
# r: numpy
# =====================================================================
# MULTI-SITE PARAMETRIC URBAN MASSING GENERATOR
# Rhino 8 / GhPython 3 (CPython 3.9)  --  PERFORMANCE BUILD
# =====================================================================
# This build keeps ALL input / output names of the original IronPython
# version. Only the computational core has changed.
#
# ---------------------------------------------------------------------
# STAGE 1 - fewer RhinoCommon calls (geometric results unchanged)
# ---------------------------------------------------------------------
#  [1] Fixed the bounding-box filter bug. The original used
#          if not rg.BoundingBox.Intersection(a, b)
#      BoundingBox is a struct and is always truthy -> the condition was
#      NEVER true -> every curve pair fell through to
#      CreateBooleanIntersection. Replaced by the pure-arithmetic
#      _bbox_disjoint().
#  [2] violates_tower_spacing() no longer offsets every tower on every
#      check. Uses Curve.ClosestPoints (1 call) + a padded bbox filter.
#  [3] create_typology_curve() builds a prototype at the origin, caches
#      it with lru_cache, then transforms it. No repeated BooleanUnion.
#  [4] Polygon area / centroid via the shoelace formula instead of
#      AreaMassProperties.Compute (fallback only when no polyline exists).
#  [5] Closest boundary point via Curve.ClosestPoint instead of a
#      200-point sample array + min() loop.
#  [6] is_inside_boundary() pre-filters by bbox before calling
#      PlanarClosedCurveRelationship.
#  [7] Validity check order: area -> bbox -> spacing -> overlap ->
#      inside boundary (cheap first, expensive last).
#  [8] Running sums instead of repeated sum(...) inside loops.
#  [9] numpy for: GFA floor adjustment, height statistics, distance
#      sorting, batch bbox filtering when n is large.
#
# ---------------------------------------------------------------------
# STAGE 2 - convergence algorithm changes (results may differ within tol.)
# ---------------------------------------------------------------------
# [10] find_optimal_podium_offset: regula-falsi + bracketing, ~8-14
#      iterations instead of 50 pure bisection steps.
# [11] Courtyard: zones / inner ring / corner params / arc-length table
#      are cached OUTSIDE the coverage loop (previously rebuilt every
#      step). Coverage converges by bisection instead of 0.02 x 80 steps.
# [12] The three move functions find the largest feasible displacement by
#      a full-span test + bisection (~8 checks) instead of 30-80 steps.
# [13] Podium union clusters curves by bbox before BooleanUnion (O(n^2)
#      only inside each disjoint cluster) and skips BooleanIntersection
#      when a piece already lies fully inside the boundary.
# [14] BCR shrink / expand loops exit early when no progress is made.
#
# ---------------------------------------------------------------------
# STAGE 3 - height regulation fix
# ---------------------------------------------------------------------
# [15] enforceHeightRegulation + heightRegulationMode = 1 (strict):
#      previously, after heights were clipped, adjust_floors_to_target()
#      re-added floors WITHOUT any height cap to recover the FAR target,
#      so some towers shot far above maxBuildingHeight. Now:
#        - every tower gets a hard floor cap
#              floor((maxBuildingHeight - podiumHeight) / floorHeight)
#        - heights -> floors use floor(), never round(), so rounding can
#          not push a tower past the cap
#        - missing GFA is redistributed only to towers that still have
#          headroom (adjust_floors_to_target_capped)
#        - if the cap makes the FAR target unreachable, the shortfall is
#          reported (HeightCapLimitedFAR / TowerGFAShortfall) instead of
#          breaking the regulation
#        - a final clamp + compliance check runs before extrusion.
#      Mode 2 (flexible) keeps its intended 70 % softening, but the GFA
#      redistribution can no longer raise a tower above its regulated
#      height.
#
# ---------------------------------------------------------------------
# STAGE 4 - NO FALLBACK GEOMETRY IN RESULTS
# ---------------------------------------------------------------------
# [16] A site either produces a fully constrained layout or it FAILS
#      (Success = False, empty geometry, reason in Errors / Report).
#      Removed substitutions that put non-compliant geometry in results:
#        - setback offset failure no longer falls back to the full site
#          boundary (that silently ignored the setback);
#        - supplied centroids that all lie outside the buildable site no
#          longer fall back to the site centroid;
#        - when no tower passes validation, the unvalidated single
#          I-shape "fallback tower" is no longer created;
#        - a final guard fails the site if BCR calibration leaves no
#          building.
#      The site centroid is still used as a DEFAULT seed point when no
#      centroids are supplied at all, but only if it lies inside the
#      buildable site, and the tower placed there must pass all checks.
#
# ---------------------------------------------------------------------
# STAGE 5 - EDGE ALIGNMENT + BCR CASCADE
# ---------------------------------------------------------------------
# [17] Edge alignment works on the real straight edges of the buildable
#      site (polyline segments, near-collinear pieces merged) instead of
#      the curve tangent at the closest point. Near a corner the longer
#      edge wins (the shorter one is tried second). The tangent at a
#      vertex used to pick an arbitrary edge.
# [18] L / C typologies: of the two 180-degree flips, the one whose spine
#      backs onto the boundary is tried first (arms open to the site).
# [19] A tower that cannot be rotated in place (it would spill over the
#      setback) is slid inward along the edge normal by the smallest
#      feasible distance instead of being left unaligned.
# [20] Pipeline order: ALIGN runs BEFORE move-to-boundary / move-to-
#      setback, so moving no longer happens on a rotation that is then
#      undone. Move-to-setback moves along the edge normal when the
#      perpendicular foot lies on an edge (stays parallel and flush).
# [21] New output TowerEdgeAngleError: deviation (deg) between each tower
#      spine and its governing boundary edge (0 = parallel).
# [22] BCR cascade rewritten (non-courtyard):
#        a) towers alone above target -> uniform spine rescale by
#           bisection; only if min-size towers still exceed it, remove the
#           building whose area best matches the excess;
#        b) podium offset solved by regula falsi to a tight tolerance
#           (0.4 % of target BCR area instead of 1.5 %);
#        c) if podiumMinOffset already overshoots -> towers rescaled under
#           a min-offset podium (bisection), compared with towers only;
#        d) if the podium saturates at podiumMaxOffset -> towers grow and
#           the offset is re-solved (up to 4 rounds); an unreachable
#           target is reported, not hidden.
#      The old x0.9 / x1.15 shrink-expand loop (which settled anywhere
#      between ~0.94 x BCR and upperBCR) is gone. Courtyard: coverage is
#      re-bisected against the FULL BCR target. upperBCR stays a hard
#      ceiling; exceeding it fails the site.
# [23] Adaptive arm length now rebuilds from the CURRENT (grown) tower
#      lengths; it used to rebuild from the initial lengths and silently
#      discard the growth of step 6.
# [24] podiumMaxOffset is no longer silently capped at 0.35 x sqrt(site).
#
# ---------------------------------------------------------------------
# STAGE 6 - SPEED (measured in Rhino 8 CPython: each .NET attribute read
#           costs ~1-2 us, shoelace on a 9-pt polyline ~62 us, bbox via
#           GetBoundingBox ~17 us, Curve.Offset ~1.3 ms, Boolean ~2.5 ms)
# ---------------------------------------------------------------------
# [25] Lazy typology footprints: create_typology_curve() returns a light
#      token; area comes from the cached prototype (rigid transforms keep
#      area) and the bbox is computed in pure Python from the prototype
#      vertices. The RhinoCommon curve is only built when a check really
#      needs it, so candidates rejected by the area / bbox filters never
#      touch RhinoCommon. Areas are now EXACT (0.1.17 carried ~1e-12
#      shoelace noise from rotated coordinates); geometry is identical,
#      but when several towers have the same area the floor distribution
#      may break ties differently than 0.1.17.
# [26] Pure-Python bboxes (_BB) everywhere, incl. the buildable site and
#      podium clustering -> no struct marshalling in the hot filters.
# [27] Spacing + overlap merged: when two towers are >= minTowerDistance
#      apart (ClosestPoints), they cannot intersect, so the 2.5 ms
#      CreateBooleanIntersection is replaced by a containment test.
# [28] create_individual_podiums is memoised per site on
#      (footprint objects, offset): the BCR cascade / regula falsi no
#      longer rebuild identical podiums (Offset + Union + Intersection).
# [29] Podium offset of typology-I towers is built analytically (sharp
#      offset of a rectangle = rectangle); sign verified once against
#      Curve.Offset at load time, fast path disabled if it does not match.
#      The `random` state after each call is stored and restored on a
#      memo hit, so results are bit-identical to 0.1.17.
#
# ---------------------------------------------------------------------
# STAGE 7 - NEAREST-EDGE PRIORITY
# ---------------------------------------------------------------------
# [30] A building is aligned to the boundary edge it is CLOSEST to; the
#      next-closest edge is the second choice. Ties only (corner
#      bisector) go to the edge the building fronts, then the longer
#      edge. Applies to initial placement angles, the align pass,
#      move-to-setback direction and TowerEdgeAngleError.
# [31] Priority order per tower: nearest edge parallel -> nearest edge
#      perpendicular -> next edge parallel -> next edge perpendicular.
#      Each option exhausts all placements first: inward slide, slide
#      along the edge (+ inward), then a shorter spine (down to 60 %,
#      never below min length / minFootprintPerTower). The BCR cascade
#      re-balances area afterwards.
#
# ---------------------------------------------------------------------
# ENVIRONMENT NOTES
# ---------------------------------------------------------------------
# - CPython in Rhino 8 has a higher marshalling cost per RhinoCommon call
#   than IronPython. Reducing the NUMBER of calls therefore matters more
#   here, not less.
# - NO per-site parallelism in this build: the CPython GIL makes
#   Parallel.For / ThreadPoolExecutor useless, and multiprocessing is not
#   available inside the Rhino process.
# - All random.seed(...) calls keep the original positions and values so
#   results can be compared between the two builds.
# - NEW outputs (non-breaking): `Timings` (per-stage time of each site),
#   `HeightCapLimitedFAR`, `TowerGFAShortfall`, `TowerFloorCap`.
# =====================================================================


# ==================================================
# INPUTS (connect from Grasshopper)  -- UNCHANGED
# ==================================================
# siteCrv: Curve                (LIST ACCESS)
# centroids: List(Point3d)      NOTE: ignored when towerTypologyMode == 7
# FAR, BCR, setback, podiumFloors, floorHeight, minWidth, heightVariation
# towerSizeMode, seed, podiumMinOffset, podiumMaxOffset
# globalRotationMode, uniformRotationDeg
# minFootprintPerTower, maxFootprintPerTower
# minTowerDistance, towerGrowStep, towerGrowIterations
# maxLengthWidthRatio, towerBCRPriority, upperBCR
# towerTypologyMode, armLengthRatio
# courtyardCount, courtyardBreakCount, courtyardBreakWidth,
# courtyardZoneGap, courtyardSplitAngle, courtyardBreakShift,
# courtyardLayoutMode
# maxBuildingHeight, minBuildingHeight, heightRegulationMode,
# enforceHeightRegulation
# moveToBoundary, moveAllToSetback, moveTowerToPodiumEdge
# alignTowersToEdge, edgeAlignBothOrientations
# Run: bool                     (gate)
# ==================================================

import math
import random
import time
from bisect import bisect_left
from functools import lru_cache

import Rhino.Geometry as rg

try:
    import numpy as np
    HAS_NP = True
except Exception:
    np = None
    HAS_NP = False

try:
    from Grasshopper import DataTree
    from Grasshopper.Kernel.Data import GH_Path
    HAS_GH = True
except Exception:
    HAS_GH = False


# =====================================================================
# PART 0 - FAST GEOMETRY UTILITIES
# =====================================================================

TYPOLOGY_NAMES = {0: "I", 1: "L", 2: "T", 3: "H", 4: "C", 5: "Plus", 7: "Courtyard"}
COVERAGE_MIN, COVERAGE_MAX = 0.30, 0.95

# element-count threshold for the numpy path (below it, overhead > benefit)
NP_THRESHOLD = 16


def _polyline_of(curve):
    """Return the Polyline if the curve is a polyline, otherwise None."""
    try:
        ok, pl = curve.TryGetPolyline()
    except Exception:
        return None
    if ok and pl is not None and pl.Count > 2:
        return pl
    return None


def _fast_area(curve):
    """[S1-4] Shoelace for polylines; fallback to AreaMassProperties."""
    pl = _polyline_of(curve)
    if pl is not None:
        n = pl.Count
        acc = 0.0
        for i in range(n - 1):
            p = pl[i]
            q = pl[i + 1]
            acc += p.X * q.Y - q.X * p.Y
        if not pl.IsClosed:
            p = pl[n - 1]
            q = pl[0]
            acc += p.X * q.Y - q.X * p.Y
        return abs(acc) * 0.5
    try:
        pr = rg.AreaMassProperties.Compute(curve)
        return pr.Area if pr else 0.0
    except Exception:
        return 0.0


def _fast_centroid(curve):
    """[S1-4] Polygon centroid by formula; fallback to AreaMassProperties."""
    pl = _polyline_of(curve)
    if pl is not None:
        n = pl.Count
        a2 = 0.0
        cx = 0.0
        cy = 0.0
        idx = list(range(n - 1)) if pl.IsClosed else list(range(n))
        for i in idx:
            p = pl[i]
            q = pl[(i + 1) % n]
            cross = p.X * q.Y - q.X * p.Y
            a2 += cross
            cx += (p.X + q.X) * cross
            cy += (p.Y + q.Y) * cross
        if abs(a2) > 1e-12:
            return rg.Point3d(cx / (3.0 * a2), cy / (3.0 * a2), 0.0)
    try:
        pr = rg.AreaMassProperties.Compute(curve)
        if pr:
            return pr.Centroid
    except Exception:
        pass
    try:
        return curve.PointAtStart
    except Exception:
        return rg.Point3d(0, 0, 0)


def _region_area(curve):
    return _fast_area(curve)


def _bbox_disjoint(a, b, pad=0.0):
    """[S1-1] True if the two bboxes are DISJOINT. Replaces the original
    buggy `not rg.BoundingBox.Intersection(...)`."""
    return (a.Max.X < b.Min.X - pad or b.Max.X < a.Min.X - pad or
            a.Max.Y < b.Min.Y - pad or b.Max.Y < a.Min.Y - pad)


def _bbox_inside(inner, outer, tol=0.0):
    """NECESSARY condition for inner to lie inside outer - used as a pre-filter."""
    return (inner.Min.X >= outer.Min.X - tol and inner.Max.X <= outer.Max.X + tol and
            inner.Min.Y >= outer.Min.Y - tol and inner.Max.Y <= outer.Max.Y + tol)


class _XY:
    __slots__ = ("X", "Y", "Z")

    def __init__(self, x, y):
        self.X = x
        self.Y = y
        self.Z = 0.0


class _BB:
    """[S6-26] Pure-Python 2-D bbox, same .Min / .Max .X / .Y as rg.BoundingBox."""
    __slots__ = ("Min", "Max")

    def __init__(self, x0, y0, x1, y1):
        self.Min = _XY(x0, y0)
        self.Max = _XY(x1, y1)


def _py_bbox(rg_bbox):
    mn = rg_bbox.Min
    mx = rg_bbox.Max
    return _BB(mn.X, mn.Y, mx.X, mx.Y)


class _LazyTypology:
    """[S6-25] Placed typology footprint that is not yet a RhinoCommon curve."""
    __slots__ = ("proto", "area", "pts", "cx", "cy", "ang")

    def __init__(self, info, cx, cy, ang):
        self.proto, self.area, self.pts = info
        self.cx = cx
        self.cy = cy
        self.ang = ang

    def __bool__(self):
        return True

    def world_pts(self):
        r = math.radians(self.ang)
        ca, sa = math.cos(r), math.sin(r)
        cx, cy = self.cx, self.cy
        return [(x * ca - y * sa + cx, x * sa + y * ca + cy) for x, y in self.pts]

    def build(self):
        c = self.proto.DuplicateCurve()
        rot = rg.Transform.Rotation(math.radians(self.ang), rg.Vector3d.ZAxis,
                                    rg.Point3d(0, 0, 0))
        mov = rg.Transform.Translation(self.cx, self.cy, 0.0)
        c.Transform(mov * rot)
        return c


class CachedCurve:
    """[S1 / S6-25] Lazy cache of curve + area + bbox."""

    __slots__ = ("_curve", "_area", "_bbox", "_lazy")

    def __init__(self, curve):
        self._area = None
        self._bbox = None
        if isinstance(curve, _LazyTypology):
            self._lazy = curve
            self._curve = None
            self._area = curve.area
        else:
            self._lazy = None
            self._curve = curve

    @property
    def curve(self):
        if self._curve is None and self._lazy is not None:
            self._curve = self._lazy.build()
        return self._curve

    @property
    def area(self):
        if self._area is None:
            self._area = _fast_area(self.curve)
        return self._area

    @property
    def bbox(self):
        if self._bbox is None:
            lz = self._lazy
            if lz is not None and lz.pts:
                wp = lz.world_pts()
                xs = [q[0] for q in wp]
                ys = [q[1] for q in wp]
                self._bbox = _BB(min(xs), min(ys), max(xs), max(ys))
            else:
                self._bbox = _py_bbox(self.curve.GetBoundingBox(True))
        return self._bbox

    def anchor(self):
        """A point ON the footprint outline (for containment tests)."""
        lz = self._lazy
        if lz is not None and lz.pts:
            x, y = lz.world_pts()[0]
            return rg.Point3d(x, y, 0.0)
        return self.curve.PointAtStart


def _as_cc(x):
    return x if isinstance(x, CachedCurve) else CachedCurve(x)


def is_inside_boundary(curve, boundary, tol=0.01, cand_bbox=None, bnd_bbox=None):
    """[S1-6] bbox pre-filter before PlanarClosedCurveRelationship."""
    if cand_bbox is not None and bnd_bbox is not None:
        if not _bbox_inside(cand_bbox, bnd_bbox, tol):
            return False
    try:
        rel = rg.Curve.PlanarClosedCurveRelationship(curve, boundary, rg.Plane.WorldXY, tol)
    except Exception:
        return False
    return rel == rg.RegionContainment.AInsideB


def curves_overlap_safe(c1, c2, tol=0.01):
    """[S1-1] The bbox filter now actually works."""
    if _bbox_disjoint(c1.bbox, c2.bbox):
        return False
    try:
        inter = rg.Curve.CreateBooleanIntersection(c1.curve, c2.curve, tol)
        return inter is not None and len(inter) > 0
    except Exception:
        return False


def create_rectangle_curve(center, length, width, angle_deg):
    plane = rg.Plane(center, rg.Vector3d.ZAxis)
    rect = rg.Rectangle3d(
        plane,
        rg.Interval(-length / 2.0, length / 2.0),
        rg.Interval(-width / 2.0, width / 2.0)
    ).ToNurbsCurve()
    if rect and rect.IsValid:
        if abs(angle_deg) > 1e-9:
            rect.Transform(rg.Transform.Rotation(math.radians(angle_deg),
                                                 rg.Vector3d.ZAxis, center))
        return rect
    return None


def _biggest_piece(curves):
    if not curves:
        return None
    best = None
    best_a = -1.0
    for c in curves:
        a = _fast_area(c)
        if a > best_a:
            best_a = a
            best = c
    return best


def _ensure_ccw(curve):
    """Counter-clockwise copy -> Extrusion.Create always extrudes UPWARD."""
    try:
        c = curve.DuplicateCurve()
        if c.ClosedCurveOrientation(rg.Plane.WorldXY) == rg.CurveOrientation.Clockwise:
            c.Reverse()
        return c
    except Exception:
        return curve


def _closest_on_curve(curve, pt):
    """[S1-5] TRUE closest point on the boundary - replaces the 200-sample array."""
    try:
        ok, t = curve.ClosestPoint(pt)
    except Exception:
        return None, None, None
    if not ok:
        return None, None, None
    cp = curve.PointAt(t)
    d = math.hypot(cp.X - pt.X, cp.Y - pt.Y)
    if d < 1e-9:
        return cp, None, 0.0
    direction = rg.Vector3d((cp.X - pt.X) / d, (cp.Y - pt.Y) / d, 0.0)
    return cp, direction, d


_EDGE_CACHE = {}


def _dir_diff(a, b):
    """Difference of two DIRECTIONS in degrees, 0..180."""
    return abs((a - b + 180.0) % 360.0 - 180.0)


def _angle_eq(a, b, period=180.0, tol=0.5):
    h = period * 0.5
    return abs((a - b + h) % period - h) < tol


def _boundary_edges(boundary, merge_deg=2.0):
    """[S5-17] Straight edges of a closed boundary.

    Returns tuples (ax, ay, bx, by, angle_mod180, length, nx, ny), where
    (nx, ny) is the INWARD unit normal. Consecutive near-collinear
    segments are merged (deviation from the edge's first segment
    < merge_deg) so a slightly kinked edge counts as one edge.
    """
    crv = boundary.curve if isinstance(boundary, CachedCurve) else boundary
    hit = _EDGE_CACHE.get(id(crv))
    if hit is not None and hit[0] is crv:
        return hit[1]

    pl = _polyline_of(crv)
    if pl is None:
        try:
            pc = crv.ToPolyline(0.01, math.radians(2.0), 0.0, 0.0)
            pl = _polyline_of(pc) if pc else None
        except Exception:
            pl = None

    edges = []
    if pl is not None:
        pts = [(pl[i].X, pl[i].Y) for i in range(pl.Count)]
        if math.hypot(pts[0][0] - pts[-1][0], pts[0][1] - pts[-1][1]) < 1e-6:
            pts = pts[:-1]
        n = len(pts)
        if n >= 3:
            s2 = 0.0
            for i in range(n):
                x0, y0 = pts[i]
                x1, y1 = pts[(i + 1) % n]
                s2 += x0 * y1 - x1 * y0
            ccw = s2 > 0

            segs = []
            for i in range(n):
                ax, ay = pts[i]
                bx, by = pts[(i + 1) % n]
                L = math.hypot(bx - ax, by - ay)
                if L < 1e-6:
                    continue
                d = math.degrees(math.atan2(by - ay, bx - ax)) % 360.0
                segs.append([ax, ay, bx, by, d, d])        # [.., chord dir, first dir]

            merged = []
            for sg in segs:
                if merged and _dir_diff(merged[-1][5], sg[4]) < merge_deg:
                    m = merged[-1]
                    m[2], m[3] = sg[2], sg[3]
                    m[4] = math.degrees(math.atan2(m[3] - m[1], m[2] - m[0])) % 360.0
                else:
                    merged.append(list(sg))
            if len(merged) > 1 and _dir_diff(merged[-1][4], merged[0][5]) < merge_deg:
                last = merged.pop()
                first = merged[0]
                first[0], first[1] = last[0], last[1]
                first[4] = math.degrees(math.atan2(first[3] - first[1],
                                                   first[2] - first[0])) % 360.0

            for ax, ay, bx, by, d, _d0 in merged:
                L = math.hypot(bx - ax, by - ay)
                if L < 1e-6:
                    continue
                ux, uy = (bx - ax) / L, (by - ay) / L
                nx, ny = (-uy, ux) if ccw else (uy, -ux)
                edges.append((ax, ay, bx, by, d % 180.0, L, nx, ny))

    _EDGE_CACHE[id(crv)] = (crv, edges)
    return edges


def _seg_dist(px, py, e):
    """Distance from (px, py) to edge e and the foot parameter along it (m)."""
    ax, ay, bx, by, _a, L = e[0], e[1], e[2], e[3], e[4], e[5]
    ux, uy = (bx - ax) / L, (by - ay) / L
    t = (px - ax) * ux + (py - ay) * uy
    tc = max(0.0, min(L, t))
    return math.hypot(px - (ax + ux * tc), py - (ay + uy * tc)), t


def _edge_candidates(pt, boundary, width, max_n=2):
    """[S7-30] Edges a building at `pt` should align to, best first.

    PROXIMITY FIRST: the edge closest to the building governs it, the
    next-closest edge (other direction) comes second.
    Only a true tie (distances within max(0.25 m, 5 %) - e.g. a point on a
    corner bisector) is broken by:
        1. the edge the building actually FRONTS (perpendicular foot lies
           on the edge, not past its end),
        2. the longer edge.
    (0.1.17-0.1.18 let the longer edge win anywhere within width/2 of the
    nearest distance, so a tower 2 m from a short edge could be aligned to
    a long edge 7 m away.)
    `width` is kept for call compatibility and no longer widens the window.
    Returns [(edge, distance), ...].
    """
    edges = _boundary_edges(boundary)
    if not edges:
        return []
    scored = []
    for e in edges:
        d, t = _seg_dist(pt.X, pt.Y, e)
        fronts = -1e-6 <= t <= e[5] + 1e-6
        scored.append((d, fronts, e))
    scored.sort(key=lambda s: s[0])
    dmin = scored[0][0]
    tie = dmin + max(0.25, 0.05 * dmin)
    tied = [s for s in scored if s[0] <= tie]
    rest = [s for s in scored if s[0] > tie]
    tied.sort(key=lambda s: (not s[1], -s[2][5], s[0]))
    near = [(d, e) for d, _f, e in tied + rest]
    out = []
    for d, e in near:
        if any(_angle_eq(e[4], o[0][4]) and abs(e[6] - o[0][6]) + abs(e[7] - o[0][7]) < 1e-6
               for o in out):
            continue
        out.append((e, d))
        if len(out) >= max_n:
            break
    return out


def _oriented_angles(edge_angle, nx, ny, typology, short_side=False):
    """[S5-18] Rotation(s) that put the spine parallel (or, short_side,
    perpendicular) to an edge. L (1) / C (4): the flip whose spine backs
    onto the boundary comes first. T (2): both flips (ends differ)."""
    a0 = (edge_angle + (90.0 if short_side else 0.0)) % 180.0
    a1 = a0 + 180.0
    if typology in (1, 4) and not short_side:
        def back_dot(a):
            r = math.radians(a)
            # local -Y (spine back) after rotation = (sin a, -cos a); it should
            # point OUT of the site, i.e. against the inward normal
            return math.sin(r) * nx - math.cos(r) * ny
        return sorted([a0, a1], key=back_dot)
    if typology in (1, 2, 4):
        return [a0, a1]
    return [a0]


def _nearest_boundary_edge_angle(pt, boundary):
    """Angle (deg, mod 180) of the governing boundary edge for `pt`."""
    cands = _edge_candidates(pt, boundary, 0.0, 1)
    if cands:
        return cands[0][0][4]
    try:
        ok, t = boundary.ClosestPoint(pt)
    except Exception:
        return None
    if not ok:
        return None
    try:
        tangent = boundary.TangentAt(t)
    except Exception:
        return None
    if tangent is None or tangent.Length < 1e-9:
        return None
    return math.degrees(math.atan2(tangent.Y, tangent.X)) % 180.0


# =====================================================================
# PART A - TYPOLOGY LIBRARY (I / L / T / H / C / Plus)
# =====================================================================

def typology_arm_count(typology):
    return {0: 0, 1: 1, 2: 1, 3: 2, 4: 2, 5: 1}.get(typology, 0)


def estimate_extra_area(typology, width, arm_len):
    return typology_arm_count(typology) * width * max(arm_len, 0.0)


def max_length_for_typology(typology, width, arm_len, max_total_area, absolute_cap_length):
    extra = estimate_extra_area(typology, width, arm_len)
    avail_area = max(width * 2.0, max_total_area - extra)
    return max(width * 2.0, min(absolute_cap_length, avail_area / width))


def get_typology_modules(spine_length, spine_width, typology, arm_length):
    """(local_x, local_y, size_x, size_y) of each rectangular module."""
    L = spine_length
    W = spine_width
    A = max(arm_length, W * 0.5)
    overlap = W * 0.5
    half_L = L / 2.0

    modules = [(0.0, 0.0, L, W)]

    def one_side_arm(attach_x, sign):
        cy = sign * ((A - overlap) / 2.0)
        modules.append((attach_x, cy, W, A + overlap))

    def crossbar(attach_x):
        modules.append((attach_x, 0.0, W, 2.0 * A + W))

    if typology == 0:
        pass
    elif typology == 1:
        one_side_arm(-half_L, +1.0)
    elif typology == 2:
        crossbar(-half_L)
    elif typology == 3:
        crossbar(-half_L)
        crossbar(+half_L)
    elif typology == 4:
        one_side_arm(-half_L, +1.0)
        one_side_arm(+half_L, +1.0)
    elif typology == 5:
        crossbar(0.0)

    return modules


@lru_cache(maxsize=4096)
def _typology_prototype(typology, spine_length, spine_width, arm_length):
    """[S1-3] Build the shape ONCE at the origin, angle 0.

    The shape depends only on (typology, L, W, arm); position and angle
    are rigid transforms. BooleanUnion therefore runs once per size
    combination instead of every time a tower is placed / moved / rotated.

    Parameters are rounded by the caller so the cache gets hits.
    """
    modules = get_typology_modules(spine_length, spine_width, typology, arm_length)

    if len(modules) == 1:
        lx, ly, sx, sy = modules[0]
        return create_rectangle_curve(rg.Point3d(lx, ly, 0), sx, sy, 0.0)

    rects = []
    for (lx, ly, sx, sy) in modules:
        r = create_rectangle_curve(rg.Point3d(lx, ly, 0), sx, sy, 0.0)
        if r and r.IsValid:
            rects.append(r)

    if len(rects) < 2:
        return rects[0] if rects else None

    try:
        unioned = rg.Curve.CreateBooleanUnion(rects, 0.015)
    except Exception:
        unioned = None

    if not unioned:
        return rects[0]
    piece = _biggest_piece(unioned)
    if piece is not None:
        # normalise orientation at the prototype -> no _ensure_ccw later
        piece = _ensure_ccw(piece)
    return piece


@lru_cache(maxsize=4096)
def _prototype_info(typology, spine_length, spine_width, arm_length):
    """[S6-25] (curve, area, local vertices as Python tuples) of a prototype."""
    proto = _typology_prototype(typology, spine_length, spine_width, arm_length)
    if proto is None:
        return None
    area = _fast_area(proto)
    pl = _polyline_of(proto)
    pts = tuple((pl[i].X, pl[i].Y) for i in range(pl.Count)) if pl is not None else ()
    return proto, area, pts


def create_typology_curve(center, spine_length, spine_width, angle_deg, typology, arm_length):
    """[S1-3 / S6-25] Cached prototype + rigid transform, built LAZILY.

    Returns a _LazyTypology token (truthy). Wrap it in CachedCurve(...) as
    before; the RhinoCommon curve is created on the first `.curve` access.
    """
    info = _prototype_info(
        int(typology),
        round(float(spine_length), 3),
        round(float(spine_width), 3),
        round(float(arm_length), 3),
    )
    if info is None:
        return None
    return _LazyTypology(info, center.X, center.Y, angle_deg)


def get_tower_typology(tower_index, global_seed, mode):
    if mode == 7:
        return 7
    if mode <= 5:
        return mode
    random.seed(global_seed * 71 + tower_index * 13 + 4001)
    return random.randint(0, 5)


# =====================================================================
# PART A2 - VALIDITY / SPACING CHECKS
# =====================================================================

def violates_tower_spacing(candidate, existing, min_dist, tol=0.01):
    """[S1-2] THIS WAS THE BIGGEST HOTSPOT OF THE ORIGINAL BUILD.

    Original: for EVERY candidate, re-offset ALL existing towers
    (rg.Curve.Offset), then run PlanarClosedCurveRelationship +
    BooleanIntersection on every buffer. Called from grow / adapt-arm /
    the 3 move functions / align / shrink / expand -> tens of thousands
    of Offsets per site.

    This build: padded bbox filter (drops distant pairs immediately),
    then a single Curve.ClosestPoints call for the true clear distance.
    Full containment (ClosestPoints > 0 while still overlapping) is
    handled separately by curves_overlap_safe.
    """
    if min_dist <= 0 or not existing:
        return False

    cb = candidate.bbox
    cc = candidate.curve

    for ex in existing:
        if _bbox_disjoint(cb, ex.bbox, min_dist):
            continue
        try:
            res = cc.ClosestPoints(ex.curve)
        except Exception:
            res = None
        if res is None:
            continue
        # RhinoCommon returns (bool, Point3d, Point3d)
        try:
            ok, pa, pb = res
        except Exception:
            continue
        if not ok:
            continue
        if math.hypot(pa.X - pb.X, pa.Y - pb.Y) < min_dist - tol:
            return True
    return False


def _clear_of_others(candidate, existing, min_dist, tol=0.01):
    """[S6-27] Spacing + overlap in one pass.

    If the clear distance (ClosestPoints) is >= min_dist > 0, the outlines
    cannot intersect, so the only possible overlap is full containment ->
    a 20 us Contains test replaces the 2.5 ms CreateBooleanIntersection.
    Same verdict as violates_tower_spacing + curves_overlap_safe.
    """
    if not existing:
        return True
    cb = candidate.bbox
    use_dist = min_dist > 2.0 * tol
    pad = min_dist if use_dist else 0.0
    for ex in existing:
        eb = ex.bbox
        if _bbox_disjoint(cb, eb, pad):
            continue
        if use_dist:
            try:
                ok, pa, pb = candidate.curve.ClosestPoints(ex.curve)
            except Exception:
                ok = False
            if ok:
                if math.hypot(pa.X - pb.X, pa.Y - pb.Y) < min_dist - tol:
                    return False
                if _bbox_inside(cb, eb) and ex.curve.Contains(
                        candidate.anchor(), rg.Plane.WorldXY, tol) == rg.PointContainment.Inside:
                    return False
                if _bbox_inside(eb, cb) and candidate.curve.Contains(
                        ex.anchor(), rg.Plane.WorldXY, tol) == rg.PointContainment.Inside:
                    return False
                continue
        if curves_overlap_safe(candidate, ex, tol):
            return False
    return True


def is_valid_tower_candidate(candidate, existing, boundary, min_area, min_dist, tol=0.01):
    """[S1-7] Check order: cheap first, expensive last.

    area -> spacing (ClosestPoints) -> overlap (Boolean)
    -> inside boundary (PlanarClosedCurveRelationship).
    The original ran the most expensive check (inside-boundary) first.
    """
    if candidate is None or candidate.area < min_area - 0.1:
        return False

    bnd = _as_cc(boundary)

    # bbox pre-filter against the boundary - rejects candidates spilling out
    if not _bbox_inside(candidate.bbox, bnd.bbox, tol):
        return False

    if not _clear_of_others(candidate, existing, min_dist, tol):
        return False

    if not is_inside_boundary(candidate.curve, bnd.curve, tol,
                              candidate.bbox, bnd.bbox):
        return False

    return True


def get_global_rotation_angle(mode, seed_val, uniform_deg):
    if mode == 0:
        return None
    if mode == 1:
        return uniform_deg
    if mode in (2, 3):
        random.seed(seed_val + 9000)
        return random.choice([0.0, 45.0, 90.0, 135.0, 180.0])
    return None


def _angle_is_aligned(candidate_angle, current_angle, tol_deg=0.5):
    diff = abs(((candidate_angle - current_angle) + 90.0) % 180.0 - 90.0)
    return diff < tol_deg


# =====================================================================
# PART B - COURTYARD
# =====================================================================

def _polygon_from_points(pts):
    pl = rg.Polyline(pts)
    if not pl.IsClosed:
        pl.Add(pts[0])
    return pl.ToPolylineCurve() if pl.IsValid else None


def _unit_vec(angle_deg):
    rad = math.radians(angle_deg)
    return rg.Vector3d(math.cos(rad), math.sin(rad), 0)


def split_site_into_zones(boundary, count, seed_val, split_angle_deg=0.0, zone_gap=0.0):
    if count <= 1:
        return [boundary]

    bbox = boundary.GetBoundingBox(True)
    dx = bbox.Max.X - bbox.Min.X
    dy = bbox.Max.Y - bbox.Min.Y
    base_angle = 0.0 if dx >= dy else 90.0

    total_angle = base_angle + split_angle_deg
    d = _unit_vec(total_angle)
    p = _unit_vec(total_angle + 90.0)
    center = bbox.Center

    pl = _polyline_of(boundary)
    if pl is not None:
        pts = [pt for pt in pl]
    else:
        params = boundary.DivideByCount(64, True)
        pts = [boundary.PointAt(t) for t in params] if params else [bbox.Min, bbox.Max]

    if HAS_NP and len(pts) >= NP_THRESHOLD:
        arr = np.array([[pt.X - center.X, pt.Y - center.Y] for pt in pts], dtype=float)
        pd = arr[:, 0] * d.X + arr[:, 1] * d.Y
        pp = arr[:, 0] * p.X + arr[:, 1] * p.Y
        lo_d, hi_d = float(pd.min()), float(pd.max())
        lo_p, hi_p = float(pp.min()), float(pp.max())
    else:
        pd = [(pt.X - center.X) * d.X + (pt.Y - center.Y) * d.Y for pt in pts]
        pp = [(pt.X - center.X) * p.X + (pt.Y - center.Y) * p.Y for pt in pts]
        lo_d, hi_d = min(pd), max(pd)
        lo_p, hi_p = min(pp), max(pp)

    span = hi_d - lo_d
    total_gap = max(0.0, zone_gap) * max(0, count - 1)
    step = max((span - total_gap) / count, 0.01)

    margin = (hi_p - lo_p) + max(dx, dy) + 10.0
    p_lo = lo_p - margin
    p_hi = hi_p + margin

    zones = []
    cursor = lo_d
    for _i in range(count):
        seg_lo = cursor
        seg_hi = cursor + step
        cursor = seg_hi + max(0.0, zone_gap)

        corners = [
            center + d * seg_lo + p * p_lo,
            center + d * seg_hi + p * p_lo,
            center + d * seg_hi + p * p_hi,
            center + d * seg_lo + p * p_hi,
        ]
        strip_curve = _polygon_from_points(corners)
        if not strip_curve:
            continue
        try:
            pieces = rg.Curve.CreateBooleanIntersection(boundary, strip_curve, 0.01)
        except Exception:
            pieces = None
        piece = _biggest_piece(pieces) if pieces else None
        if piece and _fast_area(piece) > 1.0:
            zones.append(piece)

    return zones if zones else [boundary]


def get_courtyard_break_params(size_mode, base_break_count, seed_val, zone_index):
    random.seed(seed_val * 131 + zone_index * 17 + 6001)
    if size_mode == 0:
        breaks = min(base_break_count + 2, 12)
        gap_factor = 1.3
    elif size_mode == 2:
        breaks = max(1, base_break_count - 1)
        gap_factor = 0.7
    elif size_mode == 3:
        breaks = max(1, base_break_count + random.randint(-2, 2))
        gap_factor = random.uniform(0.7, 1.4)
    else:
        breaks = base_break_count
        gap_factor = 1.0
    return max(1, breaks), gap_factor


def initial_coverage_for_size_mode(size_mode, seed_val):
    random.seed(seed_val + 7301)
    if size_mode == 0:
        return 0.55
    if size_mode == 2:
        return 0.85
    if size_mode == 3:
        return random.uniform(0.50, 0.90)
    return 0.70


def _inner_ring_curve(outer, width):
    outer_area = _fast_area(outer)
    for dist in (-width, width):
        try:
            offs = rg.Curve.Offset(outer, rg.Plane.WorldXY, dist, 0.01,
                                   rg.CurveOffsetCornerStyle.Sharp)
        except Exception:
            offs = None
        c = _biggest_piece(offs) if offs else None
        if c and c.IsClosed:
            a = _fast_area(c)
            if 0.5 < a < outer_area - 0.5:
                return c
    return None


def _trim_closed_forward(curve, t0, t1):
    dom = curve.Domain
    t0m = dom.Min + ((t0 - dom.Min) % dom.Length)
    t1m = dom.Min + ((t1 - dom.Min) % dom.Length)
    try:
        pieces = curve.Split([t0m, t1m])
    except Exception:
        pieces = None
    if not pieces or len(pieces) < 2:
        return None

    pt_at_t0 = curve.PointAt(t0m)
    best = None
    best_d = None
    for pc in pieces:
        d = pc.PointAtStart.DistanceTo(pt_at_t0)
        if best_d is None or d < best_d:
            best_d = d
            best = pc
    return best


class RingCache:
    """[S2-11] Arc-length table of the outer ring + static data of a zone.

    The original called curve.GetLength(Interval) inside _arc_pos /
    _length_to_param at EVERY break point, EVERY coverage step (up to 80
    steps). None of this depends on coverage, so it is built once.
    """

    __slots__ = ("outer", "inner", "dom", "ts", "cum", "total", "corners", "ok")

    def __init__(self, zone_curve, ring_width, samples=512):
        self.ok = False
        outer = _ensure_ccw(zone_curve)
        self.outer = outer

        inner = _inner_ring_curve(outer, ring_width)
        if not inner:
            return
        try:
            if not rg.Curve.DoDirectionsMatch(outer, inner):
                inner = inner.DuplicateCurve()
                inner.Reverse()
        except Exception:
            pass
        self.inner = inner

        dom = outer.Domain
        self.dom = dom
        n = max(64, int(samples))
        self.ts = [dom.Min + dom.Length * i / float(n) for i in range(n + 1)]
        pts = [outer.PointAt(t) for t in self.ts]
        cum = [0.0]
        acc = 0.0
        for i in range(1, len(pts)):
            acc += pts[i].DistanceTo(pts[i - 1])
            cum.append(acc)
        self.cum = cum
        self.total = acc
        if self.total < 1.0:
            return

        self.corners = self._compute_corners()
        self.ok = True

    # ---- arc-length <-> parameter, table lookup instead of GetLength ----
    def arc_pos(self, t):
        dom = self.dom
        tm = dom.Min + ((t - dom.Min) % dom.Length)
        i = bisect_left(self.ts, tm)
        if i <= 0:
            return 0.0
        if i >= len(self.ts):
            return self.total
        t0 = self.ts[i - 1]
        t1 = self.ts[i]
        f = 0.0 if t1 - t0 < 1e-12 else (tm - t0) / (t1 - t0)
        return self.cum[i - 1] + f * (self.cum[i] - self.cum[i - 1])

    def param_at_arc(self, s):
        if self.total < 1e-9:
            return self.dom.Min
        s = s % self.total
        if s < 0:
            s += self.total
        i = bisect_left(self.cum, s)
        if i <= 0:
            return self.ts[0]
        if i >= len(self.cum):
            return self.ts[-1]
        c0 = self.cum[i - 1]
        c1 = self.cum[i]
        f = 0.0 if c1 - c0 < 1e-12 else (s - c0) / (c1 - c0)
        return self.ts[i - 1] + f * (self.ts[i] - self.ts[i - 1])

    def shift_param(self, t, length_delta):
        return self.param_at_arc(self.arc_pos(t) + length_delta)

    def forward_arc_len(self, t0, t1):
        return (self.arc_pos(t1) - self.arc_pos(t0)) % self.total

    def _compute_corners(self):
        outer = self.outer
        params = []
        pl = _polyline_of(outer)
        if pl is not None:
            count = pl.Count - 1 if pl.IsClosed else pl.Count
            for i in range(count):
                okc, t = outer.ClosestPoint(pl[i])
                if okc:
                    params.append(t)
        else:
            dom = outer.Domain
            t0 = dom.Min
            for _ in range(64):
                try:
                    ok2, td = outer.GetNextDiscontinuity(
                        rg.Continuity.G1_locus_continuous, t0, dom.Max)
                except Exception:
                    ok2, td = False, None
                if not ok2:
                    break
                params.append(td)
                t0 = td

        if not params:
            return []

        dedupe_tol = max(0.05, self.total * 1e-4)
        ordered = sorted(set(params), key=self.arc_pos)
        out = []
        for t in ordered:
            if out and abs(self.arc_pos(t) - self.arc_pos(out[-1])) < dedupe_tol:
                continue
            out.append(t)
        if len(out) > 1 and (self.arc_pos(out[0]) + self.total - self.arc_pos(out[-1])) < dedupe_tol:
            out.pop()
        return out


def _band_segment(ring, t_start, t_end, min_seg_area):
    outer = ring.outer
    inner = ring.inner

    outer_arc = _trim_closed_forward(outer, t_start, t_end)
    if not outer_arc:
        return None

    ok1, ti1 = inner.ClosestPoint(outer_arc.PointAtStart)
    ok2, ti2 = inner.ClosestPoint(outer_arc.PointAtEnd)
    if not (ok1 and ok2):
        return None
    inner_arc = _trim_closed_forward(inner, ti1, ti2)
    if not inner_arc:
        return None

    inner_rev = inner_arc.DuplicateCurve()
    inner_rev.Reverse()

    link1 = rg.LineCurve(outer_arc.PointAtEnd, inner_rev.PointAtStart)
    link2 = rg.LineCurve(inner_rev.PointAtEnd, outer_arc.PointAtStart)

    try:
        joined = rg.Curve.JoinCurves([outer_arc, link1, inner_rev, link2], 0.02)
    except Exception:
        joined = None
    if not joined:
        return None

    piece = _biggest_piece(joined)
    if piece and piece.IsClosed and _fast_area(piece) > min_seg_area:
        return _ensure_ccw(piece)
    return None


def create_courtyard_segments(ring, ring_width, break_count, break_width, size_mode,
                              seed_val, zone_index, coverage=0.7, break_shift=0.0,
                              layout_mode=0):
    """[S2-11] Takes a prebuilt RingCache instead of the raw zone_curve."""
    if ring is None or not ring.ok:
        return []

    outer = ring.outer
    total_len = ring.total

    eff_breaks, gap_factor = get_courtyard_break_params(size_mode, break_count, seed_val, zone_index)
    eff_breaks = max(1, eff_breaks)

    cov = max(COVERAGE_MIN, min(COVERAGE_MAX, coverage))
    min_seg_area = max(1.0, ring_width * ring_width * 0.3)
    domain = ring.dom
    corner_eps = max(domain.Length * 0.0005, 1e-6)

    def off_corner(ts):
        try:
            if not outer.IsContinuous(rg.Continuity.G1_continuous, ts):
                return min(domain.Max, ts + corner_eps)
        except Exception:
            pass
        return ts

    segments = []

    if layout_mode == 1:
        gap_len = max(0.3, break_width)
        n = eff_breaks
        max_cluster = total_len * 0.96
        cluster_len = min(max_cluster, cov * total_len)

        b_len = (cluster_len - (n - 1) * gap_len) / n
        min_b_len = max(ring_width, 2.0)
        while n > 1 and b_len < min_b_len:
            n -= 1
            b_len = (cluster_len - (n - 1) * gap_len) / n
        if b_len < min_b_len * 0.5:
            return []

        t_cursor = ring.shift_param(domain.Min, -break_shift)
        for _k in range(n):
            t_s = off_corner(t_cursor)
            t_e = off_corner(ring.shift_param(t_cursor, b_len))
            piece = _band_segment(ring, t_s, t_e, min_seg_area)
            if piece:
                segments.append(piece)
            t_cursor = ring.shift_param(t_cursor, b_len + gap_len)
        return segments

    min_gap = max(0.3, break_width * gap_factor)
    anchors = ring.corners

    if len(anchors) < 3:
        try:
            params = outer.DivideByCount(eff_breaks, False)
        except Exception:
            params = None
        if not params:
            return []
        anchors = [ring.shift_param(t, -break_shift) for t in params]

    m = len(anchors)
    for i in range(m):
        c_prev = anchors[(i - 1) % m]
        c_i = anchors[i]
        c_next = anchors[(i + 1) % m]

        left_half = ring.forward_arc_len(c_prev, c_i) / 2.0
        right_half = ring.forward_arc_len(c_i, c_next) / 2.0

        arm_left = min(cov * left_half, max(0.0, left_half - min_gap / 2.0))
        arm_right = min(cov * right_half, max(0.0, right_half - min_gap / 2.0))
        if arm_left + arm_right < max(ring_width, 1.0):
            continue

        t_s = off_corner(ring.shift_param(c_i, -arm_left))
        t_e = off_corner(ring.shift_param(c_i, arm_right))
        piece = _band_segment(ring, t_s, t_e, min_seg_area)
        if piece:
            segments.append(piece)

    return segments


class CourtyardContext:
    """[S2-11] All coverage-independent data is built once.

    The original re-ran split_site_into_zones + _inner_ring_curve +
    _corner_params at EVERY coverage step (up to 80 times per site).
    """

    __slots__ = ("rings", "ring_width", "break_count", "break_width", "size_mode",
                 "seed", "min_slat_area", "break_shift", "layout_mode")

    def __init__(self, boundary, count, break_count, break_width, ring_width, size_mode,
                 seed_val, min_slat_area, split_angle_deg, zone_gap, break_shift, layout_mode):
        zones = split_site_into_zones(boundary, count, seed_val, split_angle_deg, zone_gap)
        self.rings = []
        for z in zones:
            if _fast_area(z) < ring_width * ring_width * 4.0:
                self.rings.append(None)
                continue
            self.rings.append(RingCache(z, ring_width))
        self.ring_width = ring_width
        self.break_count = break_count
        self.break_width = break_width
        self.size_mode = size_mode
        self.seed = seed_val
        self.min_slat_area = min_slat_area
        self.break_shift = break_shift
        self.layout_mode = layout_mode

    def build(self, coverage):
        fps = []
        centers = []
        total = 0.0
        for zi, ring in enumerate(self.rings):
            if ring is None or not ring.ok:
                continue
            segs = create_courtyard_segments(
                ring, self.ring_width, self.break_count, self.break_width,
                self.size_mode, self.seed, zi, coverage, self.break_shift, self.layout_mode)
            for s in segs:
                cc = CachedCurve(s)
                if cc.area < self.min_slat_area:
                    continue
                fps.append(cc)
                centers.append(_fast_centroid(s))
                total += cc.area
        return fps, centers, total


def grow_courtyard_to_bcr(ctx, target_area, max_iter, bcr_tol, start_coverage=0.7):
    """[S2-11] Bisection on coverage.

    Original: linear stepping cov_step = 0.02, up to `towerGrowIterations`
    (default 80) full courtyard rebuilds.
    This build: area increases monotonically with coverage -> bisection
    with ~8-10 rebuilds, each cheaper thanks to CourtyardContext.
    """
    cov0 = max(COVERAGE_MIN, min(COVERAGE_MAX, start_coverage))
    fps, centers, area = ctx.build(cov0)
    steps = 1

    best = (fps, centers, cov0, area)
    best_diff = abs(area - target_area)

    if best_diff <= bcr_tol or not fps:
        return fps, centers, cov0, area, steps

    lo, hi = COVERAGE_MIN, COVERAGE_MAX
    if area < target_area:
        lo = cov0
    else:
        hi = cov0

    max_bisect = max(4, min(12, int(max_iter)))
    for _ in range(max_bisect):
        if hi - lo < 0.005:
            break
        mid = 0.5 * (lo + hi)
        f, c, a = ctx.build(mid)
        steps += 1
        if not f:
            lo = mid
            continue

        d = abs(a - target_area)
        if d < best_diff:
            best_diff = d
            best = (f, c, mid, a)

        if d <= bcr_tol:
            break
        if a < target_area:
            lo = mid
        else:
            hi = mid

    fps, centers, cov, area = best
    return fps, centers, cov, area, steps


# =====================================================================
# PART C - ADAPTIVE ARM LENGTH
# =====================================================================

def adapt_arm_length_for_bcr(original_arm_ratio, target_bcr_area, current_bcr_area,
                             footprints_data, buildable_site, w, min_dist,
                             min_fp_area, max_fp_area, bcr_tol, max_iter=20):
    arm_range = 0.30
    arm_step = 0.05

    min_ratio = original_arm_ratio * (1 - arm_range)
    max_ratio = original_arm_ratio * (1 + arm_range)

    current_ratio = original_arm_ratio
    best_ratio = current_ratio
    best_footprints = None
    best_area = current_bcr_area
    best_diff = abs(current_bcr_area - target_bcr_area)

    bnd = _as_cc(buildable_site)

    if current_bcr_area < target_bcr_area - bcr_tol:
        direction = 1
    elif current_bcr_area > target_bcr_area + bcr_tol:
        direction = -1
    else:
        return original_arm_ratio, None, current_bcr_area, True

    for _iteration in range(max_iter):
        new_ratio = current_ratio + direction * arm_step
        if new_ratio < min_ratio or new_ratio > max_ratio:
            break

        new_arm_length = new_ratio * w
        new_footprints = []
        success = True
        running = 0.0

        for i, (center, length, angle, typology) in enumerate(footprints_data):
            curve = create_typology_curve(center, length, w, angle, typology, new_arm_length)
            fp = CachedCurve(curve) if curve else None
            if fp is None:
                success = False
                break
            if not is_valid_tower_candidate(fp, new_footprints, bnd,
                                            min_fp_area * 0.5, min_dist):
                success = False
                break
            new_footprints.append(fp)
            running += fp.area

        if not success:
            if abs(direction * arm_step) > 0.01:
                direction *= 0.5
                continue
            break

        new_total_area = running
        new_diff = abs(new_total_area - target_bcr_area)

        if new_diff < best_diff:
            best_ratio = new_ratio
            best_footprints = new_footprints
            best_area = new_total_area
            best_diff = new_diff

        if new_diff <= bcr_tol:
            return new_ratio, new_footprints, new_total_area, True

        if direction > 0 and new_total_area > target_bcr_area + bcr_tol:
            direction = -0.5
        elif direction < 0 and new_total_area < target_bcr_area - bcr_tol:
            direction = 0.5

        current_ratio = new_ratio

    return best_ratio, best_footprints, best_area, best_diff <= bcr_tol


# =====================================================================
# PART D - MOVE / ALIGN
# =====================================================================

def _max_feasible_move(test_fn, max_dist, iters=9):
    """[S2-12] Find the largest feasible displacement.

    The original stepped 0.5-1 m, with up to 30-80 validity checks PER
    tower. This build tries the full span first (often succeeds / fails
    immediately), then ~7 bisection steps. ~8 checks instead of 80.
    """
    if max_dist <= 1e-6:
        return 0.0
    if test_fn(max_dist):
        return max_dist
    lo = 0.0
    hi = max_dist
    for _ in range(iters):
        mid = 0.5 * (lo + hi)
        if test_fn(mid):
            lo = mid
        else:
            hi = mid
        if hi - lo < 0.05:
            break
    return lo


def _order_by_distance(points, ref, reverse=True):
    """[S1-9] numpy when n is large."""
    n = len(points)
    if n == 0:
        return []
    if HAS_NP and n >= NP_THRESHOLD:
        arr = np.array([[p.X - ref.X, p.Y - ref.Y] for p in points], dtype=float)
        d2 = arr[:, 0] ** 2 + arr[:, 1] ** 2
        idx = np.argsort(d2)
        if reverse:
            idx = idx[::-1]
        return [int(i) for i in idx]
    order = list(range(n))
    order.sort(key=lambda i: (points[i].X - ref.X) ** 2 + (points[i].Y - ref.Y) ** 2,
               reverse=reverse)
    return order


def _move_generic(footprints, tower_centers, tower_angles, tower_lengths, tower_typologies,
                  width, arm_len, boundary, min_tower_dist, min_fp_area,
                  direction_fn, label, max_span_fn=None):
    """Shared framework for move-to-boundary / move-to-setback."""
    if not footprints:
        return footprints, tower_centers

    bnd = _as_cc(boundary)
    site_centroid = _fast_centroid(bnd.curve)
    order = _order_by_distance(tower_centers, site_centroid, reverse=True)

    moved_count = 0
    total_movement = 0.0

    for idx in order:
        current_center = tower_centers[idx]
        length = tower_lengths[idx]
        angle = tower_angles[idx]
        typology = tower_typologies[idx]

        direction, span = direction_fn(current_center, bnd)
        if direction is None or span <= 0.05:
            continue
        if max_span_fn is not None:
            span = min(span, max_span_fn(current_center, bnd))

        others = [footprints[j] for j in range(len(footprints)) if j != idx]

        state = {"fp": None, "pt": None}

        def test(d):
            new_center = rg.Point3d(current_center.X + direction.X * d,
                                    current_center.Y + direction.Y * d, 0)
            if bnd.curve.Contains(new_center, rg.Plane.WorldXY, 0.01) != rg.PointContainment.Inside:
                return False
            new_curve = create_typology_curve(new_center, length, width, angle, typology, arm_len)
            if not new_curve:
                return False
            new_fp = CachedCurve(new_curve)
            if new_fp.area < min_fp_area * 0.5:
                return False
            if not is_valid_tower_candidate(new_fp, others, bnd, min_fp_area * 0.5, min_tower_dist):
                return False
            state["fp"] = new_fp
            state["pt"] = new_center
            return True

        d_ok = _max_feasible_move(test, span, iters=9)
        if d_ok > 0.05 and state["fp"] is not None:
            # make sure state matches the final d_ok
            test(d_ok)
            if state["fp"] is not None:
                footprints[idx] = state["fp"]
                tower_centers[idx] = state["pt"]
                moved_count += 1
                total_movement += d_ok

    print("  {}: {} buildings moved, total movement {:.1f} m".format(
        label, moved_count, total_movement))
    return footprints, tower_centers


def move_towers_to_boundary(footprints, tower_centers, tower_angles, tower_lengths, tower_typologies,
                            width, arm_len, boundary, min_tower_dist, min_fp_area, max_fp_area,
                            step_size=1.0, max_iter=50):
    """Move towers outward along the site-centroid -> tower direction."""
    if not footprints:
        return footprints, tower_centers
    bnd = _as_cc(boundary)
    site_centroid = _fast_centroid(bnd.curve)

    def direction_fn(center, b):
        vx = center.X - site_centroid.X
        vy = center.Y - site_centroid.Y
        ln = math.hypot(vx, vy)
        if ln < 1e-3:
            cp, d, dist = _closest_on_curve(b.curve, center)
            if d is None:
                return None, 0.0
            return d, dist
        # max span = distance to the boundary in that direction (approximated
        # by the distance to the closest boundary point; safe enough because
        # test_fn still validates each move)
        cp, _dd, dist = _closest_on_curve(b.curve, center)
        span = dist if dist is not None else 0.0
        return rg.Vector3d(vx / ln, vy / ln, 0.0), max(span, 0.0)

    return _move_generic(footprints, tower_centers, tower_angles, tower_lengths, tower_typologies,
                         width, arm_len, bnd, min_tower_dist, min_fp_area,
                         direction_fn, "Move-to-boundary")


def move_buildings_to_nearest_setback(footprints, tower_centers, tower_angles, tower_lengths,
                                      tower_typologies, width, arm_len, boundary, min_tower_dist,
                                      min_fp_area, step_size=1.0, max_iter=60):
    """Move towers perpendicularly toward the closest point on the setback line."""

    def direction_fn(center, b):
        # [S5-20] move along the edge normal when the perpendicular foot lies
        # on the edge -> the tower stays parallel and lands flush
        cands = _edge_candidates(center, b, 0.0, 1)
        if cands:
            e, _d = cands[0]
            dist, t = _seg_dist(center.X, center.Y, e)
            if 1e-6 < t < e[5] - 1e-6 and dist > 1e-6:
                return rg.Vector3d(-e[6], -e[7], 0.0), dist
        cp, d, dist = _closest_on_curve(b.curve, center)
        if d is None:
            return None, 0.0
        return d, dist

    return _move_generic(footprints, tower_centers, tower_angles, tower_lengths, tower_typologies,
                         width, arm_len, boundary, min_tower_dist, min_fp_area,
                         direction_fn, "Move-to-setback")


def _place_aligned(center, length, width, angle, typology, arm_len, others, bnd,
                   min_fp_area, min_dist, max_fp_area, nx, ny, max_pull,
                   max_slide=None, min_length=None):
    """[S5-19 / S7-31] Place a tower at `angle` as close to its current spot
    as possible. Strategies, in order:
      1. rotate in place, else slide along the inward normal (nx, ny) by the
         smallest feasible distance (bisection);
      2. slide along the edge (tangent) +- and combined with inward moves,
         nearest displacement first;
      3. shorten the spine (90 / 80 / 70 / 60 %, never below min_length)
         and repeat strategy 1.
    Returns (fp, center, length) or None."""
    tx, ty = -ny, nx
    step = max(0.5, width / 6.0)

    def build(dn, dt, L):
        c = rg.Point3d(center.X + nx * dn + tx * dt, center.Y + ny * dn + ty * dt, 0.0)
        crv = create_typology_curve(c, L, width, angle, typology, arm_len)
        if not crv:
            return None
        fp = CachedCurve(crv)
        if fp.area > max_fp_area * 1.05 or fp.area < min_fp_area - 0.1:
            return None
        if not is_valid_tower_candidate(fp, others, bnd, min_fp_area, min_dist):
            return None
        return fp, c, L

    def normal_search(L):
        r = build(0.0, 0.0, L)
        if r is not None:
            return r
        prev = 0.0
        d = step
        while d <= max_pull + 1e-9:
            r = build(d, 0.0, L)
            if r is not None:
                lo, hi, best = prev, d, r
                for _ in range(6):
                    if hi - lo < 0.05:
                        break
                    mid = 0.5 * (lo + hi)
                    rm = build(mid, 0.0, L)
                    if rm is not None:
                        hi, best = mid, rm
                    else:
                        lo = mid
                return best
            prev = d
            d += step
        return None

    r = normal_search(length)
    if r is not None:
        return r

    # 2. tangential (+ inward) slides, nearest displacement first
    if max_slide is None:
        max_slide = max(width, 0.5 * length)
    n_steps = int(max_pull / step + 1e-9)
    t_steps = int(max_slide / step + 1e-9)
    moves = []
    for i in range(0, n_steps + 1):
        for j in range(1, t_steps + 1):
            for sg in (1.0, -1.0):
                dn, dt = i * step, sg * j * step
                moves.append((math.hypot(dn, dt), dn, dt))
    moves.sort()
    for _h, dn, dt in moves:
        r = build(dn, dt, length)
        if r is not None:
            return r

    # 3. shorter spine
    if min_length is None:
        min_length = 0.6 * length
    for f in (0.9, 0.8, 0.7, 0.6):
        L = length * f
        if L < min_length - 1e-6:
            break
        r = normal_search(L)
        if r is not None:
            return r
    return None


def align_towers_to_nearest_edge(footprints, tower_centers, tower_angles, tower_lengths,
                                 tower_typologies, width, arm_len, boundary, min_tower_dist,
                                 min_fp_area, max_fp_area, both_orientations=True,
                                 min_length=None):
    """[S7-30/31] NEAREST EDGE FIRST.

    PASS 1 (towers closest to the boundary first): spine parallel to the
           nearest edge.
    PASS 2 (towers that failed): nearest edge, spine perpendicular (if
           both_orientations) -> next-nearest edge parallel -> next-nearest
           perpendicular.
    Every attempt uses all placement strategies of _place_aligned before the
    next, lower-priority option is tried.
    Returns (footprints, tower_centers, tower_angles); tower_lengths is
    updated in place when a spine had to be shortened."""
    if not footprints:
        return footprints, tower_centers, tower_angles

    bnd = _as_cc(boundary)
    n = len(footprints)
    cands = [_edge_candidates(tower_centers[i], bnd, width, 2) for i in range(n)]
    order = sorted(range(n), key=lambda i: cands[i][0][1] if cands[i] else 1e18)
    stat = {"nearest": 0, "second": 0, "none": 0, "moved": 0, "shortened": 0, "kept": 0}

    def try_align(idx, edge_rank, short_side):
        if edge_rank >= len(cands[idx]):
            return None
        e, _d = cands[idx][edge_rank]
        center = tower_centers[idx]
        length = tower_lengths[idx]
        typ = tower_typologies[idx]
        cur = tower_angles[idx] if tower_angles[idx] is not None else 0.0
        period = 360.0 if typ in (1, 2, 4) else 180.0
        angs = _oriented_angles(e[4], e[6], e[7], typ, short_side)
        if any(_angle_eq(a, cur, period) for a in angs[:1]) or (
                period == 180.0 and any(_angle_eq(a, cur, 180.0) for a in angs)):
            return "same"
        others = [footprints[j] for j in range(n) if j != idx]
        max_pull = max(width, 0.5 * length + width * 0.5)
        for ang in angs:
            res = _place_aligned(center, length, width, ang, typ, arm_len, others, bnd,
                                 min_fp_area, min_tower_dist, max_fp_area,
                                 e[6], e[7], max_pull, None, min_length)
            if res is not None:
                fp, c, L = res
                footprints[idx] = fp
                tower_centers[idx] = c
                tower_angles[idx] = ang
                if L < length - 1e-6:
                    tower_lengths[idx] = L
                    stat["shortened"] += 1
                if c.DistanceTo(center) > 1e-3:
                    stat["moved"] += 1
                return "ok"
        # flipped L / C already in place counts as aligned
        if any(_angle_eq(a, cur, period) for a in angs):
            return "same"
        return None

    pending = []
    for idx in order:
        if not cands[idx]:
            stat["none"] += 1
            continue
        if try_align(idx, 0, False):
            stat["nearest"] += 1
        else:
            pending.append(idx)

    plan = []
    if both_orientations:
        plan.append((0, True))
    plan.append((1, False))
    if both_orientations:
        plan.append((1, True))
    for idx in pending:
        done = False
        for rank, short in plan:
            if try_align(idx, rank, short):
                stat["nearest" if rank == 0 else "second"] += 1
                done = True
                break
        if not done:
            stat["kept"] += 1

    print("  Align: nearest edge {} | next edge {} | moved {} | shortened {} | "
          "not alignable {} | no edge {} (of {})".format(
              stat["nearest"], stat["second"], stat["moved"], stat["shortened"],
              stat["kept"], stat["none"], n))
    return footprints, tower_centers, tower_angles


def tower_edge_angle_errors(tower_centers, tower_angles, boundary, width, both_orientations):
    """[S5-21] Deviation (deg) of each spine from its governing edge."""
    out = []
    for c, a in zip(tower_centers, tower_angles):
        cands = _edge_candidates(c, boundary, width, 1)
        if not cands or a is None:
            out.append(-1.0)
            continue
        dev = abs(((a - cands[0][0][4]) + 90.0) % 180.0 - 90.0)
        if both_orientations:
            dev = min(dev, 90.0 - dev)
        out.append(round(dev, 2))
    return out


# =====================================================================
# PART E - PODIUM
# =====================================================================

def _cluster_by_bbox(curves, pad=0.0):
    """[S2-13] Cluster curves whose bboxes intersect (union-find).

    CreateBooleanUnion is O(n^2) in the number of curves. With scattered
    towers most clusters have only 1-2 members -> cost drops sharply.
    """
    n = len(curves)
    if n <= 1:
        return [list(range(n))]

    bbs = [_py_bbox(c.GetBoundingBox(True)) for c in curves]
    parent = list(range(n))

    def find(a):
        while parent[a] != a:
            parent[a] = parent[parent[a]]
            a = parent[a]
        return a

    def union(a, b):
        ra, rb = find(a), find(b)
        if ra != rb:
            parent[rb] = ra

    for i in range(n):
        for j in range(i + 1, n):
            if not _bbox_disjoint(bbs[i], bbs[j], pad):
                union(i, j)

    groups = {}
    for i in range(n):
        groups.setdefault(find(i), []).append(i)
    return list(groups.values())


_PODIUM_MEMO = {}


def _rect_half_extents(pts):
    """(hx, hy) if the prototype vertices form an origin-centred, axis-aligned
    rectangle (typology I), else None."""
    if not pts or len(pts) not in (4, 5):
        return None
    hx = max(abs(x) for x, _y in pts)
    hy = max(abs(y) for _x, y in pts)
    for x, y in pts:
        if abs(abs(x) - hx) > 1e-6 or abs(abs(y) - hy) > 1e-6:
            return None
    return hx, hy


def _probe_rect_offset_sign():
    """[S6-29] Which offset sign Curve.Offset uses to grow the CCW prototype
    rectangle (checked once against RhinoCommon). None = disable fast path."""
    try:
        r = create_rectangle_curve(rg.Point3d(0, 0, 0), 20.0, 10.0, 0.0)
        o = rg.Curve.Offset(r, rg.Plane.WorldXY, 2.0, 0.015, rg.CurveOffsetCornerStyle.Sharp)
        a = _fast_area(o[0]) if o else 0.0
        if abs(a - 24.0 * 14.0) < 1e-3:
            return 1.0
        if abs(a - 16.0 * 6.0) < 1e-3:
            return -1.0
    except Exception:
        pass
    return None


_RECT_OFFSET_SIGN = _probe_rect_offset_sign()


def create_individual_podiums(tower_footprints, offset_dist, boundary, seed_val):
    """[S6-28] Memoised wrapper (same footprint objects + offset -> same podium)."""
    if not tower_footprints:
        return 0.0, []
    bcrv = boundary.curve if isinstance(boundary, CachedCurve) else boundary
    key = (tuple(id(f) for f in tower_footprints), round(float(offset_dist), 6),
           seed_val, id(bcrv))
    hit = _PODIUM_MEMO.get(key)
    if hit is not None and hit[1] is bcrv and all(
            a is b for a, b in zip(hit[0], tower_footprints)):
        # the real call re-seeds `random`; restore that state so everything
        # downstream (e.g. height distribution) sees the same random stream
        random.setstate(hit[4])
        return hit[2], list(hit[3])
    area, curves = _create_individual_podiums(tower_footprints, offset_dist, boundary, seed_val)
    if len(_PODIUM_MEMO) > 512:
        _PODIUM_MEMO.clear()
    _PODIUM_MEMO[key] = (tuple(tower_footprints), bcrv, area, tuple(curves), random.getstate())
    return area, list(curves)


def _create_individual_podiums(tower_footprints, offset_dist, boundary, seed_val):
    if not tower_footprints:
        return 0.0, []

    bnd = _as_cc(boundary)

    if offset_dist < 0.01:
        curves = [fp.curve for fp in tower_footprints if fp]
        return sum(fp.area for fp in tower_footprints if fp), curves

    candidates = []
    for i, fp in enumerate(tower_footprints):
        random.seed(seed_val * 53 + i * 29)
        actual = offset_dist * (1.0 + random.uniform(-0.05, 0.05))
        # [S6-29] typology I: a sharp-corner offset of a rectangle IS a
        # rectangle -> build it directly (~60 us instead of ~1.3 ms Offset)
        lz = getattr(fp, "_lazy", None)
        he = _rect_half_extents(lz.pts) if (lz is not None and _RECT_OFFSET_SIGN) else None
        if he is not None:
            grow = actual * _RECT_OFFSET_SIGN
            if he[0] + grow > 1e-6 and he[1] + grow > 1e-6:
                candidates.append(create_rectangle_curve(
                    rg.Point3d(lz.cx, lz.cy, 0.0), 2.0 * (he[0] + grow),
                    2.0 * (he[1] + grow), lz.ang))
            continue
        try:
            offs = rg.Curve.Offset(fp.curve, rg.Plane.WorldXY, actual, 0.015,
                                   rg.CurveOffsetCornerStyle.Sharp)
        except Exception:
            offs = None
        if offs:
            for o in offs:
                if not o or not o.IsClosed:
                    continue
                # [S1-4] filter slivers with shoelace instead of AreaMassProperties
                if _fast_area(o) > 0.1:
                    candidates.append(o)

    if not candidates:
        return 0.0, []

    random.seed(seed_val + 6000)
    union_tol = 0.015 * (1.0 + random.uniform(-0.2, 0.2))

    # [S2-13] union per disjoint cluster
    unioned = []
    try:
        for grp in _cluster_by_bbox(candidates, pad=union_tol * 2.0):
            sub = [candidates[k] for k in grp]
            if len(sub) == 1:
                unioned.append(sub[0])
                continue
            u = rg.Curve.CreateBooleanUnion(sub, union_tol)
            if u:
                unioned.extend(list(u))
            else:
                unioned.extend(sub)
    except Exception:
        return 0.0, []

    if not unioned:
        return 0.0, []

    clipped = []
    total_area = 0.0
    for u in unioned:
        ubb = _py_bbox(u.GetBoundingBox(True))
        # [S2-13] piece already fully inside the boundary -> skip BooleanIntersection
        if _bbox_inside(ubb, bnd.bbox, 0.0) and is_inside_boundary(
                u, bnd.curve, 0.015, ubb, bnd.bbox):
            a = _fast_area(u)
            if a > 0.1:
                total_area += a
                clipped.append(u)
            continue
        try:
            inters = rg.Curve.CreateBooleanIntersection(u, bnd.curve, 0.015)
        except Exception:
            inters = None
        if inters:
            for c in inters:
                a = _fast_area(c)
                if a > 0.1:
                    total_area += a
                    clipped.append(c)

    return total_area, clipped


def find_optimal_podium_offset(tower_footprints, target_area, boundary, seed_val,
                               min_offset, max_offset, tol=None):
    """[S2-10] Regula-falsi + bracketing instead of 50 bisection rounds.

    Podium area is monotonically increasing and fairly smooth in the
    offset, so linear interpolation converges much faster. Each saved
    round avoids n Offsets + 1 BooleanUnion + n BooleanIntersections.
    """
    if tol is None:
        tol = max(1.0, target_area * 0.015)

    lo = min_offset
    hi = max_offset

    a_lo, c_lo = create_individual_podiums(tower_footprints, lo, boundary, seed_val)
    if a_lo >= target_area - tol:
        return lo, a_lo, c_lo

    a_hi, c_hi = create_individual_podiums(tower_footprints, hi, boundary, seed_val)

    best_offset = lo
    best_area = a_lo
    best_curves = c_lo
    if abs(a_hi - target_area) < abs(best_area - target_area):
        best_offset, best_area, best_curves = hi, a_hi, c_hi

    if a_hi <= target_area + tol:
        return best_offset, best_area, best_curves

    for _ in range(20):
        if hi - lo < 0.01:
            break

        span = a_hi - a_lo
        if abs(span) < 1e-6:
            mid = 0.5 * (lo + hi)
        else:
            frac = (target_area - a_lo) / span
            # clamp so the estimate does not stick to an endpoint (bisection-style safety)
            frac = max(0.15, min(0.85, frac))
            mid = lo + frac * (hi - lo)

        a_mid, c_mid = create_individual_podiums(tower_footprints, mid, boundary, seed_val)

        if abs(a_mid - target_area) < abs(best_area - target_area):
            best_offset, best_area, best_curves = mid, a_mid, c_mid

        if abs(a_mid - target_area) <= tol:
            return mid, a_mid, c_mid

        if a_mid < target_area:
            lo, a_lo = mid, a_mid
        else:
            hi, a_hi = mid, a_mid

    return best_offset, best_area, best_curves


def move_towers_to_podium_edge(footprints, tower_centers, tower_angles, tower_lengths,
                               tower_typologies, width, arm_len, boundary, offset_dist,
                               min_tower_dist, min_fp_area, seed_val, step_size=0.5, max_iter=80):
    """[S2-12] Slide each tower inside its own podium toward the setback.

    Two changes: each tower's own podium is built ONCE before the loop
    (the original called create_individual_podiums again per tower), and
    the displacement is found by bisection instead of 80 steps of 0.5 m.
    """
    if not footprints or offset_dist < 0.01:
        return footprints, tower_centers

    bnd = _as_cc(boundary)

    own_podiums = []
    for i in range(len(footprints)):
        _a, curves = create_individual_podiums([footprints[i]], offset_dist, bnd, seed_val)
        own_podiums.append(_biggest_piece(curves) if curves else None)

    moved_count = 0
    total_movement = 0.0

    for idx in range(len(footprints)):
        own_podium = own_podiums[idx]
        if not own_podium:
            continue
        pod_bb = _py_bbox(own_podium.GetBoundingBox(True))

        current_center = tower_centers[idx]
        length = tower_lengths[idx]
        angle = tower_angles[idx]
        typology = tower_typologies[idx]

        _cp, direction, _d = _closest_on_curve(bnd.curve, current_center)
        if direction is None:
            continue

        others = [footprints[j] for j in range(len(footprints)) if j != idx]
        span = max(0.0, offset_dist * 1.5)
        state = {"fp": None, "pt": None}

        def test(d):
            new_center = rg.Point3d(current_center.X + direction.X * d,
                                    current_center.Y + direction.Y * d, 0)
            new_curve = create_typology_curve(new_center, length, width, angle, typology, arm_len)
            if not new_curve:
                return False
            new_fp = CachedCurve(new_curve)
            if new_fp.area < min_fp_area * 0.5:
                return False
            if not is_inside_boundary(new_fp.curve, own_podium, 0.01, new_fp.bbox, pod_bb):
                return False
            if not is_valid_tower_candidate(new_fp, others, bnd, min_fp_area * 0.5, min_tower_dist):
                return False
            state["fp"] = new_fp
            state["pt"] = new_center
            return True

        d_ok = _max_feasible_move(test, span, iters=9)
        if d_ok > 0.05:
            test(d_ok)
            if state["fp"] is not None:
                footprints[idx] = state["fp"]
                tower_centers[idx] = state["pt"]
                moved_count += 1
                total_movement += d_ok

    print("  Move-to-podium-edge: {} buildings moved, total movement {:.1f} m".format(
        moved_count, total_movement))
    return footprints, tower_centers


# =====================================================================
# PART F - HEIGHT DISTRIBUTION
# =====================================================================

def _gfa(floors, areas):
    """[S1-9] numpy when n is large."""
    if HAS_NP and len(floors) >= NP_THRESHOLD:
        return float(np.dot(np.asarray(floors, dtype=float), np.asarray(areas, dtype=float)))
    return sum(floors[i] * areas[i] for i in range(len(floors)))


def adjust_floors_to_target(floors, footprint_areas, target_gfa, min_floors_per_tower):
    """[S1-8] Incremental GFA update instead of re-summing every step.

    Original: while loop up to 200 times, each recomputing the sum over
    n towers -> O(200 * n^2). Now O(200 * n) in the worst case.

    NOTE: this function has NO height cap. It must never be used when a
    height regulation is enforced - use adjust_floors_to_target_capped().
    """
    num_towers = len(floors)
    if num_towers == 0 or target_gfa <= 0:
        return floors

    current_gfa = _gfa(floors, footprint_areas)
    min_floors_per_tower = max(2, min_floors_per_tower)
    if abs(current_gfa - target_gfa) / target_gfa < 0.005:
        return floors

    sorted_indices = sorted(range(num_towers), key=lambda i: footprint_areas[i], reverse=True)
    iteration = 0
    while abs(current_gfa - target_gfa) > target_gfa * 0.005 and iteration < 200:
        diff = target_gfa - current_gfa
        for idx in sorted_indices:
            if diff > 0:
                floors[idx] += 1
                current_gfa += footprint_areas[idx]
            else:
                if floors[idx] > min_floors_per_tower:
                    floors[idx] -= 1
                    current_gfa -= footprint_areas[idx]

            if abs(current_gfa - target_gfa) / target_gfa < 0.005:
                break
            if (diff > 0 and current_gfa > target_gfa) or (diff < 0 and current_gfa < target_gfa):
                if diff > 0:
                    floors[idx] -= 1
                    current_gfa -= footprint_areas[idx]
                else:
                    floors[idx] += 1
                    current_gfa += footprint_areas[idx]
                break
            else:
                break
        iteration += 1
    return floors


def adjust_floors_to_target_capped(floors, footprint_areas, target_gfa, floor_caps,
                                   floor_mins, tol_ratio=0.005, max_iter=5000):
    """[S3-15] Move tower GFA toward the target WITHOUT exceeding per-tower caps.

    - floors are first clamped into [floor_mins[i], floor_caps[i]]
      (the cap always wins if min > cap)
    - each step adds / removes one floor on the tower whose change reduces
      |target - GFA| the most; towers at their cap can not grow, towers at
      their minimum can not shrink
    - stops when within tolerance or when no single-floor move improves
      the error (e.g. every tower is at its cap -> FAR is height-limited)

    Returns (floors, achieved_gfa).
    """
    n = len(floors)
    if n == 0:
        return floors, 0.0

    for i in range(n):
        cap = floor_caps[i]
        lo = min(floor_mins[i], cap)
        floors[i] = int(max(lo, min(cap, floors[i])))

    gfa = _gfa(floors, footprint_areas)
    if target_gfa <= 0:
        return floors, gfa
    tol = target_gfa * tol_ratio

    for _ in range(max_iter):
        diff = target_gfa - gfa
        if abs(diff) <= tol:
            break
        best = None
        best_err = abs(diff)
        if diff > 0:
            for i in range(n):
                if floors[i] < floor_caps[i]:
                    err = abs(diff - footprint_areas[i])
                    if err < best_err - 1e-9:
                        best, best_err = i, err
            if best is None:
                break
            floors[best] += 1
            gfa += footprint_areas[best]
        else:
            for i in range(n):
                if floors[i] > min(floor_mins[i], floor_caps[i]):
                    err = abs(diff + footprint_areas[i])
                    if err < best_err - 1e-9:
                        best, best_err = i, err
            if best is None:
                break
            floors[best] -= 1
            gfa -= footprint_areas[best]

    return floors, gfa


def enforce_variation_range(floors, base_floors, heightVariation, min_floors_per_tower):
    if len(floors) < 2:
        return floors

    sorted_floors = sorted(floors)
    current_range = sorted_floors[-1] - sorted_floors[0]
    target_range = heightVariation * base_floors
    if target_range <= 0 or abs(current_range - target_range) / target_range < 0.05:
        return floors

    if current_range < target_range:
        expand_needed = int(round((target_range - current_range) / 2))
        for _ in range(min(expand_needed, len(floors) // 2)):
            min_idx = floors.index(min(floors))
            max_idx = floors.index(max(floors))
            if min_idx != max_idx:
                if floors[min_idx] > min_floors_per_tower:
                    floors[min_idx] -= 1
                if floors[max_idx] < 200:
                    floors[max_idx] += 1
    else:
        shrink_needed = int(round((current_range - target_range) / 2))
        for _ in range(min(shrink_needed, len(floors) // 2)):
            min_idx = floors.index(min(floors))
            max_idx = floors.index(max(floors))
            if min_idx != max_idx:
                floors[min_idx] += 1
                if floors[max_idx] > min_floors_per_tower:
                    floors[max_idx] -= 1
    return floors


def adjust_floors_to_target_preserve_variation(floors, footprint_areas, target_gfa,
                                               min_floors_per_tower, heightVariation,
                                               base_floors, min_range, max_range):
    num_towers = len(floors)
    if num_towers == 0 or target_gfa <= 0:
        return floors

    current_gfa = _gfa(floors, footprint_areas)
    min_floors_per_tower = max(2, min_floors_per_tower)
    if abs(current_gfa - target_gfa) / target_gfa < 0.005:
        return floors

    sorted_indices = sorted(range(num_towers), key=lambda i: footprint_areas[i], reverse=True)
    iteration = 0
    while abs(current_gfa - target_gfa) > target_gfa * 0.005 and iteration < 200:
        diff = target_gfa - current_gfa
        for idx in sorted_indices:
            if diff > 0:
                if floors[idx] < max_range:
                    floors[idx] += 1
                    current_gfa += footprint_areas[idx]
                else:
                    continue
            else:
                if floors[idx] > min_floors_per_tower and floors[idx] > min_range:
                    floors[idx] -= 1
                    current_gfa -= footprint_areas[idx]
                else:
                    continue

            if abs(current_gfa - target_gfa) / target_gfa < 0.005:
                break
            if (diff > 0 and current_gfa > target_gfa) or (diff < 0 and current_gfa < target_gfa):
                if diff > 0:
                    floors[idx] -= 1
                    current_gfa -= footprint_areas[idx]
                else:
                    floors[idx] += 1
                    current_gfa += footprint_areas[idx]
                continue
            else:
                break
        iteration += 1

    if base_floors > 0 and heightVariation > 0:
        final_variation = (max(floors) - min(floors)) / float(base_floors)
        if abs(final_variation - heightVariation) > heightVariation * 0.15:
            return enforce_variation_range(floors, base_floors, heightVariation, min_floors_per_tower)
    return floors


def create_height_distribution_from_variation(num_towers, base_floors, heightVariation,
                                              footprint_areas, target_gfa, podium_floors, seed_val):
    if num_towers == 0:
        return []

    if heightVariation < 0.01:
        floors = [base_floors] * num_towers
        return adjust_floors_to_target(floors, footprint_areas, target_gfa, podium_floors)

    random.seed(seed_val + 8888)

    range_floors = heightVariation * base_floors
    min_floors = max(podium_floors + 2, int(round(base_floors - range_floors / 2)))
    max_floors = int(round(base_floors + range_floors / 2))
    if max_floors - min_floors < 2:
        min_floors = max(podium_floors + 2, base_floors - 2)
        max_floors = base_floors + 2

    factors = [random.uniform(min_floors / float(base_floors), max_floors / float(base_floors))
               for _ in range(num_towers)]

    weighted_sum = _gfa(factors, footprint_areas)

    if weighted_sum > 0 and target_gfa > 0:
        scale_needed = target_gfa / weighted_sum
        mean_factor = sum(factors) / len(factors)
        scaled_factors = [mean_factor + (f - mean_factor) * scale_needed for f in factors]

        min_allowed = max(0.3, 1.0 - heightVariation * 1.5)
        max_allowed = min(2.0, 1.0 + heightVariation * 1.5)
        scaled_factors = [max(min_allowed, min(max_allowed, f)) for f in scaled_factors]

        floors = [max(podium_floors + 2, int(round(base_floors * f))) for f in scaled_factors]

        return adjust_floors_to_target_preserve_variation(
            floors, footprint_areas, target_gfa, podium_floors,
            heightVariation, base_floors, min_floors, max_floors)

    return [base_floors] * num_towers


def validate_height_variation(floors, base_floors, expected_variation):
    if len(floors) < 2 or base_floors <= 0:
        return True, 0.0
    factors = [f / float(base_floors) for f in floors]
    actual_range = max(factors) - min(factors)
    tolerance = max(0.01, expected_variation * 0.1)
    return abs(actual_range - expected_variation) <= tolerance, actual_range


def calculate_actual_variation(floors, base_floors):
    if len(floors) < 2 or base_floors <= 0:
        return 0.0
    factors = [f / float(base_floors) for f in floors]
    return max(factors) - min(factors)


def create_height_bins(heights, num_bins=5):
    if not heights:
        return [], []
    min_h = min(heights)
    max_h = max(heights)
    if max_h == min_h:
        return [min_h], [len(heights)]

    if HAS_NP and len(heights) >= NP_THRESHOLD:
        arr = np.asarray(heights, dtype=float)
        edges = np.linspace(min_h, max_h, num_bins + 1)
        counts, _ = np.histogram(arr, bins=edges)
        centers = (edges[:-1] + edges[1:]) * 0.5
        return [float(v) for v in centers], [int(v) for v in counts]

    bin_width = (max_h - min_h) / num_bins
    bins = []
    counts = []
    for i in range(num_bins):
        bin_start = min_h + i * bin_width
        bin_end = bin_start + bin_width
        bins.append((bin_start + bin_end) / 2)
        counts.append(sum(1 for h in heights if bin_start <= h < bin_end))
    bins[-1] = (min_h + (num_bins - 1) * bin_width + max_h) / 2
    counts[-1] = sum(1 for h in heights if h >= min_h + (num_bins - 1) * bin_width)
    return bins, counts


def _height_stats(values):
    """[S1-9] numpy for std / quartiles."""
    if not values:
        return dict(min_h=0.0, max_h=0.0, avg_h=0.0, std_dev=0.0, cv=0.0,
                    height_range=0.0, variation_percent=0.0, q1=0.0, q2=0.0, q3=0.0, iqr=0.0)

    if HAS_NP and len(values) >= NP_THRESHOLD:
        arr = np.asarray(values, dtype=float)
        min_h = float(arr.min())
        max_h = float(arr.max())
        avg_h = float(arr.mean())
        std_dev = float(arr.std())
    else:
        min_h = min(values)
        max_h = max(values)
        avg_h = sum(values) / len(values)
        var = sum((h - avg_h) ** 2 for h in values) / len(values)
        std_dev = math.sqrt(var)

    cv = std_dev / avg_h if avg_h > 0 else 0.0
    height_range = max_h - min_h
    variation_percent = (height_range / avg_h * 100) if avg_h > 0 else 0.0

    if len(values) >= 3:
        sh = sorted(values)
        q1 = sh[len(sh) // 4]
        q2 = sh[len(sh) // 2]
        q3 = sh[3 * len(sh) // 4]
        iqr = q3 - q1
    else:
        q1 = q2 = q3 = iqr = 0.0

    return dict(min_h=min_h, max_h=max_h, avg_h=avg_h, std_dev=std_dev, cv=cv,
                height_range=height_range, variation_percent=variation_percent,
                q1=q1, q2=q2, q3=q3, iqr=iqr)


# =====================================================================
# PART G - SINGLE-SITE SOLVER
# =====================================================================

def solve_site(site_index, siteCrv, centroids, P):
    _PODIUM_MEMO.clear()
    _EDGE_CACHE.clear()
    report = []
    timings = {}
    _t_stage = [time.perf_counter()]

    def mark(name):
        now = time.perf_counter()
        timings[name] = timings.get(name, 0.0) + (now - _t_stage[0])
        _t_stage[0] = now

    def log(msg=""):
        print(msg)
        report.append(msg)

    def g(name, default):
        v = P.get(name, None)
        return default if v is None else v

    FAR = float(g("FAR", 3.0))
    BCR = float(g("BCR", 0.5))
    setback = float(g("setback", 5.0))
    podiumFloors = int(g("podiumFloors", 2))
    floorHeight = float(g("floorHeight", 3.5))
    minWidth = float(g("minWidth", 12.0))
    heightVariation = float(g("heightVariation", 0.0))

    seed = int(g("seed", 0)) % 10000
    towerSizeMode = max(0, min(3, int(g("towerSizeMode", 1))))
    podiumMinOffset = max(0.0, float(g("podiumMinOffset", 2.0)))
    podiumMaxOffset = max(podiumMinOffset + 0.5, float(g("podiumMaxOffset", 15.0)))
    globalRotationMode = max(0, min(3, int(g("globalRotationMode", 0))))
    uniformRotationDeg = max(0.0, min(180.0, float(g("uniformRotationDeg", 0.0))))

    minFootprintPerTower = max(20.0, float(g("minFootprintPerTower", 80.0)))
    maxFootprintPerTower = max(minFootprintPerTower + 30.0, float(g("maxFootprintPerTower", 350.0)))

    minTowerDistance = max(0.0, float(g("minTowerDistance", 12.0)))
    towerGrowStep = max(0.1, float(g("towerGrowStep", 1.0)))
    towerGrowIterations = max(0, int(g("towerGrowIterations", 80)))
    maxLengthWidthRatio = max(2.0, float(g("maxLengthWidthRatio", 4.0)))
    towerBCRPriority = max(0.0, min(1.0, float(g("towerBCRPriority", 0.65))))
    upperBCR = max(BCR * 1.05, float(g("upperBCR", BCR * 1.1)))

    towerTypologyMode = max(0, min(7, int(g("towerTypologyMode", 0))))
    armLengthRatio = max(0.3, float(g("armLengthRatio", 1.3)))

    courtyardCount = max(1, int(g("courtyardCount", 1)))
    courtyardBreakCount = max(1, int(g("courtyardBreakCount", 4)))
    courtyardBreakWidth = max(1.0, float(g("courtyardBreakWidth", max(minWidth * 1.5, 4.0))))
    courtyardZoneGap = max(0.0, float(g("courtyardZoneGap", max(minTowerDistance, minWidth))))
    courtyardSplitAngle = max(-45.0, min(45.0, float(g("courtyardSplitAngle", 0.0))))
    courtyardBreakShift = float(g("courtyardBreakShift", 0.0))
    courtyardLayoutMode = max(0, min(1, int(g("courtyardLayoutMode", 0))))

    maxBuildingHeight = max(3.0, float(g("maxBuildingHeight", 100.0)))
    minBuildingHeight = max(3.0, min(float(g("minBuildingHeight", 3.0)), maxBuildingHeight - 1.0))
    heightRegulationMode = max(0, min(2, int(g("heightRegulationMode", 0))))
    enforceHeightRegulation = bool(g("enforceHeightRegulation", False))

    moveToBoundary = bool(g("moveToBoundary", False))
    moveAllToSetback = bool(g("moveAllToSetback", False))
    moveTowerToPodiumEdge = bool(g("moveTowerToPodiumEdge", False))
    alignTowersToEdge = bool(g("alignTowersToEdge", False))
    edgeAlignBothOrientations = bool(g("edgeAlignBothOrientations", True))

    IS_COURTYARD = (towerTypologyMode == 7)
    random.seed(seed)

    # ---------------- 1. SITE & TARGETS ----------------
    site_area = _fast_area(siteCrv)
    if site_area < 0.1:
        raise ValueError("Site area too small or invalid curve")
    site_centroid = _fast_centroid(siteCrv)

    TARGET_GFA = site_area * FAR
    TARGET_BCR_AREA = site_area * BCR
    BCR_TOL = max(1.0, TARGET_BCR_AREA * 0.015)

    # [S4-16] no fallback to the full site boundary
    if setback <= 1e-6:
        buildableSite = siteCrv
    else:
        buildableSite = None
        # inward direction depends on curve orientation: try both signs and
        # keep only a result that is strictly smaller than the site
        for dist in (-setback, setback):
            try:
                offsets = rg.Curve.Offset(siteCrv, rg.Plane.WorldXY, dist, 0.01,
                                          rg.CurveOffsetCornerStyle.Sharp)
            except Exception:
                offsets = None
            cands = [c for c in (offsets or [])
                     if c is not None and c.IsValid and c.IsClosed
                     and 0.1 < _fast_area(c) < site_area - 1e-6]
            buildableSite = _biggest_piece(cands)
            if buildableSite is not None:
                break
        if buildableSite is None:
            raise ValueError("Setback offset failed ({:.2f} m too large for this site); "
                             "no buildable area".format(setback))

    BSITE = CachedCurve(buildableSite)   # bbox / area reused across the whole pipeline
    mark("site")

    # ---------------- 2. VALID CENTROIDS ----------------
    valid_pts = []
    for pt in centroids or []:
        if pt is not None:
            pt2d = rg.Point3d(pt.X, pt.Y, 0)
            # bbox pre-filter before Contains
            bb = BSITE.bbox
            if bb.Min.X - 0.01 <= pt2d.X <= bb.Max.X + 0.01 and \
               bb.Min.Y - 0.01 <= pt2d.Y <= bb.Max.Y + 0.01:
                if buildableSite.Contains(pt2d, rg.Plane.WorldXY, 0.01) == rg.PointContainment.Inside:
                    valid_pts.append(pt2d)

    # [S4-16] supplied-but-invalid centroids are an error, not a fallback
    supplied = [p for p in (centroids or []) if p is not None]
    if not valid_pts and not IS_COURTYARD:
        if supplied:
            raise ValueError("None of the {} supplied centroid(s) lies inside the "
                             "buildable site".format(len(supplied)))
        c2d = rg.Point3d(site_centroid.X, site_centroid.Y, 0)
        if buildableSite.Contains(c2d, rg.Plane.WorldXY, 0.01) != rg.PointContainment.Inside:
            raise ValueError("No centroids supplied and the site centroid lies outside "
                             "the buildable site")
        valid_pts = [c2d]
        log("  No centroids supplied; site centroid used as the seed point")

    random.seed(seed + 1000)
    scored = [(i, pt.X * 1000 + pt.Y * 100 + random.random() * 50000)
              for i, pt in enumerate(valid_pts)]
    scored.sort(key=lambda x: x[1])
    valid_pts = [valid_pts[i] for i, _ in scored]

    # ---------------- 3. DIMENSIONS ----------------
    w = max(minWidth, 2.0)
    min_length = max(2.0 * w, minFootprintPerTower / w)
    max_length = min(maxLengthWidthRatio * w, maxFootprintPerTower / w)
    if max_length < min_length:
        max_length = min_length
    arm_length = armLengthRatio * w

    log("  Site area {:,.1f} sqm | FAR {:.2f} | BCR {:.3f} | setback {:.1f} m".format(
        site_area, FAR, BCR, setback))
    log("  Typology mode {} ({}), size mode {}, seed {}".format(
        towerTypologyMode, TYPOLOGY_NAMES.get(towerTypologyMode, "Random"), towerSizeMode, seed))

    # ---------------- 4. SITE-DEPENDENT HELPERS ----------------
    def angle_candidates(tower_index, anchor_pt=None, typology=0):
        forced_angle = get_global_rotation_angle(globalRotationMode, seed, uniformRotationDeg)
        if forced_angle is not None:
            return [forced_angle]

        random.seed(seed * 37 + tower_index * 19 + 73)
        base_angles = [0, 15, 30, 45, 60, 75, 90, 105, 120, 135, 150, 165]
        extra_angles = [random.uniform(0, 180) for _ in range(5)]
        all_angles = list(set(round(a, 1) for a in base_angles + extra_angles))
        random.shuffle(all_angles)

        if alignTowersToEdge and anchor_pt is not None:
            # [S5-17/18] real edges, corner-aware, spine-back flip first
            preferred = []
            ecands = _edge_candidates(anchor_pt, BSITE, w, 2)
            for e, _d in ecands:
                preferred += [round(a, 1) for a in _oriented_angles(e[4], e[6], e[7], typology)]
            if edgeAlignBothOrientations:
                for e, _d in ecands:
                    preferred += [round(a, 1) for a in
                                  _oriented_angles(e[4], e[6], e[7], typology, True)]
            seen = set()
            preferred = [a for a in preferred if not (a in seen or seen.add(a))]
            rest = [a for a in all_angles if a not in seen]
            all_angles = preferred + rest
        return all_angles

    def create_tower_footprint(pt, length, width, existing, tower_index, typology, arm_len):
        if width < minWidth - 0.001:
            return None, None
        for angle in angle_candidates(tower_index, pt, typology):
            curve = create_typology_curve(pt, length, width, angle, typology, arm_len)
            if not curve:
                continue
            candidate = CachedCurve(curve)
            if candidate.area > maxFootprintPerTower * 1.05:
                continue
            if is_valid_tower_candidate(candidate, existing, BSITE,
                                        minFootprintPerTower, minTowerDistance):
                return candidate, angle
        return None, None

    def grow_towers_to_bcr(fps, centers, angles, lengths, typologies, width, arm_len,
                           target_area, step, max_iter):
        """[S1-8] Keep a running total instead of re-summing in the inner loop."""
        if not fps:
            return fps, lengths, 0.0, 0
        growth_count = 0
        running = sum(fp.area for fp in fps)

        for _ in range(max_iter):
            if running >= target_area - BCR_TOL:
                break
            improved = False
            order = list(range(len(fps)))
            random.seed(seed + 10000 + growth_count)
            random.shuffle(order)

            for idx in order:
                if running >= target_area - BCR_TOL:
                    break
                eff_max_length = max_length_for_typology(typologies[idx], width, arm_len,
                                                         maxFootprintPerTower, max_length)
                old_length = lengths[idx]
                new_length = min(eff_max_length, old_length + step)
                if new_length <= old_length + 0.001:
                    continue

                curve = create_typology_curve(centers[idx], new_length, width, angles[idx],
                                              typologies[idx], arm_len)
                if not curve:
                    continue
                candidate = CachedCurve(curve)
                if candidate.area > maxFootprintPerTower * 1.05:
                    continue
                others = [fp for j, fp in enumerate(fps) if j != idx]
                if is_valid_tower_candidate(candidate, others, BSITE,
                                            minFootprintPerTower, minTowerDistance):
                    running += candidate.area - fps[idx].area
                    fps[idx] = candidate
                    lengths[idx] = new_length
                    improved = True
                    growth_count += 1
            if not improved:
                break
        return fps, lengths, running, growth_count

    # ---------------- 5. INITIAL LAYOUT ----------------
    footprints = []
    tower_centers = []
    tower_angles = []
    tower_lengths = []
    tower_typologies = []
    footprints_data = []
    grow_steps_used = 0
    courtyard_ring_width_used = w
    courtyard_coverage_used = 0.7
    cy_ctx = None

    if IS_COURTYARD:
        tower_target_cy = max(1.0, min(TARGET_BCR_AREA, TARGET_BCR_AREA * towerBCRPriority))
        min_slat_area = max(1.0, minFootprintPerTower * 0.15)
        start_coverage = initial_coverage_for_size_mode(towerSizeMode, seed)

        # [S2-11] build the context ONCE
        cy_ctx = CourtyardContext(buildableSite, courtyardCount, courtyardBreakCount,
                                  courtyardBreakWidth, w, towerSizeMode, seed, min_slat_area,
                                  courtyardSplitAngle, courtyardZoneGap,
                                  courtyardBreakShift, courtyardLayoutMode)

        footprints, tower_centers, courtyard_coverage_used, tower_area, grow_steps_used = \
            grow_courtyard_to_bcr(cy_ctx, tower_target_cy, towerGrowIterations, BCR_TOL,
                                  start_coverage)

        tower_angles = [0.0] * len(footprints)
        tower_lengths = [0.0] * len(footprints)
        tower_typologies = [7] * len(footprints)
        log("  Courtyard: {} buildings / {} zone(s), band width {:.2f} m, coverage {:.2f}".format(
            len(footprints), courtyardCount, courtyard_ring_width_used, courtyard_coverage_used))
    else:
        for i, pt in enumerate(valid_pts):
            minA = minFootprintPerTower
            maxA = maxFootprintPerTower
            rangeA = maxA - minA
            third = rangeA / 3.0

            random.seed(seed + 5500 + i)
            if towerSizeMode == 0:
                target_area = minA + (random.random() ** 1.6) * third
            elif towerSizeMode == 1:
                target_area = (minA + third) + random.random() * third
            elif towerSizeMode == 2:
                target_area = (minA + 2 * third) + (random.random() ** 0.6) * (maxA - (minA + 2 * third))
            else:
                target_area = minA + random.random() * rangeA
            target_area = max(minA, min(maxA, target_area))

            tower_typology = get_tower_typology(i, seed, towerTypologyMode)
            extra_area_est = estimate_extra_area(tower_typology, w, arm_length)
            spine_target_area = max(minA * 0.4, target_area - extra_area_est)
            eff_max_length = max_length_for_typology(tower_typology, w, arm_length,
                                                     maxFootprintPerTower, max_length)
            length = max(min_length, min(eff_max_length, spine_target_area / w))

            fp, angle = create_tower_footprint(pt, length, w, footprints, i, tower_typology, arm_length)
            if fp:
                footprints.append(fp)
                tower_centers.append(pt)
                tower_angles.append(angle if angle is not None else 0.0)
                tower_lengths.append(length)
                tower_typologies.append(tower_typology)
                footprints_data.append((pt, length, angle if angle is not None else 0.0, tower_typology))

    # [S4-16] no unvalidated fallback tower
    if not footprints:
        raise ValueError("No valid footprint on this site (size / spacing / boundary "
                         "constraints cannot be met); site excluded")

    tower_area = sum(fp.area for fp in footprints)
    log("  Placed {} buildings; initial footprint area {:,.1f} sqm".format(len(footprints), tower_area))
    mark("layout")

    # ---------------- 6. GROW TO BCR ----------------
    if not IS_COURTYARD:
        tower_target_bcr_area = TARGET_BCR_AREA * towerBCRPriority
        tower_target_bcr_area = max(tower_area, min(TARGET_BCR_AREA, tower_target_bcr_area))
        footprints, tower_lengths, tower_area, grow_steps_used = grow_towers_to_bcr(
            footprints, tower_centers, tower_angles, tower_lengths, tower_typologies,
            w, arm_length, tower_target_bcr_area, towerGrowStep, towerGrowIterations)
        log("  Growth steps {} -> footprint area {:,.1f} sqm".format(grow_steps_used, tower_area))
    mark("grow")

    # ---------------- 7. ADAPTIVE ARM LENGTH ----------------
    if not IS_COURTYARD:
        target_adaptive = TARGET_BCR_AREA * towerBCRPriority
        current_tower_area = tower_area
        has_adaptive_shapes = any(t != 0 for t in tower_typologies)

        # [S5-23] rebuild from the CURRENT (grown) lengths
        footprints_data = [(tower_centers[i], tower_lengths[i], tower_angles[i], tower_typologies[i])
                           for i in range(len(footprints))]
        if has_adaptive_shapes and abs(current_tower_area - target_adaptive) > BCR_TOL and footprints_data:
            optimized_ratio, new_footprints, new_area, success = adapt_arm_length_for_bcr(
                armLengthRatio, target_adaptive, current_tower_area, footprints_data,
                BSITE, w, minTowerDistance, minFootprintPerTower,
                maxFootprintPerTower, BCR_TOL, 15)
            if success and new_footprints is not None:
                armLengthRatio = optimized_ratio
                arm_length = armLengthRatio * w
                footprints = new_footprints
                tower_area = new_area
                grow_steps_used += 1
                log("  Arm ratio adjusted -> {:.3f}, area {:,.1f} sqm".format(armLengthRatio, tower_area))
    mark("adaptive_arm")

    # ---------------- 8. ALIGN, THEN MOVE  [S5-20] ----------------
    if alignTowersToEdge and not IS_COURTYARD:
        footprints, tower_centers, tower_angles = align_towers_to_nearest_edge(
            footprints, tower_centers, tower_angles, tower_lengths, tower_typologies,
            w, arm_length, BSITE, minTowerDistance, minFootprintPerTower,
            maxFootprintPerTower, edgeAlignBothOrientations, min_length)
        tower_area = sum(fp.area for fp in footprints)

    if moveToBoundary and not IS_COURTYARD:
        footprints, tower_centers = move_towers_to_boundary(
            footprints, tower_centers, tower_angles, tower_lengths, tower_typologies,
            w, arm_length, BSITE, minTowerDistance, minFootprintPerTower, maxFootprintPerTower)
        tower_area = sum(fp.area for fp in footprints)

    if moveAllToSetback and not IS_COURTYARD:
        footprints, tower_centers = move_buildings_to_nearest_setback(
            footprints, tower_centers, tower_angles, tower_lengths, tower_typologies,
            w, arm_length, BSITE, minTowerDistance, minFootprintPerTower)
        tower_area = sum(fp.area for fp in footprints)
    mark("move_align")

    # ---------------- 9. REMOVE BUILDINGS IF BCR IS TOO HIGH ----------------
    BCR_TOLERANCE = 0.015
    MIN_TOWERS_KEPT = 1

    if len(footprints) > MIN_TOWERS_KEPT:
        current_bcr = tower_area / site_area if site_area > 0 else 0.0
        if current_bcr > BCR + BCR_TOLERANCE * 2.5:
            removal_candidates = []
            for i, fp in enumerate(footprints):
                dist = tower_centers[i].DistanceTo(site_centroid)
                removal_candidates.append((i, fp.area - dist * 0.3))
            removal_order = [i for i, _ in sorted(removal_candidates, key=lambda x: x[1], reverse=True)]
            removed = set()
            running = tower_area

            for idx in removal_order:
                if len(footprints) - len(removed) <= MIN_TOWERS_KEPT:
                    break
                removed.add(idx)
                running -= footprints[idx].area
                current_bcr = running / site_area if site_area > 0 else 0.0
                if current_bcr <= BCR + BCR_TOLERANCE:
                    break

            keep = [j for j in range(len(footprints)) if j not in removed]
            footprints = [footprints[j] for j in keep]
            tower_centers = [tower_centers[j] for j in keep]
            tower_angles = [tower_angles[j] for j in keep]
            tower_lengths = [tower_lengths[j] for j in keep]
            tower_typologies = [tower_typologies[j] for j in keep]
            tower_area = sum(fp.area for fp in footprints)
            log("  Removed {} buildings to respect BCR; now {:.4f}".format(len(removed), current_bcr))

    # ---------------- 10-11. BCR CASCADE  [S5-22] ----------------
    max_offset_limit = podiumMaxOffset                        # [S5-24]
    FINAL_TOL = max(0.5, TARGET_BCR_AREA * 0.004)
    CAP_AREA = upperBCR * site_area
    shrink_iterations = 0
    expand_iterations = 0

    def _towers_only(fps):
        return sum(f.area for f in fps), [f.curve for f in fps], 0.0

    def _with_podium(fps, off):
        if off < 0.01:
            return _towers_only(fps)
        a_, c_ = create_individual_podiums(fps, off, BSITE, seed)
        if not c_ or a_ < 0.1:
            return None
        return a_, c_, off

    def _rescale(fps, centers, angles, lengths, typologies, s):
        """Every spine -> clamp(L * s); s = 0 means min_length. A tower whose
        new size fails validation keeps its current size."""
        nf, nl = list(fps), list(lengths)
        for i in range(len(nf)):
            eff_max = max_length_for_typology(typologies[i], w, arm_length,
                                              maxFootprintPerTower, max_length)
            L = max(min_length, min(eff_max, lengths[i] * s))
            if abs(L - lengths[i]) < 1e-3:
                continue
            crv = create_typology_curve(centers[i], L, w, angles[i], typologies[i], arm_length)
            if not crv:
                continue
            fp = CachedCurve(crv)
            if fp.area > maxFootprintPerTower * 1.05:
                continue
            others = [nf[j] for j in range(len(nf)) if j != i]
            if is_valid_tower_candidate(fp, others, BSITE, minFootprintPerTower, minTowerDistance):
                nf[i] = fp
                nl[i] = L
        return nf, nl

    def _err(a_):
        return abs(a_ - TARGET_BCR_AREA)

    def calibrate_bcr(fps, centers, angles, lengths, typologies, _depth=0):
        """Returns (fps, centers, angles, lengths, typologies, offset, area, curves, note)."""
        nonlocal shrink_iterations, expand_iterations
        T = TARGET_BCR_AREA
        fps, centers, angles = list(fps), list(centers), list(angles)
        lengths, typologies = list(lengths), list(typologies)

        # (a) towers alone above target: rescale, then remove
        removed = 0
        while fps and sum(f.area for f in fps) > T + FINAL_TOL:
            f0, l0 = _rescale(fps, centers, angles, lengths, typologies, 0.0)
            shrink_iterations += 1
            if sum(f.area for f in f0) > T + FINAL_TOL:
                if len(fps) <= 1:
                    fps, lengths = f0, l0
                    break
                excess = sum(f.area for f in f0) - T
                k = min(range(len(fps)), key=lambda i: abs(f0[i].area - excess))
                fps, centers, angles, lengths, typologies = (
                    [v for i, v in enumerate(lst) if i != k]
                    for lst in (fps, centers, angles, lengths, typologies))
                removed += 1
                continue
            best = (f0, l0)
            lo, hi = 0.0, 1.0
            for _ in range(10):
                mid = 0.5 * (lo + hi)
                fm, lm = _rescale(fps, centers, angles, lengths, typologies, mid)
                shrink_iterations += 1
                am = sum(f.area for f in fm)
                if am > T + FINAL_TOL:
                    hi = mid
                else:
                    lo = mid
                    best = (fm, lm)
                    if am >= T - FINAL_TOL:
                        break
            fps, lengths = best
            break
        if removed:
            log("  BCR cascade: removed {} building(s) whose size could not shrink enough".format(removed))

        ta = sum(f.area for f in fps)
        if ta >= T - FINAL_TOL:
            a_, c_, o_ = _towers_only(fps)
            return fps, centers, angles, lengths, typologies, o_, a_, c_, "towers only"

        # (b)/(c) podium
        r_min = _with_podium(fps, podiumMinOffset)
        if r_min is not None and r_min[0] > T + FINAL_TOL:
            # min podium ring already overshoots -> shrink towers under it
            options = [(fps, lengths, _towers_only(fps))]
            lo, hi = 0.0, 1.0
            for _ in range(10):
                mid = 0.5 * (lo + hi)
                fm, lm = _rescale(fps, centers, angles, lengths, typologies, mid)
                shrink_iterations += 1
                rm = _with_podium(fm, podiumMinOffset)
                if rm is None:
                    lo = mid
                    continue
                if rm[0] <= CAP_AREA:
                    options.append((fm, lm, rm))
                if rm[0] > T + FINAL_TOL:
                    hi = mid
                else:
                    lo = mid
                    if rm[0] >= T - FINAL_TOL:
                        break
            fb, lb, rb = min(options, key=lambda o: _err(o[2][0]))
            return fb, centers, angles, lb, typologies, \
                rb[2], rb[0], rb[1], "towers rescaled under min podium"

        # (d) podium saturates at max offset -> grow towers, re-solve
        r_max = _with_podium(fps, max_offset_limit)
        rounds = 0
        while (r_max is None or r_max[0] < T - FINAL_TOL) and rounds < 4:
            rounds += 1
            expand_iterations += 1
            base = r_max[0] if r_max is not None else ta
            gfps, glen, gta, gcount = grow_towers_to_bcr(
                list(fps), centers, angles, list(lengths), typologies, w, arm_length,
                ta + (T - base), towerGrowStep, towerGrowIterations)
            if gcount == 0:
                break
            fps, lengths, ta = gfps, glen, gta
            if ta >= T - FINAL_TOL:
                if ta > T + FINAL_TOL and _depth < 2:
                    # growth overshot -> back through (a) to rescale precisely
                    return calibrate_bcr(fps, centers, angles, lengths, typologies, _depth + 1)
                a_, c_, o_ = _towers_only(fps)
                return fps, centers, angles, lengths, typologies, o_, a_, c_, "towers grown"
            r_max = _with_podium(fps, max_offset_limit)

        if r_max is not None and r_max[0] >= T - FINAL_TOL:
            off, a_, c_ = find_optimal_podium_offset(fps, T, BSITE, seed, podiumMinOffset,
                                                     max_offset_limit, tol=FINAL_TOL)
            if c_ and a_ >= 0.1:
                return fps, centers, angles, lengths, typologies, off, a_, c_, "podium offset solved"

        best = _towers_only(fps)
        if r_max is not None and _err(r_max[0]) < _err(best[0]):
            best = r_max
        log("  BCR cascade: target not reachable within the constraints; "
            "max achieved BCR {:.4f} (buildable area / site = {:.4f})".format(
                best[0] / site_area, BSITE.area / site_area))
        return fps, centers, angles, lengths, typologies, best[2], best[0], best[1], "unreachable"

    if IS_COURTYARD:
        podium_offset = 0.0
        cf, cc, ccov, carea, csteps = grow_courtyard_to_bcr(
            cy_ctx, TARGET_BCR_AREA, 12, FINAL_TOL, courtyard_coverage_used)
        expand_iterations = csteps
        if cf and carea <= CAP_AREA and _err(carea) < _err(sum(f.area for f in footprints)):
            footprints, tower_centers, courtyard_coverage_used = cf, cc, ccov
            tower_angles = [0.0] * len(footprints)
            tower_lengths = [0.0] * len(footprints)
            tower_typologies = [7] * len(footprints)
        podium_area, podium_curves = create_individual_podiums(footprints, 0.0, BSITE, seed)
        cascade_note = "courtyard coverage {:.3f}".format(courtyard_coverage_used)
    else:
        (footprints, tower_centers, tower_angles, tower_lengths, tower_typologies,
         podium_offset, podium_area, podium_curves, cascade_note) = calibrate_bcr(
            footprints, tower_centers, tower_angles, tower_lengths, tower_typologies)

        if moveTowerToPodiumEdge and podium_offset > 0.01:
            footprints, tower_centers = move_towers_to_podium_edge(
                footprints, tower_centers, tower_angles, tower_lengths, tower_typologies,
                w, arm_length, BSITE, podium_offset, minTowerDistance,
                minFootprintPerTower, seed)
            # towers moved -> podium shape changed -> re-solve the cascade
            (footprints, tower_centers, tower_angles, tower_lengths, tower_typologies,
             podium_offset, podium_area, podium_curves, cascade_note) = calibrate_bcr(
                footprints, tower_centers, tower_angles, tower_lengths, tower_typologies)

    if not footprints:
        raise ValueError("BCR calibration left no building on this site; site excluded")
    if podium_area > CAP_AREA + 1e-6:
        raise ValueError("BCR {:.4f} exceeds upperBCR {:.4f}; site excluded".format(
            podium_area / site_area, upperBCR))

    total_footprint_area = podium_area
    total_footprint_curves = podium_curves

    def calculate_total_bcr():
        return total_footprint_area / site_area if site_area > 0 else 0.0

    tower_area = sum(fp.area for fp in footprints)
    used_areas = [fp.area for fp in footprints]
    log("  BCR cascade ({}): podium offset {:.2f} m -> BCR {:.4f} (target {:.4f}, err {:+.4f})".format(
        cascade_note, podium_offset, calculate_total_bcr(), BCR, calculate_total_bcr() - BCR))
    mark("bcr_adjust")

    # ---------------- 12. PODIUM 3D MASSES ----------------
    podium_height = podiumFloors * floorHeight
    podiumMasses = []
    for crv in podium_curves:
        try:
            ext = rg.Extrusion.Create(_ensure_ccw(crv), podium_height, True)
            if ext:
                podiumMasses.append(ext.ToBrep())
        except Exception:
            pass

    PODIUM_GFA = 0.0
    for c in podium_curves:
        PODIUM_GFA += _fast_area(c)
    PODIUM_GFA *= podiumFloors

    TOWER_GFA_TARGET = max(TARGET_GFA - PODIUM_GFA, 0.0)
    total_tower_fp_area = sum(used_areas) if used_areas else 0.1

    # ---------------- 13. HEIGHTS + REGULATION ----------------
    def check_height_regulations(tower_heights, pod_h, max_height, min_height, mode):
        """Returns tower heights (ABOVE the podium) after applying the rule.
        Heights are clamped to >= 0 so a podium taller than the limit never
        produces a negative tower."""
        if not enforceHeightRegulation or mode == 0:
            return tower_heights, {"violations": 0, "adjusted": 0, "details": []}

        adjusted_heights = []
        violations = []
        adjusted_count = 0

        for i, h in enumerate(tower_heights):
            total_height = pod_h + h

            if mode == 1:
                if total_height > max_height:
                    new_tower_h = max(0.0, max_height - pod_h)
                    adjusted_heights.append(new_tower_h)
                    violations.append({"tower_index": i, "original_height": total_height,
                                       "adjusted_height": pod_h + new_tower_h,
                                       "violation": "exceeds_max",
                                       "reduction": total_height - (pod_h + new_tower_h)})
                    adjusted_count += 1
                elif total_height < min_height:
                    new_tower_h = max(0.0, min(min_height, max_height) - pod_h)
                    adjusted_heights.append(new_tower_h)
                    violations.append({"tower_index": i, "original_height": total_height,
                                       "adjusted_height": pod_h + new_tower_h,
                                       "violation": "below_min",
                                       "increase": (pod_h + new_tower_h) - total_height})
                    adjusted_count += 1
                else:
                    adjusted_heights.append(h)

            elif mode == 2:
                if total_height > max_height:
                    new_tower_h = h - (total_height - max_height) * 0.7
                    if pod_h + new_tower_h < min_height:
                        new_tower_h = min_height - pod_h
                    new_tower_h = max(0.0, new_tower_h)
                    adjusted_heights.append(new_tower_h)
                    violations.append({"tower_index": i, "original_height": total_height,
                                       "adjusted_height": pod_h + new_tower_h,
                                       "violation": "exceeds_max_flexible",
                                       "reduction": total_height - (pod_h + new_tower_h)})
                    adjusted_count += 1
                elif total_height < min_height:
                    new_tower_h = max(0.0, min(min_height - pod_h, max_height - pod_h))
                    adjusted_heights.append(new_tower_h)
                    violations.append({"tower_index": i, "original_height": total_height,
                                       "adjusted_height": pod_h + new_tower_h,
                                       "violation": "below_min_flexible",
                                       "increase": (pod_h + new_tower_h) - total_height})
                    adjusted_count += 1
                else:
                    adjusted_heights.append(h)
            else:
                adjusted_heights.append(h)

        return adjusted_heights, {"violations": len(violations),
                                  "adjusted": adjusted_count, "details": violations}

    base_floors = max(podiumFloors + 2,
                      int(round(TOWER_GFA_TARGET / total_tower_fp_area
                                if total_tower_fp_area > 0 else podiumFloors + 5)))

    floors_list = create_height_distribution_from_variation(
        len(footprints), base_floors, heightVariation, used_areas,
        TOWER_GFA_TARGET, podiumFloors, seed)
    if not floors_list:
        floors_list = [base_floors] * len(footprints)

    is_valid_variation, actual_variation = validate_height_variation(
        floors_list, base_floors, heightVariation)

    if not is_valid_variation and len(footprints) >= 3 and heightVariation > 0.01:
        random.seed(seed + 9999)
        range_floors = heightVariation * base_floors
        min_floors = max(podiumFloors + 2, int(round(base_floors - range_floors / 2)))
        max_floors = int(round(base_floors + range_floors / 2))
        if max_floors - min_floors < 2:
            min_floors = max(podiumFloors + 2, base_floors - 2)
            max_floors = base_floors + 2

        floors_list = [random.randint(min_floors, max_floors) for _ in range(len(footprints))]
        floors_list = adjust_floors_to_target_preserve_variation(
            floors_list, used_areas, TOWER_GFA_TARGET, podiumFloors,
            heightVariation, base_floors, min_floors, max_floors)
        is_valid_variation, actual_variation = validate_height_variation(
            floors_list, base_floors, heightVariation)

        if not is_valid_variation and len(footprints) >= 4:
            sorted_indices = sorted(range(len(footprints)), key=lambda i: used_areas[i])
            floors_list = [0] * len(footprints)
            for i, idx in enumerate(sorted_indices):
                position = i / float(len(sorted_indices) - 1) if len(sorted_indices) > 1 else 0.5
                floors_list[idx] = int(round(min_floors + position * (max_floors - min_floors)))
            floors_list = adjust_floors_to_target_preserve_variation(
                floors_list, used_areas, TOWER_GFA_TARGET, podiumFloors,
                heightVariation, base_floors, min_floors, max_floors)
            is_valid_variation, actual_variation = validate_height_variation(
                floors_list, base_floors, heightVariation)

    heights = [f * floorHeight for f in floors_list]
    height_violations = {"violations": 0, "adjusted": 0, "details": []}

    # [S3-15] per-tower floor caps + FAR shortfall bookkeeping
    regulation_active = enforceHeightRegulation and heightRegulationMode > 0
    tower_floor_caps = []
    far_limited_by_height = False
    tower_gfa_shortfall = 0.0

    if regulation_active:
        adjusted_heights, height_violations = check_height_regulations(
            heights, podium_height, maxBuildingHeight, minBuildingHeight, heightRegulationMode)

        eps = 1e-9
        # number of tower floors that fit between the podium roof and the limit
        strict_cap = max(0, int(math.floor((maxBuildingHeight - podium_height) / floorHeight + eps)))
        # floors needed above the podium to reach minBuildingHeight
        min_reg_floors = max(0, int(math.ceil((minBuildingHeight - podium_height) / floorHeight - eps)))

        if heightRegulationMode == 1:
            # STRICT: floor() so rounding can never exceed the limit
            floors_list = [int(math.floor(h / floorHeight + eps)) for h in adjusted_heights]
            tower_floor_caps = [strict_cap] * len(floors_list)
        else:
            # FLEXIBLE: keep the softened height, but redistribution may not
            # push a tower above max(limit, its own regulated height)
            floors_list = [max(0, int(round(h / floorHeight))) for h in adjusted_heights]
            tower_floor_caps = [max(strict_cap, f) for f in floors_list]

        # minimum: reach minBuildingHeight, at least 1 tower floor - cap always wins
        floor_mins = [min(cap, max(1, min_reg_floors)) for cap in tower_floor_caps]
        floors_list = [max(floor_mins[i], min(tower_floor_caps[i], floors_list[i]))
                       for i in range(len(floors_list))]

        if strict_cap == 0:
            log("  Warning: podium height {:.1f} m already reaches maxBuildingHeight {:.1f} m; "
                "no tower floors allowed".format(podium_height, maxBuildingHeight))

        actual_gfa = _gfa(floors_list, used_areas)
        if TOWER_GFA_TARGET > 0 and abs(actual_gfa - TOWER_GFA_TARGET) / TOWER_GFA_TARGET > 0.005:
            floors_list, actual_gfa = adjust_floors_to_target_capped(
                floors_list, used_areas, TOWER_GFA_TARGET, tower_floor_caps, floor_mins)

        # final safety clamp (strict cap is absolute)
        floors_list = [min(f, tower_floor_caps[i]) for i, f in enumerate(floors_list)]
        heights = [f * floorHeight for f in floors_list]

        achieved = _gfa(floors_list, used_areas)
        tower_gfa_shortfall = max(0.0, TOWER_GFA_TARGET - achieved)
        if TOWER_GFA_TARGET > 0 and tower_gfa_shortfall > TOWER_GFA_TARGET * 0.005:
            far_limited_by_height = True
            log("  Height cap limits FAR: tower GFA short by {:,.0f} sqm "
                "(max achievable FAR {:.3f} vs target {:.3f})".format(
                    tower_gfa_shortfall, (PODIUM_GFA + achieved) / site_area, FAR))

        if height_violations["adjusted"] > 0:
            log("  Height regulation: {} buildings adjusted".format(height_violations["adjusted"]))

        if heightRegulationMode == 1:
            worst = max([podium_height + h for h in heights] or [podium_height])
            log("  Strict height check: tallest {:.2f} m <= limit {:.2f} m -> {}".format(
                worst, maxBuildingHeight, "OK" if worst <= maxBuildingHeight + 1e-6 else "VIOLATION"))

    actual_tower_gfa = _gfa(floors_list, used_areas)
    actual_variation = calculate_actual_variation(floors_list, base_floors)
    heightVariationError = abs(actual_variation - heightVariation)

    towerMasses = []
    zero_height = 0
    for fp, h in zip(footprints, heights):
        if h <= 1e-6:
            zero_height += 1
            continue
        try:
            top = _ensure_ccw(fp.curve)
            top.Transform(rg.Transform.Translation(0, 0, podium_height))
            ext = rg.Extrusion.Create(top, h, True)
            if ext:
                towerMasses.append(ext.ToBrep())
        except Exception:
            pass
    if zero_height:
        log("  {} tower(s) have 0 floors above the podium (height cap); no tower mass".format(
            zero_height))
    mark("heights_3d")

    # ---------------- 14. METRICS ----------------
    TotalBuildingHeights = [podium_height + h for h in heights]
    st = _height_stats(TotalBuildingHeights)
    HeightBins, HeightCounts = create_height_bins(TotalBuildingHeights, 5)

    ActualBCR = calculate_total_bcr()
    TotalGFA = PODIUM_GFA + actual_tower_gfa
    ActualFAR = TotalGFA / site_area if site_area > 0 else 0.0

    log("  FINAL -> BCR {:.4f} (target {:.4f}) | FAR {:.4f} (target {:.4f}) | {} buildings".format(
        ActualBCR, BCR, ActualFAR, FAR, len(footprints)))

    mark("metrics")
    timing_str = " | ".join("{}={:.0f}ms".format(k, v * 1000.0) for k, v in timings.items())
    log("  TIMING: " + timing_str)

    # ---------------- 15. RESULT ----------------
    return {
        "SiteIndex": site_index,
        "OK": True,
        "Error": "",
        "Report": "\n".join(report),
        "Timing": timing_str,

        "SiteCurve": siteCrv,
        "BuildableSite": buildableSite,
        "SiteArea": site_area,

        "TowerFootprints": [fp.curve for fp in footprints],
        "TowerMasses": towerMasses,
        "TowerCentroids": tower_centers,
        "TowerAngles": tower_angles,
        "TowerLengths": tower_lengths,
        "TowerTypologies": tower_typologies,
        "TowerTypologyNames": [TYPOLOGY_NAMES.get(t, "I") for t in tower_typologies],
        "TowerAreas": used_areas,
        "TowerEdgeAngleError": ([] if IS_COURTYARD else tower_edge_angle_errors(
            tower_centers, tower_angles, BSITE, w, edgeAlignBothOrientations)),

        "PodiumFootprints": podium_curves,
        "PodiumMasses": podiumMasses,
        "PodiumOffset": podium_offset,
        "PodiumArea": podium_area,

        "Floors": floors_list,
        "Heights": heights,
        "TotalBuildingHeights": TotalBuildingHeights,

        "NumTowers": len(footprints),
        "TowerTotalArea": tower_area,
        "PodiumGFA": PODIUM_GFA,
        "TowerGFA": actual_tower_gfa,
        "TotalGFA": TotalGFA,
        "ActualFAR": ActualFAR,
        "ActualBCR": ActualBCR,
        "FAR_Error": abs(ActualFAR - FAR),
        "BCR_Error": abs(ActualBCR - BCR),
        "TargetFAR": FAR,
        "TargetBCR": BCR,
        "UpperBCRUsed": upperBCR,

        "TowerWidthUsed": w,
        "ArmLengthRatioUsed": armLengthRatio,
        "SeedUsed": seed,
        "GrowStepsUsed": grow_steps_used,
        "ShrinkIterations": shrink_iterations,
        "ExpandIterations": expand_iterations,
        "BaseFloors": base_floors,
        "ActualHeightVariation": actual_variation,
        "HeightVariationError": heightVariationError,

        "CourtyardCoverageUsed": courtyard_coverage_used if IS_COURTYARD else None,
        "CourtyardRingWidthUsed": courtyard_ring_width_used if IS_COURTYARD else None,

        "HeightStats": {
            "MinHeight": st["min_h"], "MaxHeight": st["max_h"], "AvgHeight": st["avg_h"],
            "HeightRange": st["height_range"], "StdDev": st["std_dev"],
            "CoefficientOfVariation": st["cv"], "VariationPercent": st["variation_percent"],
            "Q1": st["q1"], "Median": st["q2"], "Q3": st["q3"], "IQR": st["iqr"],
            "HeightBins": HeightBins, "HeightCounts": HeightCounts,
            "TotalFloors": sum(floors_list) if floors_list else 0,
            "InputHeightVariation": heightVariation,
            "ActualHeightVariation": actual_variation,
            "HeightVariationError": heightVariationError,
            "BaseFloors": base_floors,
            "TowerGFA_Target": TOWER_GFA_TARGET,
            "TowerGFA_Actual": actual_tower_gfa,
            "VariationToleranceMet": is_valid_variation,
            "HeightRegulationEnforced": enforceHeightRegulation,
            "HeightRegulationMode": heightRegulationMode,
            "HeightViolationsCount": height_violations.get("violations", 0),
            "HeightAdjustedCount": height_violations.get("adjusted", 0),
            "HeightViolations": height_violations.get("details", []),
            "TowerFloorCap": tower_floor_caps,
            "FARLimitedByHeight": far_limited_by_height,
            "TowerGFAShortfall": tower_gfa_shortfall,
        },
    }


# =====================================================================
# PART H - MULTI-SITE DRIVER
# =====================================================================
_SCOPE = globals()

PARAM_NAMES = [
    "FAR", "BCR", "setback", "podiumFloors", "floorHeight", "minWidth", "heightVariation",
    "towerSizeMode", "seed", "podiumMinOffset", "podiumMaxOffset",
    "globalRotationMode", "uniformRotationDeg",
    "minFootprintPerTower", "maxFootprintPerTower",
    "minTowerDistance", "towerGrowStep", "towerGrowIterations",
    "maxLengthWidthRatio", "towerBCRPriority", "upperBCR",
    "towerTypologyMode", "armLengthRatio",
    "courtyardCount", "courtyardBreakCount", "courtyardBreakWidth", "courtyardZoneGap",
    "courtyardSplitAngle", "courtyardBreakShift", "courtyardLayoutMode",
    "maxBuildingHeight", "minBuildingHeight", "heightRegulationMode", "enforceHeightRegulation",
    "moveToBoundary", "moveAllToSetback", "moveTowerToPodiumEdge",
    "alignTowersToEdge", "edgeAlignBothOrientations",
]


def _as_list(v):
    if v is None:
        return []
    if isinstance(v, (list, tuple)):
        return list(v)
    if isinstance(v, str):
        return [v]
    if hasattr(v, "__iter__"):
        try:
            return list(v)
        except Exception:
            return [v]
    return [v]


def _pick(name, i):
    vals = _as_list(_SCOPE.get(name, None))
    if not vals:
        return None
    return vals[i] if i < len(vals) else vals[-1]


def _centroids_for(i):
    c = _SCOPE.get("centroids", None)
    if c is None:
        return []
    if hasattr(c, "BranchCount"):
        try:
            bc = c.BranchCount
            if bc == 0:
                return []
            return [p for p in c.Branch(min(i, bc - 1))]
        except Exception:
            pass
    lst = _as_list(c)
    if not lst:
        return []
    if isinstance(lst[0], (list, tuple)):
        return list(lst[min(i, len(lst) - 1)])
    return lst


def _tree(list_of_lists):
    if not HAS_GH:
        return list_of_lists
    try:
        t = DataTree[object]()
        for i, sub in enumerate(list_of_lists):
            t.AddRange(sub if sub else [], GH_Path(i))
        return t
    except Exception:
        return list_of_lists


def _empty_result(si, site, P, note, ok=False, error=""):
    return {
        "SiteIndex": si, "OK": ok, "Error": error, "Report": note, "Timing": "",
        "SiteCurve": site, "BuildableSite": None, "SiteArea": 0.0,
        "TowerFootprints": [], "TowerMasses": [], "TowerCentroids": [], "TowerAngles": [],
        "TowerLengths": [], "TowerTypologies": [], "TowerTypologyNames": [], "TowerAreas": [], "TowerEdgeAngleError": [],
        "PodiumFootprints": [], "PodiumMasses": [], "PodiumOffset": 0.0, "PodiumArea": 0.0,
        "Floors": [], "Heights": [], "TotalBuildingHeights": [],
        "NumTowers": 0, "TowerTotalArea": 0.0, "PodiumGFA": 0.0, "TowerGFA": 0.0,
        "TotalGFA": 0.0, "ActualFAR": 0.0, "ActualBCR": 0.0,
        "FAR_Error": 0.0, "BCR_Error": 0.0,
        "TargetFAR": P.get("FAR"), "TargetBCR": P.get("BCR"), "UpperBCRUsed": 0.0,
        "TowerWidthUsed": 0.0, "ArmLengthRatioUsed": 0.0, "SeedUsed": P.get("seed"),
        "GrowStepsUsed": 0, "ShrinkIterations": 0, "ExpandIterations": 0, "BaseFloors": 0,
        "ActualHeightVariation": 0.0, "HeightVariationError": 0.0,
        "CourtyardCoverageUsed": None, "CourtyardRingWidthUsed": None,
        "HeightStats": {},
    }


# =====================================================================
# PART H-0 - AUTOMATIC TOOLTIPS FOR INPUTS / OUTPUTS
# =====================================================================
# Writes a Description on every input / output parameter of this
# component (matched by NickName, then Name). Runs on every solve, also
# when Run = False, and is a no-op outside Grasshopper. Unknown params
# are left untouched, so adding / renaming params never breaks anything.

_PER_SITE = " Per-site list: one value per site; the last value repeats."

INPUT_TOOLTIPS = {
    "siteCrv": "Site boundary curve(s), closed and planar (List Access). One curve = one site.",
    "centroids": "Tower seed points (Point3d). DataTree: one branch per site, or a flat list "
                 "shared by all sites. Points outside the buildable area are dropped. "
                 "Ignored when towerTypologyMode = 7 (Courtyard).",
    "FAR": "Target Floor Area Ratio (total GFA / site area). Default 3.0." + _PER_SITE,
    "BCR": "Target Building Coverage Ratio (footprint / site area). Default 0.5." + _PER_SITE,
    "setback": "Setback from the site boundary (m). Defines the buildable area. Default 5.0." + _PER_SITE,
    "podiumFloors": "Number of podium floors. Default 2." + _PER_SITE,
    "floorHeight": "Floor-to-floor height (m), used for podium and towers. Default 3.5." + _PER_SITE,
    "minWidth": "Tower plate width / module depth (m). Also the courtyard band width. Default 12." + _PER_SITE,
    "heightVariation": "Height variation between towers as a fraction of the base floor count "
                       "(0 = all equal, 0.5 = range of 50 %). Default 0." + _PER_SITE,
    "towerSizeMode": "Footprint size bias: 0 small, 1 medium, 2 large, 3 random. Default 1." + _PER_SITE,
    "seed": "Random seed (0-9999). Same seed = same result." + _PER_SITE,
    "podiumMinOffset": "Minimum podium offset around each tower (m). Default 2." + _PER_SITE,
    "podiumMaxOffset": "Maximum podium offset around each tower (m). Default 15. "
                       "Also capped at 0.35 x sqrt(site area)." + _PER_SITE,
    "globalRotationMode": "Tower rotation: 0 free (best fit), 1 uniform angle (uniformRotationDeg), "
                          "2/3 one random angle from {0,45,90,135,180} for all towers. Default 0." + _PER_SITE,
    "uniformRotationDeg": "Rotation (deg, 0-180) used when globalRotationMode = 1." + _PER_SITE,
    "minFootprintPerTower": "Minimum footprint per tower (sqm, >= 20). Default 80." + _PER_SITE,
    "maxFootprintPerTower": "Maximum footprint per tower (sqm, >= min + 30). Default 350." + _PER_SITE,
    "minTowerDistance": "Minimum clear distance between towers (m). Default 12." + _PER_SITE,
    "towerGrowStep": "Length increment per growth step when growing towers to the BCR target (m). "
                     "Default 1." + _PER_SITE,
    "towerGrowIterations": "Maximum growth iterations (also caps courtyard coverage search). "
                           "Default 80." + _PER_SITE,
    "maxLengthWidthRatio": "Maximum spine length / width ratio of a tower (>= 2). Default 4." + _PER_SITE,
    "towerBCRPriority": "Share of the BCR target reached by tower footprints before the podium "
                        "fills the rest (0-1). Default 0.65." + _PER_SITE,
    "upperBCR": "Hard upper BCR limit: the BCR cascade never exceeds it (site fails instead). "
                "Default BCR x 1.1 (min BCR x 1.05)." + _PER_SITE,
    "towerTypologyMode": "Tower shape: 0 I, 1 L, 2 T, 3 H, 4 C, 5 Plus, 6 random mix, 7 Courtyard "
                         "(perimeter blocks, centroids ignored). Default 0." + _PER_SITE,
    "armLengthRatio": "Arm length of L/T/H/C/Plus shapes as a multiple of minWidth (>= 0.3). "
                      "Auto-adapted +/-30 % to hit BCR. Default 1.3." + _PER_SITE,
    "courtyardCount": "[Courtyard] Number of zones the site is split into. Default 1." + _PER_SITE,
    "courtyardBreakCount": "[Courtyard] Number of breaks (gaps) in each perimeter ring. Default 4." + _PER_SITE,
    "courtyardBreakWidth": "[Courtyard] Width of each break (m). Default max(1.5 x minWidth, 4)." + _PER_SITE,
    "courtyardZoneGap": "[Courtyard] Gap between zones (m). Default max(minTowerDistance, minWidth)." + _PER_SITE,
    "courtyardSplitAngle": "[Courtyard] Rotation of the zone split lines (deg, -45 to 45). Default 0." + _PER_SITE,
    "courtyardBreakShift": "[Courtyard] Shift of the break positions along the ring (m). Default 0." + _PER_SITE,
    "courtyardLayoutMode": "[Courtyard] 0 = blocks anchored on corners, 1 = consecutive bands "
                           "from the ring start. Default 0." + _PER_SITE,
    "maxBuildingHeight": "Maximum total building height incl. podium (m). Default 100." + _PER_SITE,
    "minBuildingHeight": "Minimum total building height incl. podium (m). Default 3." + _PER_SITE,
    "heightRegulationMode": "0 off, 1 strict (hard cap at maxBuildingHeight, FAR may fall short), "
                            "2 flexible (excess softened by 70 %). Default 0." + _PER_SITE,
    "enforceHeightRegulation": "True = apply heightRegulationMode. Default False." + _PER_SITE,
    "moveToBoundary": "True = push towers outward from the site centroid toward the setback line." + _PER_SITE,
    "moveAllToSetback": "True = slide each tower perpendicular to its nearest setback edge." + _PER_SITE,
    "moveTowerToPodiumEdge": "True = slide each tower to the outer edge of its own podium." + _PER_SITE,
    "alignTowersToEdge": "True = rotate towers parallel to the nearest boundary edge." + _PER_SITE,
    "edgeAlignBothOrientations": "With alignTowersToEdge: also try the perpendicular orientation "
                                 "when the parallel one fails. Default True." + _PER_SITE,
    "Run": "Gate. True = solve. Per-site list allowed (False skips that site).",
}

OUTPUT_TOOLTIPS = {
    # --- geometry (DataTree, one branch per site) ---
    "TowerFootprints": "Tower footprint curves. Tree: {site}.",
    "TowerMasses": "Tower 3D masses (Brep), sitting on top of the podium. Tree: {site}.",
    "TowerCentroids": "Tower placement points after moves. Tree: {site}.",
    "PodiumFootprints": "Podium outline curves (clipped to the buildable area). Tree: {site}.",
    "PodiumMasses": "Podium 3D masses (Brep). Tree: {site}.",
    "UnionFootprint": "Alias of PodiumFootprints (total built footprint). Tree: {site}.",
    "SiteCurves": "Input site curve per site.",
    "BuildableSite": "Buildable area after setback, per site.",
    "siteOriginal": "Original site curves as received.",
    # --- per-tower data (Tree) ---
    "TowerAngles": "Tower rotation angles (deg). Tree: {site}.",
    "TowerLengths": "Tower spine lengths (m). Tree: {site}.",
    "TowerAreas": "Tower footprint areas (sqm). Tree: {site}.",
    "TowerTypologies": "Tower typology codes (0 I, 1 L, 2 T, 3 H, 4 C, 5 Plus, 7 Courtyard). Tree: {site}.",
    "TowerTypologyNames": "Tower typology names. Tree: {site}.",
    "Floors": "Tower floors above the podium. Tree: {site}.",
    "TowerFloors": "Alias of Floors.",
    "Heights": "Tower heights above the podium (m). Tree: {site}.",
    "TowerHeights": "Alias of Heights.",
    "TotalBuildingHeights": "Podium + tower height per building (m). Tree: {site}.",
    "TowerFloorCap": "Per-tower floor cap from the height regulation (empty when off). Tree: {site}.",
    # --- per-site scalars ---
    "SiteIndex": "Site index.",
    "SiteArea": "Site area (sqm).",
    "BuildableArea": "Buildable area after setback (sqm).",
    "NumTowers": "Number of towers / buildings generated.",
    "TowerTotalArea": "Sum of tower footprint areas (sqm).",
    "PodiumArea": "Total podium footprint area (sqm).",
    "PodiumOffset": "Podium offset used (m).",
    "ActualPodiumOffset": "Alias of PodiumOffset.",
    "PodiumGFA": "Podium GFA = podium area x podiumFloors (sqm).",
    "TowerGFA": "Tower GFA = sum(tower area x floors) (sqm).",
    "TotalGFA": "PodiumGFA + TowerGFA (sqm).",
    "ActualFAR": "Achieved FAR.",
    "ActualBCR": "Achieved BCR (podium footprint / site area).",
    "FAR_Error": "|ActualFAR - target FAR|.",
    "BCR_Error": "|ActualBCR - target BCR|.",
    "TargetFAR": "Target FAR used.",
    "TargetBCR": "Target BCR used.",
    "UpperBCRUsed": "Upper BCR limit used in calibration.",
    "UnionArea": "Area of the union footprint (sqm).",
    "UnionBCR": "UnionArea / site area.",
    "TowerCoverageRatio": "Tower footprint / site area.",
    "PodiumCoverageRatio": "Podium footprint / site area.",
    "TowerAreaPercentOfSite": "Tower footprint as % of site area.",
    "PodiumAreaPercentOfSite": "Podium footprint as % of site area.",
    "TowerCoverageRatioBuildable": "Tower footprint / buildable area.",
    "PodiumCoverageRatioBuildable": "Podium footprint / buildable area.",
    "AdditionalPodiumArea": "Podium area beyond the tower footprints (sqm).",
    "PodiumAreaExpansionRatio": "Podium area / tower footprint area.",
    "TowerToPodiumRatio": "Tower footprint area / podium area.",
    "AdditionalPodiumRatio": "Additional podium area / tower footprint area.",
    "AdditionalPodiumPercentOfSite": "Additional podium area as % of site area.",
    "PodiumEfficiency": "Tower footprint / podium area (%).",
    "PodiumThicknessAvg": "Average podium ring thickness = additional area / tower perimeter (m).",
    "TowerWidthUsed": "Tower width used (m).",
    "ArmLengthRatioUsed": "Arm length ratio after adaptation.",
    "SeedUsed": "Seed used.",
    "GrowStepsUsed": "Growth steps used (courtyard: coverage evaluations).",
    "ShrinkIterationsUsed": "BCR shrink iterations used.",
    "ExpandIterationsUsed": "BCR expand iterations used.",
    "CourtyardCoverageUsed": "[Courtyard] Ring coverage used (0.30-0.95), None otherwise.",
    "CourtyardRingWidthUsed": "[Courtyard] Band width used (m), None otherwise.",
    # --- heights ---
    "BaseFloors": "Base tower floor count before variation.",
    "TotalFloors": "Sum of tower floors.",
    "ActualHeightVariation": "Achieved height variation (floor range / base floors).",
    "HeightVariationError": "|ActualHeightVariation - heightVariation|.",
    "HeightVariationOutputs": "Readable summary of the height variation check.",
    "HeightBins": "Height histogram bin centres (m). Tree: {site}.",
    "HeightCounts": "Height histogram counts. Tree: {site}.",
    "HeightStats": "Dictionary of height statistics per site (min, max, mean, std, quartiles ...).",
    "HeightRegulationEnforced": "Whether the height regulation was enforced.",
    "HeightRegulationMode": "Height regulation mode used (0 off, 1 strict, 2 flexible).",
    "HeightViolationsCount": "Towers that violated the height limits before adjustment.",
    "HeightAdjustedCount": "Towers adjusted by the height regulation.",
    "HeightViolations": "Violation details per tower. Tree: {site}.",
    "HeightCapLimitedFAR": "True if the height cap prevented reaching the target FAR.",
    "TowerGFAShortfall": "Tower GFA missing because of the height cap (sqm).",
    "MaxAllowedHeight": "maxBuildingHeight input per site (m).",
    "MinAllowedHeight": "minBuildingHeight input per site (m).",
    # --- run info ---
    "Report": "Text log per site.",
    "Timings": "Per-stage solve time per site (ms).",
    "TowerEdgeAngleError": "Deviation (deg) of each tower spine from its governing boundary "
                           "edge (0 = parallel; with edgeAlignBothOrientations also 0 = "
                           "perpendicular; -1 = no edge). Tree: {site}.",
    "Success": "True if the site produced a fully constrained layout. False = failed "
               "(no fallback geometry; see Errors).",
    "Errors": "Error message per site (empty if OK).",
    "Ran": "True if at least one site was run.",
    "RunPerSite": "Run flag per site.",
    "Summary": "One-line summary of all sites.",
    "SchemeTag": "Scheme label per site: target vs actual FAR / BCR and signed error "
                 "(actual - target), 3 decimals. Ready for a Text Tag.",
    "out": "Console output (print log).",
}


def _apply_tooltips():
    comp = None
    try:
        env = globals().get("ghenv", None)
        comp = env.Component if env is not None else None
    except Exception:
        comp = None
    if comp is None:
        return 0

    def _apply(params, table):
        n = 0
        for p in params:
            try:
                tip = table.get(p.NickName) or table.get(p.Name)
                if tip and p.Description != tip:
                    p.Description = tip
                    n += 1
            except Exception:
                pass
        return n

    count = 0
    try:
        count += _apply(comp.Params.Input, INPUT_TOOLTIPS)
        count += _apply(comp.Params.Output, OUTPUT_TOOLTIPS)
    except Exception:
        pass
    return count


_tooltips_set = _apply_tooltips()


# ---- collect sites ----
_sites_raw = _SCOPE.get("siteCrv", None)
if _sites_raw is None:
    _sites_raw = _SCOPE.get("siteCrvs", None)
site_list = [s for s in _as_list(_sites_raw) if s is not None]
n_sites = len(site_list)


def _run_for(i):
    v = _pick("Run", i)
    return False if v is None else bool(v)


run_flags = [_run_for(i) for i in range(n_sites)]
RUN_ENABLED = any(run_flags)

print("=" * 70)
print("MULTI-SITE MASSING GENERATOR (PY3 PERF BUILD) - {} site(s) | Run = {} | numpy = {}".format(
    n_sites, RUN_ENABLED, HAS_NP))
print("=" * 70)

results = []
errors = []
_t_all = time.perf_counter()

if not RUN_ENABLED:
    print("Run is OFF - no geometry generated. Set the Run input to True to solve.")

for si in range(n_sites):
    P = {}
    for nm in PARAM_NAMES:
        P[nm] = _pick(nm, si)

    if not run_flags[si]:
        note = "SITE {} skipped (Run = False)".format(si)
        if RUN_ENABLED:
            print("\n" + "-" * 70)
            print(note)
        results.append(_empty_result(si, site_list[si], P, note))
        errors.append("")
        continue

    print("\n" + "-" * 70)
    print("SITE {}".format(si))
    print("-" * 70)

    try:
        res = solve_site(si, site_list[si], _centroids_for(si), P)
        errors.append("")
    except Exception as ex:
        msg = "SITE {} FAILED: {}".format(si, ex)
        print(msg)
        errors.append(str(ex))
        res = _empty_result(si, site_list[si], P, msg, False, str(ex))
    results.append(res)

_total_elapsed = time.perf_counter() - _t_all


def _col(key):
    return [r.get(key) for r in results]


def _branches(key):
    return [r.get(key) or [] for r in results]


# =====================================================================
# PART I - OUTPUTS (original names kept)
# =====================================================================
TowerFootprints = _tree(_branches("TowerFootprints"))
TowerMasses = _tree(_branches("TowerMasses"))
TowerCentroids = _tree(_branches("TowerCentroids"))
PodiumFootprints = _tree(_branches("PodiumFootprints"))
PodiumMasses = _tree(_branches("PodiumMasses"))
UnionFootprint = PodiumFootprints

TowerAngles = _tree(_branches("TowerAngles"))
TowerLengths = _tree(_branches("TowerLengths"))
TowerAreas = _tree(_branches("TowerAreas"))
TowerEdgeAngleError = _tree(_branches("TowerEdgeAngleError"))
TowerTypologies = _tree(_branches("TowerTypologies"))
TowerTypologyNames = _tree(_branches("TowerTypologyNames"))
Floors = _tree(_branches("Floors"))
Heights = _tree(_branches("Heights"))
TotalBuildingHeights = _tree(_branches("TotalBuildingHeights"))

SiteCurves = _col("SiteCurve")
BuildableSite = _col("BuildableSite")
siteOriginal = site_list

SiteIndex = _col("SiteIndex")
SiteArea = _col("SiteArea")
NumTowers = _col("NumTowers")
TowerTotalArea = _col("TowerTotalArea")
PodiumArea = _col("PodiumArea")
PodiumOffset = _col("PodiumOffset")
PodiumGFA = _col("PodiumGFA")
TowerGFA = _col("TowerGFA")
TotalGFA = _col("TotalGFA")
ActualFAR = _col("ActualFAR")
ActualBCR = _col("ActualBCR")
FAR_Error = _col("FAR_Error")
BCR_Error = _col("BCR_Error")
TargetFAR = _col("TargetFAR")
TargetBCR = _col("TargetBCR")
UpperBCRUsed = _col("UpperBCRUsed")
TowerWidthUsed = _col("TowerWidthUsed")
ArmLengthRatioUsed = _col("ArmLengthRatioUsed")
SeedUsed = _col("SeedUsed")
GrowStepsUsed = _col("GrowStepsUsed")
ShrinkIterationsUsed = _col("ShrinkIterations")
ExpandIterationsUsed = _col("ExpandIterations")
BaseFloors = _col("BaseFloors")
ActualHeightVariation = _col("ActualHeightVariation")
HeightVariationError = _col("HeightVariationError")
CourtyardCoverageUsed = _col("CourtyardCoverageUsed")
CourtyardRingWidthUsed = _col("CourtyardRingWidthUsed")

HeightStats = _col("HeightStats")
Report = _col("Report")
Success = _col("OK")
Errors = errors

# --- NEW OUTPUT: per-stage timing ---
Timings = _col("Timing")


# =====================================================================
# PART I-2 - DERIVED OUTPUTS
# =====================================================================
def _safe_div(a, b):
    return (a / b) if (b and abs(b) > 1e-9) else 0.0


def _sum_curve_area(curves):
    tot = 0.0
    for c in curves or []:
        if c is None:
            continue
        tot += _fast_area(c)
    return tot


def _sum_curve_length(curves):
    tot = 0.0
    for c in curves or []:
        try:
            tot += c.GetLength()
        except Exception:
            pass
    return tot


TowerFloors = Floors
TowerHeights = Heights
ActualPodiumOffset = PodiumOffset

UnionArea = [_sum_curve_area(r.get("PodiumFootprints")) for r in results]
UnionBCR = [_safe_div(UnionArea[i], SiteArea[i]) for i in range(n_sites)]

BuildableArea = [_sum_curve_area([r.get("BuildableSite")]) if r.get("BuildableSite") else 0.0
                 for r in results]

TowerCoverageRatio = [_safe_div(TowerTotalArea[i], SiteArea[i]) for i in range(n_sites)]
PodiumCoverageRatio = [_safe_div(PodiumArea[i], SiteArea[i]) for i in range(n_sites)]
TowerAreaPercentOfSite = [v * 100.0 for v in TowerCoverageRatio]
PodiumAreaPercentOfSite = [v * 100.0 for v in PodiumCoverageRatio]

# relative to the buildable area (after setback)
TowerCoverageRatioBuildable = [_safe_div(TowerTotalArea[i], BuildableArea[i]) for i in range(n_sites)]
PodiumCoverageRatioBuildable = [_safe_div(PodiumArea[i], BuildableArea[i]) for i in range(n_sites)]

AdditionalPodiumArea = [max(0.0, PodiumArea[i] - TowerTotalArea[i]) for i in range(n_sites)]
PodiumAreaExpansionRatio = [_safe_div(PodiumArea[i], TowerTotalArea[i]) for i in range(n_sites)]
TowerToPodiumRatio = [_safe_div(TowerTotalArea[i], PodiumArea[i]) for i in range(n_sites)]
AdditionalPodiumRatio = [_safe_div(AdditionalPodiumArea[i], TowerTotalArea[i]) for i in range(n_sites)]
AdditionalPodiumPercentOfSite = [_safe_div(AdditionalPodiumArea[i], SiteArea[i]) * 100.0
                                 for i in range(n_sites)]
PodiumEfficiency = [_safe_div(TowerTotalArea[i], PodiumArea[i]) * 100.0 for i in range(n_sites)]

PodiumThicknessAvg = [_safe_div(AdditionalPodiumArea[i],
                                _sum_curve_length(results[i].get("TowerFootprints")))
                      for i in range(n_sites)]


def _hs(key, default=0):
    return [(r.get("HeightStats") or {}).get(key, default) for r in results]


def _hs_tree(key):
    return _tree([(r.get("HeightStats") or {}).get(key, []) for r in results])


TotalFloors = _hs("TotalFloors", 0)
HeightBins = _hs_tree("HeightBins")
HeightCounts = _hs_tree("HeightCounts")
HeightViolations = _hs_tree("HeightViolations")
HeightRegulationEnforced = _hs("HeightRegulationEnforced", False)
HeightRegulationMode = _hs("HeightRegulationMode", 0)
HeightViolationsCount = _hs("HeightViolationsCount", 0)
HeightAdjustedCount = _hs("HeightAdjustedCount", 0)

# --- NEW OUTPUTS (optional, wire them if needed) ---
HeightCapLimitedFAR = _hs("FARLimitedByHeight", False)
TowerGFAShortfall = _hs("TowerGFAShortfall", 0.0)
TowerFloorCap = _hs_tree("TowerFloorCap")

MaxAllowedHeight = [_pick("maxBuildingHeight", i) for i in range(n_sites)]
MinAllowedHeight = [_pick("minBuildingHeight", i) for i in range(n_sites)]

HeightVariationOutputs = []
for i in range(n_sites):
    hs = results[i].get("HeightStats") or {}
    HeightVariationOutputs.append(
        "var_in={:.3f} | var_out={:.3f} | err={:.3f} | base={} fl | met={}".format(
            hs.get("InputHeightVariation", 0.0),
            ActualHeightVariation[i] or 0.0,
            HeightVariationError[i] or 0.0,
            BaseFloors[i] or 0,
            hs.get("VariationToleranceMet", False)))

Ran = RUN_ENABLED
RunPerSite = run_flags

_ok = [r for r in results if r.get("OK")]
if not RUN_ENABLED:
    Summary = "Run = False | {} site(s) loaded, nothing generated".format(n_sites)
else:
    Summary = ("Run = True | Sites: {} | Solved: {} | Skipped: {} | Failed: {} | "
               "Avg BCR: {:.4f} | Avg FAR: {:.4f} | Total buildings: {} | "
               "Elapsed: {:.2f}s").format(
        n_sites, len(_ok), run_flags.count(False),
        n_sites - len(_ok) - run_flags.count(False),
        (sum(r["ActualBCR"] for r in _ok) / len(_ok)) if _ok else 0.0,
        (sum(r["ActualFAR"] for r in _ok) / len(_ok)) if _ok else 0.0,
        sum(r["NumTowers"] for r in results),
        _total_elapsed)

print("\n" + "=" * 70)
print(Summary)
print("=" * 70)


# =====================================================================
# PART I-3 - SCHEME TAG (display only)
# =====================================================================
# One text block per site, e.g.
#   SITE 0 | seed 12
#   FAR  target 3.000 | actual 2.987 | err -0.013
#   BCR  target 0.500 | actual 0.512 | err +0.012
# err = actual - target (negative = below target).

def _f3(v):
    try:
        return "{:.3f}".format(float(v))
    except Exception:
        return "-"


def _e3(actual, target):
    try:
        return "{:+.3f}".format(float(actual) - float(target))
    except Exception:
        return "-"


SchemeTag = []
for i, r in enumerate(results):
    head = "SITE {} | seed {}".format(i, r.get("SeedUsed"))
    t_far = r.get("TargetFAR")
    t_bcr = r.get("TargetBCR")
    if not r.get("OK"):
        state = "skipped" if not run_flags[i] else "failed"
        SchemeTag.append("{} | {}\nFAR  target {}\nBCR  target {}".format(
            head, state, _f3(t_far), _f3(t_bcr)))
        continue
    a_far = r.get("ActualFAR")
    a_bcr = r.get("ActualBCR")
    SchemeTag.append(
        "{}\nFAR  target {} | actual {} | err {}\nBCR  target {} | actual {} | err {}".format(
            head,
            _f3(t_far), _f3(a_far), _e3(a_far, t_far),
            _f3(t_bcr), _f3(a_bcr), _e3(a_bcr, t_bcr)))
# ---------- end urbgen_massing_generator ----------
panel = Panel(urbgen_massing_generator.ActualBCR)
panel_2 = Panel(urbgen_massing_generator.SchemeTag)
palette = ValueList({"ladybug", "thermal", "turbo", "rdylbu", "spectral", "coolwarm", "rdbu", "viridis", "magma", "inferno"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}, selected="ladybug")
number_slider_2 = Slider(7, range=0..10)
urbgen_palette = Python3Script(paletteName=palette)  # -> out, palette, paletteNames, palettePreview; inputs colorCount: Int32, previewPoint: Point3d, reverse: Boolean
# ---------- urbgen_palette: Python ----------
"""UrbGEN Palette: modern colour palettes for UrbGEN height colouring / heatmaps
Runs in GhPython (IronPython 2.7, Rhino 7) and Python 3 (Rhino 8).

Outputs a list of colours for the 'palette' input of urbgen_height_colors.py
(also works with any colour-list input, e.g. LB Legend Parameters _colors_).

Inputs (all optional):
    paletteName  : str / int - palette (default "viridis"). Leave it unconnected: a drop-down
                               list with all 70 palettes is created. Also accepts a name ("_r" =
                               reversed) or an index 0-69 from a Number Slider
    reverse      : bool    - reverse the palette (default False)
    colorCount   : int     - number of output colours (default 11; resampled smoothly)
    previewPoint : Point3d - base point of the preview swatches (default origin)
Outputs:
    palette        : list of colours (low -> high)
    paletteNames   : all available palette names
    palettePreview : mesh with one coloured strip per palette (name order = paletteNames)
"""

# ---- tooltips (shown when hovering inputs / outputs in Grasshopper) ----------------------
COMPONENT_DESC = 'UrbGEN Palette: modern colour palettes for UrbGEN height colouring / heatmaps'
INPUT_TIPS = {'paletteName': 'palette (default "viridis"). Leave it unconnected: a drop-down list with all 70 '
                  'palettes is created. Also accepts a name ("_r" = reversed) or an index 0-69 '
                  'from a Number Slider [str / int]',
     'reverse': 'reverse the palette (default False) [bool]',
     'colorCount': 'number of output colours (default 11; resampled smoothly) [int]',
     'previewPoint': 'base point of the preview swatches (default origin) [Point3d]'}
OUTPUT_TIPS = {'palette': 'list of colours (low -> high)',
     'paletteNames': 'all available palette names',
     'palettePreview': 'mesh with one coloured strip per palette (name order = paletteNames)'}


def _apply_tooltips():
    try:
        comp = ghenv.Component
    except Exception:
        return                                        # not running inside Grasshopper
    try:
        if COMPONENT_DESC and comp.Description != COMPONENT_DESC:
            comp.Description = COMPONENT_DESC
        for params, tips in ((comp.Params.Input, INPUT_TIPS), (comp.Params.Output, OUTPUT_TIPS)):
            for p in params:
                tip = tips.get(p.NickName) or tips.get(p.Name)
                if tip and p.Description != tip:
                    p.Description = tip
    except Exception:
        pass


_apply_tooltips()
# ---------------------------------------------------------------------------------------
import Rhino.Geometry as rg
import System.Drawing as sd

# ---- colour palettes (low -> high). Add "_r" to a name to reverse it, e.g. "viridis_r".
# viridis/magma/inferno/plasma/cividis/turbo: matplotlib (CC0 / Apache 2.0);
# rdylbu/spectral/rdbu/ylorrd/blues: ColorBrewer (Apache 2.0, Cynthia Brewer);
# coolwarm: K. Moreland; ladybug: Ladybug Tools default; thermal, wind, dusk, delta: UrbGEN;
# puor/brbg/piyg/prgn: ColorBrewer; vlag/icefire: seaborn (BSD); berlin: F. Crameri (via
# matplotlib); bwr: matplotlib.
PALETTES = {
    'ladybug': [(75, 107, 169), (115, 147, 202), (170, 200, 247), (193, 213, 208), (245, 239, 103),
                (252, 230, 74), (239, 156, 21), (234, 123, 0), (234, 74, 0), (234, 38, 0)],
    'viridis': [(68, 1, 84), (72, 36, 117), (65, 68, 135), (53, 95, 141), (42, 120, 142), (33, 145, 140),
                (34, 168, 132), (68, 191, 112), (122, 209, 81), (189, 223, 38), (253, 231, 37)],
    'magma': [(0, 0, 4), (20, 14, 54), (59, 15, 112), (100, 26, 128), (140, 41, 129), (183, 55, 121),
              (222, 73, 104), (247, 112, 92), (254, 159, 109), (254, 207, 146), (252, 253, 191)],
    'inferno': [(0, 0, 4), (22, 11, 57), (66, 10, 104), (106, 23, 110), (147, 38, 103), (188, 55, 84),
                (221, 81, 58), (243, 120, 25), (252, 165, 10), (246, 215, 70), (252, 255, 164)],
    'plasma': [(13, 8, 135), (65, 4, 157), (106, 0, 168), (143, 13, 164), (177, 42, 144), (204, 71, 120),
               (225, 100, 98), (242, 132, 75), (252, 166, 54), (252, 206, 37), (240, 249, 33)],
    'cividis': [(0, 34, 78), (8, 51, 112), (53, 69, 108), (79, 87, 108), (102, 105, 112), (125, 124, 120),
                (148, 142, 119), (174, 163, 113), (200, 184, 102), (229, 207, 82), (254, 232, 56)],
    'turbo': [(48, 18, 59), (69, 89, 203), (62, 155, 254), (25, 213, 205), (70, 248, 132), (164, 252, 60),
              (225, 221, 55), (254, 164, 49), (240, 91, 18), (195, 37, 3), (122, 4, 3)],
    'rdylbu': [(49, 54, 149), (69, 116, 179), (116, 173, 209), (170, 216, 233), (224, 243, 248),
               (255, 254, 190), (254, 224, 144), (253, 173, 96), (244, 109, 67), (214, 47, 39), (165, 0, 38)],
    'spectral': [(94, 79, 162), (51, 135, 188), (102, 194, 165), (170, 220, 164), (230, 245, 152),
                 (255, 254, 190), (254, 224, 139), (253, 173, 96), (244, 109, 67), (212, 61, 79), (158, 1, 66)],
    'coolwarm': [(59, 76, 192), (89, 119, 227), (123, 159, 249), (158, 190, 255), (192, 212, 245),
                 (221, 220, 220), (242, 203, 183), (247, 172, 142), (238, 132, 104), (214, 82, 68), (180, 4, 38)],
    'rdbu': [(5, 48, 97), (32, 101, 171), (67, 147, 195), (144, 196, 221), (209, 229, 240), (247, 246, 246),
             (253, 219, 199), (243, 164, 129), (214, 96, 77), (177, 24, 43), (103, 0, 31)],
    'ylorrd': [(255, 255, 204), (255, 241, 169), (254, 225, 135), (254, 202, 102), (254, 171, 73),
               (253, 140, 60), (252, 91, 46), (237, 46, 33), (212, 16, 32), (176, 0, 38), (128, 0, 38)],
    'blues': [(247, 251, 255), (227, 238, 249), (208, 225, 242), (183, 212, 234), (148, 196, 223),
              (106, 174, 214), (74, 152, 201), (46, 126, 188), (23, 100, 171), (8, 74, 145), (8, 48, 107)],
    'thermal': [(23, 55, 94), (40, 98, 145), (72, 148, 170), (146, 197, 190), (232, 226, 196),
                (244, 190, 124), (229, 128, 77), (196, 64, 56), (128, 20, 46)],
    'wind': [(245, 250, 250), (200, 232, 230), (140, 205, 205), (70, 165, 180), (35, 120, 160),
             (30, 75, 130), (25, 40, 90)],
    'dusk': [(44, 30, 80), (92, 55, 125), (150, 70, 140), (205, 96, 120), (240, 140, 110),
             (250, 196, 132), (252, 240, 170)],
    # ---- diverging (for differences / comparisons around 0): negative = cool, positive = warm
    'delta': [(17, 72, 110), (39, 116, 156), (98, 166, 190), (170, 210, 220), (232, 242, 244),
              (250, 248, 245), (250, 224, 210), (240, 170, 140), (214, 106, 82), (168, 50, 48),
              (110, 18, 34)],
    'vlag': [(35, 105, 189), (91, 132, 189), (135, 160, 196), (175, 188, 209), (217, 220, 229),
             (250, 245, 244), (236, 211, 210), (219, 171, 168), (204, 133, 130), (187, 94, 93),
             (169, 55, 59)],
    'puor': [(45, 0, 75), (83, 38, 135), (128, 115, 172), (177, 170, 209), (216, 218, 235),
             (247, 247, 246), (254, 224, 182), (252, 183, 97), (224, 130, 20), (178, 87, 6),
             (127, 59, 8)],
    'brbg': [(0, 60, 48), (1, 101, 93), (53, 151, 143), (127, 204, 192), (199, 234, 229),
             (245, 245, 244), (246, 232, 195), (222, 193, 123), (191, 129, 45), (139, 80, 10),
             (84, 48, 5)],
    'piyg': [(142, 1, 82), (196, 26, 124), (222, 119, 174), (241, 181, 217), (253, 224, 239),
             (247, 247, 246), (230, 245, 208), (183, 224, 133), (127, 188, 65), (76, 145, 33),
             (39, 100, 25)],
    'prgn': [(64, 0, 75), (117, 41, 130), (153, 112, 171), (193, 164, 206), (231, 212, 232),
             (246, 247, 246), (217, 240, 211), (165, 218, 159), (90, 174, 97), (26, 119, 54),
             (0, 68, 27)],
    'icefire': [(189, 231, 219), (117, 184, 206), (56, 133, 208), (74, 79, 165), (48, 46, 74),
                (31, 30, 30), (74, 37, 46), (147, 46, 68), (211, 73, 54), (241, 143, 81),
                (255, 212, 172)],
    'berlin': [(158, 176, 255), (98, 166, 224), (50, 128, 166), (32, 82, 106), (17, 39, 50),
               (25, 12, 9), (55, 16, 0), (97, 32, 11), (150, 74, 54), (202, 123, 113),
               (255, 173, 173)],
    'bwr': [(0, 0, 255), (50, 50, 255), (102, 102, 255), (152, 152, 255), (204, 204, 255),
            (255, 254, 254), (255, 204, 204), (255, 152, 152), (255, 102, 102), (255, 50, 50),
            (255, 0, 0)],
    # ---- UrbGEN originals
    'urban_heat': [(52, 73, 94), (84, 110, 122), (130, 150, 150), (190, 190, 170), (235, 215, 170),
                   (240, 180, 120), (225, 130, 80), (190, 80, 60), (130, 40, 45)],
    'sunrise': [(25, 35, 80), (70, 55, 130), (150, 70, 150), (220, 90, 120), (250, 135, 90),
                (252, 190, 90), (252, 240, 160)],
    'ocean': [(8, 29, 58), (16, 62, 104), (23, 104, 140), (30, 145, 160), (80, 185, 175),
              (160, 220, 200), (230, 248, 240)],
    'forest': [(20, 40, 25), (35, 75, 40), (60, 110, 55), (100, 145, 70), (150, 180, 95),
               (205, 215, 140), (245, 245, 200)],
    'aurora': [(20, 20, 50), (40, 60, 120), (30, 130, 150), (60, 190, 140), (170, 225, 110),
               (245, 240, 140)],
    'neon': [(15, 10, 40), (80, 20, 140), (190, 30, 170), (255, 70, 120), (255, 150, 60),
             (255, 230, 80)],
    'heat_grey': [(225, 225, 225), (200, 200, 200), (170, 170, 170), (200, 150, 130),
                  (225, 110, 80), (200, 50, 40), (140, 20, 30)],
    'utci': [(0, 32, 96), (0, 64, 160), (0, 112, 224), (64, 160, 255), (160, 208, 255),
             (102, 189, 99), (254, 224, 139), (253, 174, 97), (244, 109, 67), (215, 48, 39),
             (140, 10, 30)],
    # ---- more perceptual / sequential / diverging (seaborn BSD, cmocean MIT, ColorBrewer
    #      Apache 2.0, matplotlib)
    'rocket': [(3, 5, 26), (37, 20, 51), (76, 29, 75), (117, 31, 88), (161, 26, 91), (203, 27, 79),
               (232, 63, 63), (243, 113, 77), (246, 156, 115), (247, 198, 166), (250, 235, 221)],
    'mako': [(11, 4, 5), (37, 23, 41), (56, 42, 84), (65, 63, 128), (57, 93, 156), (53, 123, 163),
             (52, 151, 169), (62, 180, 173), (96, 206, 172), (169, 225, 189), (222, 245, 229)],
    'flare': [(75, 35, 98), (98, 41, 106), (122, 46, 112), (146, 51, 113), (170, 58, 110),
              (194, 65, 103), (214, 79, 95), (226, 101, 92), (231, 126, 99), (235, 152, 114),
              (237, 176, 129)],
    'crest': [(44, 49, 114), (40, 67, 123), (33, 85, 132), (28, 102, 137), (36, 118, 139),
              (52, 133, 141), (68, 148, 143), (87, 164, 144), (109, 178, 144), (137, 191, 145),
              (165, 205, 144)],
    'cmo_thermal': [(4, 35, 51), (15, 50, 106), (64, 52, 159), (103, 67, 150), (139, 83, 141),
                    (177, 95, 130), (214, 108, 108), (243, 130, 77), (252, 166, 60),
                    (247, 208, 69), (232, 250, 91)],
    'cmo_solar': [(51, 20, 24), (82, 30, 34), (115, 39, 36), (143, 52, 31), (165, 74, 23),
                  (182, 100, 19), (196, 127, 21), (207, 156, 29), (216, 186, 42), (222, 219, 58),
                  (225, 253, 75)],
    'cmo_matter': [(47, 15, 62), (79, 22, 82), (114, 26, 96), (147, 32, 99), (179, 46, 95),
                   (207, 68, 86), (226, 98, 83), (238, 133, 94), (245, 167, 115), (250, 202, 144),
                   (254, 237, 176)],
    'cmo_amp': [(241, 237, 236), (229, 207, 201), (220, 177, 163), (211, 149, 127), (202, 119, 91),
                (192, 88, 59), (179, 56, 38), (157, 25, 38), (127, 14, 41), (92, 14, 33),
                (60, 9, 18)],
    'cmo_haline': [(42, 24, 108), (41, 39, 162), (13, 78, 150), (24, 102, 140), (45, 124, 137),
                   (60, 147, 135), (74, 170, 129), (101, 193, 114), (148, 211, 93),
                   (208, 224, 109), (253, 239, 154)],
    'cmo_ice': [(4, 6, 19), (27, 27, 55), (48, 47, 95), (61, 67, 137), (62, 94, 169),
                (66, 123, 183), (82, 150, 193), (107, 177, 203), (140, 203, 214), (188, 228, 231),
                (234, 253, 253)],
    'cmo_deep': [(40, 26, 44), (56, 45, 81), (65, 64, 123), (62, 90, 146), (64, 117, 152),
                 (72, 143, 158), (82, 168, 163), (102, 194, 164), (146, 216, 164), (202, 235, 178),
                 (253, 254, 204)],
    'cmo_dense': [(230, 241, 241), (188, 220, 229), (150, 197, 226), (123, 173, 228),
                  (115, 144, 227), (120, 113, 213), (121, 84, 187), (116, 58, 152), (104, 36, 113),
                  (83, 21, 70), (54, 14, 36)],
    'cmo_speed': [(255, 253, 205), (238, 223, 152), (216, 197, 95), (184, 178, 47), (142, 162, 11),
                  (95, 146, 12), (50, 128, 31), (15, 107, 43), (16, 84, 44), (25, 59, 35),
                  (23, 35, 19)],
    'cmo_tempo': [(255, 246, 244), (220, 223, 208), (182, 203, 175), (141, 185, 151),
                  (93, 167, 134), (42, 147, 127), (17, 125, 121), (24, 101, 110), (28, 77, 97),
                  (26, 54, 81), (21, 29, 68)],
    'cmo_algae': [(215, 249, 208), (184, 227, 172), (150, 205, 138), (114, 187, 108),
                  (68, 168, 85), (18, 148, 80), (9, 125, 75), (21, 102, 65), (26, 80, 52),
                  (24, 58, 37), (18, 36, 20)],
    'cmo_rain': [(238, 237, 243), (222, 211, 201), (203, 186, 152), (161, 172, 130),
                 (115, 157, 117), (61, 142, 110), (12, 123, 110), (8, 99, 107), (30, 75, 95),
                 (37, 51, 75), (34, 27, 56)],
    'cmo_turbid': [(233, 246, 171), (219, 217, 135), (207, 188, 102), (196, 161, 77),
                   (181, 135, 64), (161, 112, 59), (138, 94, 58), (112, 77, 55), (86, 62, 48),
                   (59, 47, 39), (34, 31, 27)],
    'cmo_balance': [(24, 28, 67), (41, 62, 151), (22, 112, 188), (89, 156, 187), (170, 194, 203),
                    (241, 236, 235), (220, 178, 164), (202, 118, 91), (179, 56, 38), (126, 14, 41),
                    (60, 9, 18)],
    'cmo_curl': [(21, 29, 68), (28, 77, 96), (17, 125, 121), (92, 167, 134), (182, 203, 176),
                 (253, 245, 244), (230, 184, 162), (211, 118, 105), (174, 64, 96), (117, 25, 93),
                 (52, 13, 53)],
    'cmo_diff': [(8, 35, 64), (33, 77, 106), (90, 116, 135), (141, 156, 167), (198, 202, 207),
                 (246, 241, 240), (206, 199, 184), (161, 150, 121), (122, 109, 65), (75, 71, 28),
                 (28, 34, 7)],
    'cmo_tarn': [(23, 35, 14), (60, 77, 13), (132, 106, 37), (203, 132, 72), (227, 191, 163),
                 (252, 247, 246), (203, 204, 170), (124, 164, 144), (46, 126, 126), (21, 79, 106),
                 (16, 30, 79)],
    'reds': [(255, 245, 240), (254, 229, 216), (253, 202, 181), (252, 171, 143), (252, 138, 106),
             (251, 105, 74), (241, 68, 50), (217, 37, 35), (188, 20, 26), (152, 12, 19),
             (103, 0, 13)],
    'oranges': [(255, 245, 235), (254, 233, 212), (253, 217, 180), (253, 195, 141), (253, 167, 98),
                (253, 140, 59), (243, 112, 27), (226, 85, 8), (197, 65, 2), (158, 51, 3),
                (127, 39, 4)],
    'greens': [(247, 252, 245), (233, 247, 229), (211, 238, 205), (184, 227, 178), (152, 213, 148),
               (115, 196, 118), (75, 176, 98), (47, 151, 78), (21, 127, 59), (0, 100, 40),
               (0, 68, 27)],
    'purples': [(252, 251, 253), (242, 240, 247), (226, 226, 239), (206, 207, 229),
                (182, 182, 216), (158, 154, 200), (134, 131, 189), (114, 98, 172), (97, 64, 155),
                (79, 31, 139), (63, 0, 125)],
    'greys': [(255, 255, 255), (243, 243, 243), (226, 226, 226), (206, 206, 206), (181, 181, 181),
              (149, 149, 149), (122, 122, 122), (95, 95, 95), (64, 64, 64), (29, 29, 29),
              (0, 0, 0)],
    'orrd': [(255, 247, 236), (254, 235, 208), (253, 220, 175), (253, 202, 148), (253, 178, 123),
             (252, 140, 89), (242, 109, 75), (224, 68, 47), (201, 29, 19), (168, 0, 0),
             (127, 0, 0)],
    'ylgnbu': [(255, 255, 217), (241, 250, 186), (214, 239, 179), (171, 222, 183), (115, 200, 189),
               (64, 181, 196), (36, 152, 193), (32, 114, 177), (35, 77, 160), (31, 47, 135),
               (8, 29, 88)],
    'ylgn': [(255, 255, 229), (249, 253, 194), (229, 245, 172), (200, 233, 155), (162, 216, 138),
             (119, 198, 121), (76, 176, 99), (47, 147, 77), (21, 121, 62), (0, 96, 52),
             (0, 69, 41)],
    'gnbu': [(247, 252, 240), (229, 245, 224), (212, 238, 206), (190, 230, 191), (159, 218, 184),
             (122, 204, 196), (87, 184, 208), (56, 155, 198), (29, 126, 183), (8, 95, 163),
             (8, 64, 129)],
    'pubugn': [(255, 247, 251), (240, 231, 242), (219, 216, 234), (192, 201, 226), (153, 185, 217),
               (102, 169, 207), (64, 149, 195), (22, 135, 159), (2, 121, 118), (1, 100, 81),
               (1, 70, 54)],
    'bupu': [(247, 252, 253), (229, 239, 246), (204, 221, 236), (178, 202, 225), (154, 180, 214),
             (140, 149, 198), (140, 116, 181), (138, 81, 165), (133, 45, 144), (118, 12, 113),
             (77, 0, 75)],
    'rdpu': [(255, 247, 243), (253, 229, 226), (252, 208, 204), (251, 182, 188), (249, 148, 177),
             (247, 103, 161), (226, 62, 153), (192, 21, 136), (153, 1, 123), (111, 1, 116),
             (73, 0, 106)],
    'cubehelix': [(0, 0, 0), (26, 20, 47), (22, 61, 78), (30, 101, 66), (84, 121, 47),
                  (161, 121, 74), (208, 126, 147), (207, 157, 219), (193, 202, 243),
                  (211, 238, 239), (255, 255, 255)],
    'managua': [(255, 207, 103), (224, 159, 87), (193, 116, 73), (160, 81, 62), (119, 51, 57),
                (87, 41, 73), (76, 61, 115), (81, 99, 162), (95, 137, 195), (111, 182, 226),
                (129, 231, 255)],
    'vanimo': [(255, 205, 253), (216, 137, 202), (173, 83, 154), (116, 46, 100), (51, 23, 44),
               (26, 21, 19), (35, 44, 20), (65, 90, 31), (98, 135, 47), (138, 188, 83),
               (190, 253, 165)],
    'rdgy': [(26, 26, 26), (76, 76, 76), (135, 135, 135), (185, 185, 185), (224, 224, 224),
             (255, 254, 254), (253, 219, 199), (243, 164, 129), (214, 96, 77), (177, 24, 43),
             (103, 0, 31)],
}


def get_palette(name):
    """palette name (optionally with '_r') -> list of (r, g, b); None if unknown"""
    key = str(name or '').strip().lower().replace(' ', '').replace('-', '')
    rev = key.endswith('_r')
    if rev:
        key = key[:-2]
    pal = PALETTES.get(key)
    if pal is None:
        return None
    return list(reversed(pal)) if rev else list(pal)


PALETTE_ORDER = ['ladybug', 'thermal', 'turbo', 'rdylbu', 'spectral', 'coolwarm', 'rdbu',
                 'viridis', 'magma', 'inferno', 'plasma', 'cividis', 'ylorrd', 'dusk',
                 'wind', 'blues',
                 # diverging, index 16-24
                 'delta', 'vlag', 'puor', 'brbg', 'piyg', 'prgn', 'icefire', 'berlin', 'bwr',
                 # UrbGEN originals, index 25-32
                 'urban_heat', 'sunrise', 'ocean', 'forest', 'aurora', 'neon', 'heat_grey', 'utci',
                 # perceptual, index 33-36
                 'rocket', 'mako', 'flare', 'crest',
                 # cmocean, index 37-53
                 'cmo_thermal', 'cmo_solar', 'cmo_matter', 'cmo_amp', 'cmo_haline', 'cmo_ice',
                 'cmo_deep', 'cmo_dense', 'cmo_speed', 'cmo_tempo', 'cmo_algae', 'cmo_rain',
                 'cmo_turbid', 'cmo_balance', 'cmo_curl', 'cmo_diff', 'cmo_tarn',
                 # ColorBrewer sequential, index 54-65
                 'reds', 'oranges', 'greens', 'purples', 'greys', 'orrd', 'ylgnbu', 'ylgn', 'gnbu',
                 'pubugn', 'bupu', 'rdpu',
                 # other, index 66-69
                 'cubehelix', 'managua', 'vanimo', 'rdgy']
DIVERGING = set(['delta', 'vlag', 'puor', 'brbg', 'piyg', 'prgn', 'icefire', 'berlin', 'bwr',
                 'rdbu', 'coolwarm', 'rdylbu', 'spectral', 'cmo_balance', 'cmo_curl',
                 'cmo_diff', 'cmo_tarn', 'managua', 'vanimo', 'rdgy'])


def palette_from_input(v, default):
    """accepts a name ("viridis", "viridis_r") or an index (0, 1, ... from a slider)"""
    if v is None or str(v).strip() == '':
        return default
    try:
        i = int(float(v))
        return PALETTE_ORDER[i % len(PALETTE_ORDER)]
    except (ValueError, TypeError):
        return str(v)


def auto_value_list(input_name, items, width=150):
    """If the input is not connected, drop a Value List (drop-down) with the given items
    next to it and wire it up - so options are picked from a menu instead of typed."""
    try:
        import System
        import Grasshopper as gh
        comp = ghenv.Component
    except Exception:
        return                                          # not running inside Grasshopper
    param = None
    for p in comp.Params.Input:
        if p.NickName == input_name or p.Name == input_name:
            param = p
    if param is None or param.SourceCount > 0:
        return
    doc = comp.OnPingDocument()
    if doc is None:
        return

    def make(d):
        if param.SourceCount > 0:
            return
        vl = gh.Kernel.Special.GH_ValueList()
        vl.CreateAttributes()
        vl.ListItems.Clear()
        for it in items:
            vl.ListItems.Add(gh.Kernel.Special.GH_ValueListItem(it, '"%s"' % it))
        vl.ListMode = gh.Kernel.Special.GH_ValueListMode.DropDown
        vl.NickName = input_name.strip('_')
        grip = param.Attributes.InputGrip
        vl.Attributes.Pivot = System.Drawing.PointF(grip.X - width - 30, grip.Y - 11)
        d.AddObject(vl, False)
        param.AddSource(vl)
        param.ExpireSolution(False)

    doc.ScheduleSolution(5, gh.Kernel.GH_Document.GH_ScheduleDelegate(make))


def opt(name, default=None):
    v = globals().get(name, default)
    return default if v is None or v == [] else v


def resample(pal, n):
    out = []
    for s in range(n):
        t = s / float(max(n - 1, 1)) * (len(pal) - 1)
        i = min(int(t), len(pal) - 2)
        f = t - i
        a, b = pal[i], pal[i + 1]
        out.append(sd.Color.FromArgb(int(round(a[0] + (b[0] - a[0]) * f)),
                                     int(round(a[1] + (b[1] - a[1]) * f)),
                                     int(round(a[2] + (b[2] - a[2]) * f))))
    return out


auto_value_list('paletteName', PALETTE_ORDER)
name = palette_from_input(opt('paletteName', None), 'viridis')
n = max(2, int(opt('colorCount', 11)))
o = opt('previewPoint', rg.Point3d(0, 0, 0))
pal = get_palette(name)
if pal is None:
    raise ValueError('Unknown palette "%s". Use one of: %s (add "_r" to reverse).'
                     % (name, ', '.join(sorted(PALETTES))))
if bool(opt('reverse', False)):
    pal = list(reversed(pal))
palette = resample(pal, n)
paletteNames = list(PALETTE_ORDER)

# preview: one horizontal strip per palette, 10 x 1 units, 0.4 gap
palettePreview = rg.Mesh()
steps = 32
for r, nm in enumerate(paletteNames):  # strip r = slider index r
    cs = resample(PALETTES[nm], steps + 1)
    y0 = o.Y - r * 1.4
    for s in range(steps):
        a = palettePreview.Vertices.Count
        x0, x1 = o.X + 10.0 * s / steps, o.X + 10.0 * (s + 1) / steps
        for (x, y), c in (((x0, y0), cs[s]), ((x1, y0), cs[s + 1]),
                          ((x1, y0 + 1), cs[s + 1]), ((x0, y0 + 1), cs[s])):
            palettePreview.Vertices.Add(x, y, o.Z)
            palettePreview.VertexColors.Add(c)
        palettePreview.Faces.AddFace(a, a + 1, a + 2, a + 3)
palettePreview.Normals.ComputeNormals()
print('%s -> %d colours' % (name, n))
# ---------- end urbgen_palette ----------
urbgen_scheme_tag_viewer = Python3Script(
    Tags=urbgen_massing_generator.SchemeTag,
    Sites=curve_13,
    Corner=Slider(3, range=0..10),
    TextSize=Slider(13, range=0..100),
    BCRTol=Slider(0.05, range=0..0.1))  # -> out, Anchors, Status, Info; inputs Tags: list of String, Sites: list of Curve, Show: Boolean, Corner: Int32, Offset: Double, TextSize: Int32, FARTol: Double, BCRTol: Double, Bake: Boolean, BakeHeight: Double
# ---------- urbgen_scheme_tag_viewer: Python ----------
# =====================================================================
# SCHEME TAG VIEWER  -  Rhino 8 / GhPython 3 (also runs in GhPython 2)
# =====================================================================
# Draws the `SchemeTag` text of the massing generator directly in the
# Rhino viewports, pinned next to each site (scheme).
#
#  - Screen-space labels: fixed pixel size, readable at any zoom, always
#    on top of the geometry, dark box + monospace text.
#  - FAR / BCR lines are colour-coded: green = |err| within tolerance,
#    red = outside tolerance, grey = site skipped / failed.
#  - Follows the component preview: hide or disable the component and
#    the labels disappear. Deleting the component removes them too.
#  - Optional Bake: writes each tag into the Rhino document as a text
#    object on layer "SchemeTags" (user string "SchemeTag" attached).
#
# ---------------------------------------------------------------------
# INPUTS (create these on the script component)
# ---------------------------------------------------------------------
#  Tags       : str        LIST ACCESS  <- SchemeTag of the generator
#  Sites      : Curve      LIST ACCESS  <- SiteCurves (or BuildableSite)
#  Show       : bool       ITEM         default True
#  Corner     : int        ITEM         0 above top-left (default)
#                                       1 right of top-right
#                                       2 below bottom-left
#                                       3 centre of site
#  Offset     : float      ITEM         gap between site and label (model units), default 3
#  TextSize   : int        ITEM         label text size in pixels, default 13
#  FARTol     : float      ITEM         |FAR err| tolerance, default 0.05
#  BCRTol     : float      ITEM         |BCR err| tolerance, default 0.015
#  Bake       : bool       ITEM         connect a Button; bakes once per press
#  BakeHeight : float      ITEM         baked text height (model units), default 2
#
# OUTPUTS
#  Anchors : Point3d per tag (where each label is pinned)
#  Status  : "OK" / "FAR off" / "BCR off" / "FAR+BCR off" / "skipped" / "failed"
#  Info    : short log
# =====================================================================

import re
import System
import Rhino
import Rhino.Geometry as rg
import scriptcontext as sc

FONT = "Consolas"
COL_BOX = System.Drawing.Color.FromArgb(215, 30, 32, 36)
COL_EDGE = System.Drawing.Color.FromArgb(255, 90, 95, 105)
COL_HEAD = System.Drawing.Color.FromArgb(255, 235, 235, 235)
COL_OK = System.Drawing.Color.FromArgb(255, 95, 210, 130)
COL_BAD = System.Drawing.Color.FromArgb(255, 245, 100, 90)
COL_MUTED = System.Drawing.Color.FromArgb(255, 150, 150, 150)
COL_PIN = System.Drawing.Color.FromArgb(255, 245, 190, 60)

_ERR_RE = re.compile(r"err\s+([+-]?\d+(?:\.\d+)?)")


# ---------------------------------------------------------------------
# inputs with defaults
# ---------------------------------------------------------------------
def _g(name, default):
    v = globals().get(name, None)
    return default if v is None else v


def _as_list(v):
    if v is None:
        return []
    if isinstance(v, (list, tuple)):
        return list(v)
    if isinstance(v, str):
        return [v]
    try:
        return list(v)
    except Exception:
        return [v]


tags = [str(t) for t in _as_list(_g("Tags", None)) if t is not None]
sites = _as_list(_g("Sites", None))
show = bool(_g("Show", True))
corner = max(0, min(3, int(_g("Corner", 0))))
offset = float(_g("Offset", 3.0))
text_px = max(8, int(_g("TextSize", 13)))
far_tol = abs(float(_g("FARTol", 0.05)))
bcr_tol = abs(float(_g("BCRTol", 0.015)))
bake = bool(_g("Bake", False))
bake_h = max(0.01, float(_g("BakeHeight", 2.0)))

comp = ghenv.Component  # noqa: F821  (provided by Grasshopper)
KEY = "scheme_tag_viewer_" + str(comp.InstanceGuid)


# ---------------------------------------------------------------------
# tooltips (same idea as the generator)
# ---------------------------------------------------------------------
_TIPS_IN = {
    "Tags": "SchemeTag output of the massing generator (one text per site).",
    "Sites": "SiteCurves (or BuildableSite) of the generator, same order as Tags.",
    "Show": "Show labels in the Rhino viewports. Default True.",
    "Corner": "Label position: 0 above top-left, 1 right of top-right, 2 below bottom-left, 3 centre.",
    "Offset": "Gap between site and label in model units. Default 3.",
    "TextSize": "Label text size in screen pixels. Default 13.",
    "FARTol": "|FAR err| tolerance for green / red colouring. Default 0.05.",
    "BCRTol": "|BCR err| tolerance for green / red colouring. Default 0.015.",
    "Bake": "Connect a Button. Each press bakes the labels to layer 'SchemeTags'.",
    "BakeHeight": "Height of baked text in model units. Default 2.",
}
_TIPS_OUT = {
    "Anchors": "Point where each label is pinned.",
    "Status": "OK / FAR off / BCR off / FAR+BCR off / skipped / failed per site.",
    "Info": "Short log.",
}
for _ps, _tb in ((comp.Params.Input, _TIPS_IN), (comp.Params.Output, _TIPS_OUT)):
    for _p in _ps:
        try:
            _t = _tb.get(_p.NickName) or _tb.get(_p.Name)
            if _t and _p.Description != _t:
                _p.Description = _t
        except Exception:
            pass


# ---------------------------------------------------------------------
# parse tag -> coloured lines + status
# ---------------------------------------------------------------------
def classify(tag):
    lines = tag.splitlines() or [tag]
    head = lines[0]
    low = head.lower()
    if "skipped" in low or "failed" in low:
        st = "failed" if "failed" in low else "skipped"
        return [(head, COL_HEAD)] + [(l, COL_MUTED) for l in lines[1:]], st

    out = [(head, COL_HEAD)]
    bad = []
    for l in lines[1:]:
        key = l.strip()[:3].upper()
        m = _ERR_RE.search(l)
        tol = far_tol if key == "FAR" else bcr_tol if key == "BCR" else None
        if m and tol is not None:
            ok = abs(float(m.group(1))) <= tol + 1e-12
            if not ok:
                bad.append(key)
            out.append((l, COL_OK if ok else COL_BAD))
        else:
            out.append((l, COL_HEAD))
    return out, ("OK" if not bad else "+".join(bad) + " off")


def anchor_for(curve, idx):
    bb = None
    try:
        bb = curve.GetBoundingBox(True) if curve is not None else None
    except Exception:
        bb = None
    if bb is None or not bb.IsValid:
        # no site: lay labels out in a row from the origin
        return rg.Point3d(idx * 60.0, 0, 0)
    if corner == 0:
        return rg.Point3d(bb.Min.X, bb.Max.Y + offset, bb.Max.Z)
    if corner == 1:
        return rg.Point3d(bb.Max.X + offset, bb.Max.Y, bb.Max.Z)
    if corner == 2:
        return rg.Point3d(bb.Min.X, bb.Min.Y - offset, bb.Max.Z)
    return bb.Center


items = []
Anchors = []
Status = []
for i, t in enumerate(tags):
    site = sites[i] if i < len(sites) else None
    lines, st = classify(t)
    a = anchor_for(site, i)
    items.append({"anchor": a, "lines": lines, "text": t})
    Anchors.append(a)
    Status.append(st)


# ---------------------------------------------------------------------
# viewport drawing (DrawForeground event, no .NET subclassing needed)
# ---------------------------------------------------------------------
def _make_handler(draw_items, px, place):
    pad = max(4, px // 2)
    line_h = int(round(px * 1.4))

    def _measure(disp, text):
        try:
            r = disp.Measure2dText(text, rg.Point2d(0, 0), False, 0.0, px, FONT)
            return r.Width, r.X, r.Y
        except Exception:
            return int(len(text) * px * 0.6), 0, -px

    def handler(sender, e):
        try:
            if comp.Hidden or comp.Locked:
                return
            doc = comp.OnPingDocument()
            if doc is None or not doc.Enabled:
                return
            disp = e.Display
            vp = e.Viewport
            for it in draw_items:
                p = vp.WorldToClient(it["anchor"])
                lines = it["lines"]
                meas = [_measure(disp, l) for l, _c in lines]
                w = int(max(m[0] for m in meas)) + 2 * pad
                h = line_h * len(lines) + 2 * pad
                x = int(p.X)
                y = int(p.Y)
                if place == 0:      # box sits above the pin
                    y -= h
                elif place == 3:    # centred on the pin
                    x -= w // 2
                    y -= h // 2
                try:
                    disp.Draw2dRectangle(System.Drawing.Rectangle(x, y, w, h), COL_EDGE, 1, COL_BOX)
                except Exception:
                    pass
                for k, (l, c) in enumerate(lines):
                    _w, ox, oy = meas[k]
                    top = y + pad + k * line_h + (line_h - px) // 2
                    disp.Draw2dText(l, c, rg.Point2d(x + pad - ox, top - oy), False, px, FONT)
                try:
                    disp.DrawPoint(it["anchor"], Rhino.Display.PointStyle.RoundSimple, 4, COL_PIN)
                except Exception:
                    pass
        except Exception:
            pass

    return handler


def _remove_handler():
    old = sc.sticky.pop(KEY, None)
    if old is not None:
        try:
            Rhino.Display.DisplayPipeline.DrawForeground -= old
        except Exception:
            pass


def _on_deleted(sender, e):
    try:
        for o in e.Objects:
            if o.InstanceGuid == comp.InstanceGuid:
                _remove_handler()
                Rhino.RhinoDoc.ActiveDoc.Views.Redraw()
    except Exception:
        pass


# subscribe once to component deletion
if not sc.sticky.get(KEY + "_deletehook", False):
    try:
        comp.OnPingDocument().ObjectsDeleted += _on_deleted
        sc.sticky[KEY + "_deletehook"] = True
    except Exception:
        pass

_remove_handler()
if show and items:
    h = _make_handler(items, text_px, corner)
    Rhino.Display.DisplayPipeline.DrawForeground += h
    sc.sticky[KEY] = h


# ---------------------------------------------------------------------
# bake (once per button press)
# ---------------------------------------------------------------------
baked = 0
prev = sc.sticky.get(KEY + "_bake", False)
if bake and not prev and items:
    rdoc = Rhino.RhinoDoc.ActiveDoc
    li = rdoc.Layers.FindByFullPath("SchemeTags", -1)
    if li < 0:
        li = rdoc.Layers.Add("SchemeTags", System.Drawing.Color.FromArgb(245, 190, 60))
    for i, it in enumerate(items):
        attr = Rhino.DocObjects.ObjectAttributes()
        attr.LayerIndex = li
        attr.SetUserString("SchemeTag", it["text"])
        attr.SetUserString("SiteIndex", str(i))
        attr.SetUserString("Status", Status[i])
        attr.Name = it["text"].splitlines()[0]
        a = it["anchor"]
        # text grows down from its insertion point -> lift it for corner 0
        n = len(it["lines"])
        base = rg.Point3d(a.X, a.Y + (bake_h * 1.6 * n if corner == 0 else 0.0), a.Z)
        gid = System.Guid.Empty
        try:
            te = rg.TextEntity.Create(it["text"], rg.Plane(base, rg.Vector3d.ZAxis),
                                      rdoc.DimStyles.Current, False, 0, 0)
            te.TextHeight = bake_h
            gid = rdoc.Objects.AddText(te, attr)
        except Exception:
            gid = System.Guid.Empty
        if gid == System.Guid.Empty:
            try:
                gid = rdoc.Objects.AddTextDot(rg.TextDot(it["text"], a), attr)
            except Exception:
                pass
        if gid != System.Guid.Empty:
            baked += 1
sc.sticky[KEY + "_bake"] = bake

try:
    Rhino.RhinoDoc.ActiveDoc.Views.Redraw()
except Exception:
    pass

Info = "{} tag(s) | show={} | corner={} | ok {} / {}{}".format(
    len(items), show, corner, Status.count("OK"), len(Status),
    " | baked {}".format(baked) if baked else "")
# ---------- end urbgen_scheme_tag_viewer ----------
urbgen_height_colors = Python3Script(buildings=[urbgen_massing_generator.TowerMasses, urbgen_massing_generator.PodiumMasses], palette=urbgen_palette.palette)  # -> out, buildingGeo, buildingColors, buildingHeights, buildingMesh, legendMesh, legendCurves, legendText, labelPlanes, labelText; inputs buildings: list of GeometryBase, palette: list of Color, minHeight: Double, maxHeight: Double, colorMode: Int32, classCount: Int32, tickCount: Int32, legendPlane: Plane, legendHeight: Double, legendTitle: String
# ---------- urbgen_height_colors: Python ----------
"""UrbGEN Height Colors: colour UrbGEN buildings by height + height legend
Runs in GhPython (IronPython 2.7, Rhino 7) and Python 3 (Rhino 8).

Tooltips for all inputs / outputs and LIST ACCESS for buildings + palette are set
automatically when the component runs (flatten buildings if it comes as a tree).

Inputs:
    buildings     : Brep / Extrusion / Mesh - building massing from UrbGEN
    palette       : list of Color   - from UrbGEN Palette 'palette' (low -> high)
    minHeight     : float - lower limit of the height domain (default: lowest building)
    maxHeight     : float - upper limit of the height domain (default: tallest building)
    colorMode     : int   - 0 = one colour per building (default), 1 = vertical gradient along Z
    classCount    : int   - 0 = smooth (default), >0 = number of discrete height classes
    tickCount     : int   - number of legend labels when smooth (default 6)
    legendPlane   : Plane - legend base plane, X = width, Y = up
                            (default: vertical plane right of the site, bottom at ground)
    legendHeight  : float - legend height (default: maxHeight - minHeight -> true scale)
    legendTitle   : str   - legend title (default "Height (m)")
Outputs:
    buildingGeo     : input buildings (flattened, same order as buildingColors)
    buildingColors  : one colour per building -> Custom Preview 'Material'
    buildingHeights : building heights
    buildingMesh    : vertex-coloured building meshes (preview directly)
    legendMesh      : vertex-coloured legend bar
    legendCurves    : legend frame + tick lines
    legendText      : legend labels + title as curves
    labelPlanes     : label planes  -> Text Tag 3D 'Location'
    labelText       : label strings -> Text Tag 3D 'Text'
"""

# ---- tooltips ------------------------------------------------------------------------------
COMPONENT_DESC = 'UrbGEN Height Colors: colour UrbGEN buildings by height + height legend'
INPUT_TIPS = {
    'buildings': 'building massing from UrbGEN (Brep / Extrusion / Mesh); flatten trees [list]',
    'palette': 'colours from UrbGEN Palette output "palette" (low -> high) [list of Color]',
    'minHeight': 'lower limit of height domain (default: lowest building) [float]',
    'maxHeight': 'upper limit of height domain (default: tallest building) [float]',
    'colorMode': '0 = one colour per building, 1 = vertical gradient along Z [int]',
    'classCount': '0 = smooth, >0 = number of discrete height classes [int]',
    'tickCount': 'number of legend labels when smooth (default 6) [int]',
    'legendPlane': 'legend plane, X = width, Y = up (default: vertical plane right of site) [Plane]',
    'legendHeight': 'legend height (default: maxHeight - minHeight, true scale) [float]',
    'legendTitle': 'legend title (default "Height (m)") [str]'}
OUTPUT_TIPS = {
    'buildingGeo': 'input buildings (flattened, same order as buildingColors)',
    'buildingColors': 'one colour per building -> Custom Preview Material',
    'buildingHeights': 'building heights',
    'buildingMesh': 'vertex-coloured building meshes',
    'legendMesh': 'vertex-coloured legend bar',
    'legendCurves': 'legend frame + ticks',
    'legendText': 'legend labels + title as curves',
    'labelPlanes': 'label planes -> Text Tag 3D Location',
    'labelText': 'label strings -> Text Tag 3D Text'}


LIST_INPUTS = ('buildings', 'palette')                # inputs that need List Access


def _setup_params():
    """Write tooltips onto every input / output and switch LIST_INPUTS to List Access."""
    try:
        import Grasshopper as gh
        comp = ghenv.Component
    except Exception:
        return                                        # not running inside Grasshopper
    try:
        if comp.Description != COMPONENT_DESC:
            comp.Description = COMPONENT_DESC
        for params, tips in ((comp.Params.Input, INPUT_TIPS), (comp.Params.Output, OUTPUT_TIPS)):
            for p in params:
                tip = tips.get(p.NickName) or tips.get(p.Name)
                if tip and p.Description != tip:
                    p.Description = tip
        fix = [p for p in comp.Params.Input
               if (p.NickName in LIST_INPUTS or p.Name in LIST_INPUTS)
               and p.Access != gh.Kernel.GH_ParamAccess.list]
        if not fix:
            return
        doc = comp.OnPingDocument()
        if doc is None:
            return

        def make(d):
            for p in fix:
                p.Access = gh.Kernel.GH_ParamAccess.list
            comp.ExpireSolution(False)

        doc.ScheduleSolution(5, gh.Kernel.GH_Document.GH_ScheduleDelegate(make))
    except Exception:
        pass


_setup_params()
# ---------------------------------------------------------------------------------------------
import System
import Rhino
import Rhino.Geometry as rg
import System.Drawing as sd

FALLBACK_PALETTE = [(68, 1, 84), (59, 82, 139), (33, 145, 140), (94, 201, 98), (253, 231, 37)]


def opt(name, default=None):
    v = globals().get(name, default)
    return default if v is None or v == [] else v


def as_list(v):
    if v is None:
        return []
    if isinstance(v, (list, tuple)):
        return list(v)
    try:
        return list(v)
    except TypeError:
        return [v]


def to_color(c):
    if hasattr(c, 'R'):
        return sd.Color.FromArgb(c.R, c.G, c.B)
    return sd.Color.FromArgb(int(c[0]), int(c[1]), int(c[2]))


def lerp_color(cols, t):
    t = max(0.0, min(1.0, t))
    if len(cols) == 1:
        return cols[0]
    x = t * (len(cols) - 1)
    i = min(int(x), len(cols) - 2)
    f = x - i
    a, b = cols[i], cols[i + 1]
    return sd.Color.FromArgb(int(round(a.R + (b.R - a.R) * f)),
                             int(round(a.G + (b.G - a.G) * f)),
                             int(round(a.B + (b.B - a.B) * f)))


def to_geom(g):
    if isinstance(g, System.Guid):
        o = Rhino.RhinoDoc.ActiveDoc.Objects.FindId(g)
        return o.Geometry if o else None
    return g


def to_mesh(g):
    g = to_geom(g)
    if g is None:
        return None
    if isinstance(g, rg.Mesh):
        return g.DuplicateMesh()
    if isinstance(g, rg.Extrusion):
        g = g.ToBrep(True)
    elif isinstance(g, rg.Surface):
        g = g.ToBrep()
    if isinstance(g, rg.Brep):
        parts = rg.Mesh.CreateFromBrep(g, rg.MeshingParameters.FastRenderMesh)
        if not parts:
            return None
        m = rg.Mesh()
        for p in parts:
            m.Append(p)
        return m
    return None


# ---- inputs -----------------------------------------------------------------------------------
cols = [to_color(c) for c in as_list(opt('palette', None))] or \
       [to_color(c) for c in FALLBACK_PALETTE]
mode = int(opt('colorMode', 0))
n_class = max(0, int(opt('classCount', 0)))
n_tick = max(2, int(opt('tickCount', 6)))
title = str(opt('legendTitle', 'Height (m)'))

buildingGeo, meshes = [], []
for g in as_list(opt('buildings', None)):
    m = to_mesh(g)
    if m is not None and m.Vertices.Count > 0:
        buildingGeo.append(to_geom(g))
        meshes.append(m)
# empty outputs until valid buildings are connected (no error, just a grey remark)
buildingColors = buildingHeights = buildingMesh = None
legendMesh = legendCurves = legendText = labelPlanes = labelText = None
if not meshes:
    buildingGeo = None
    try:
        import Grasshopper as gh
        ghenv.Component.AddRuntimeMessage(
            gh.Kernel.GH_RuntimeMessageLevel.Remark,
            'Connect UrbGEN buildings (Brep / Extrusion / Mesh) to "buildings".')
    except Exception:
        pass
else:
    boxes = [m.GetBoundingBox(True) for m in meshes]
    buildingHeights = [bb.Max.Z - bb.Min.Z for bb in boxes]

    lo = opt('minHeight', None)
    hi = opt('maxHeight', None)
    lo = min(buildingHeights) if lo is None else float(lo)
    hi = max(buildingHeights) if hi is None else float(hi)
    if hi <= lo:
        hi = lo + 1.0


    def height_color(h):
        t = (h - lo) / (hi - lo)
        if n_class > 0:
            k = min(max(int(t * n_class), 0), n_class - 1)
            t = k / float(n_class - 1) if n_class > 1 else 0.5
        return lerp_color(cols, t)


    # ---- colour buildings -------------------------------------------------------------------------
    buildingColors, buildingMesh = [], []
    for m, bb, h in zip(meshes, boxes, buildingHeights):
        m.VertexColors.Clear()
        if mode == 1:
            for i in range(m.Vertices.Count):
                m.VertexColors.Add(height_color(m.Vertices[i].Z - bb.Min.Z))
        else:
            c = height_color(h)
            for i in range(m.Vertices.Count):
                m.VertexColors.Add(c)
        buildingColors.append(height_color(h))
        buildingMesh.append(m)

    # ---- legend -----------------------------------------------------------------------------------
    site_bb = rg.BoundingBox.Empty
    for bb in boxes:
        site_bb.Union(bb)
    H = float(opt('legendHeight', hi - lo))
    if H <= 0:
        H = max(site_bb.Max.X - site_bb.Min.X, site_bb.Max.Y - site_bb.Min.Y) * 0.5
    pl = opt('legendPlane', None)
    if pl is None:
        span = max(site_bb.Max.X - site_bb.Min.X, site_bb.Max.Y - site_bb.Min.Y, 1.0)
        pl = rg.Plane(rg.Point3d(site_bb.Max.X + 0.1 * span, site_bb.Max.Y, site_bb.Min.Z),
                      rg.Vector3d.XAxis, rg.Vector3d.ZAxis)
    W = H * 0.06
    ts = H * 0.035


    def P(x, y):
        return pl.PointAt(x, y)


    def add_band(m, y0, y1, c0, c1):
        a = m.Vertices.Count
        for (x, y), c in (((0, y0), c0), ((W, y0), c0), ((W, y1), c1), ((0, y1), c1)):
            m.Vertices.Add(P(x, y))
            m.VertexColors.Add(c)
        m.Faces.AddFace(a, a + 1, a + 2, a + 3)


    legendMesh = rg.Mesh()
    if n_class > 0:
        for k in range(n_class):
            c = lerp_color(cols, k / float(n_class - 1) if n_class > 1 else 0.5)
            add_band(legendMesh, H * k / n_class, H * (k + 1) / n_class, c, c)
        tick_vals = [lo + (hi - lo) * k / n_class for k in range(n_class + 1)]
    else:
        N = 64
        for k in range(N):
            add_band(legendMesh, H * k / N, H * (k + 1) / N,
                     lerp_color(cols, k / float(N)), lerp_color(cols, (k + 1) / float(N)))
        tick_vals = [lo + (hi - lo) * k / (n_tick - 1) for k in range(n_tick)]
    legendMesh.Normals.ComputeNormals()

    fmt = '%.0f' if (hi - lo) >= 10 else '%.1f'
    legendCurves = [rg.PolylineCurve([P(0, 0), P(W, 0), P(W, H), P(0, H), P(0, 0)])]
    labelPlanes, labelText = [], []
    for v in tick_vals:
        y = H * (v - lo) / (hi - lo)
        legendCurves.append(rg.LineCurve(P(W, y), P(W * 1.3, y)))
        labelPlanes.append(rg.Plane(P(W * 1.5, y - ts * 0.5), pl.XAxis, pl.YAxis))
        labelText.append(fmt % v)
    labelPlanes.append(rg.Plane(P(0, H + ts * 1.2), pl.XAxis, pl.YAxis))
    labelText.append(title)

    legendText = []
    try:
        ds = Rhino.DocObjects.DimensionStyle()
        for p, s in zip(labelPlanes, labelText):
            ds.TextHeight = ts * (1.2 if s == title else 1.0)
            te = rg.TextEntity.Create(s, p, ds, False, 0, 0)
            crvs = te.CreateCurves(ds, False, 1.0, 0.0)
            if crvs:
                legendText.extend(crvs)
    except Exception as e:
        print('Text curves not created (%s) - use labelPlanes + labelText with Text Tag 3D.' % e)

    print('%d buildings | height %.1f - %.1f | domain %s - %s | %s'
          % (len(buildingMesh), min(buildingHeights), max(buildingHeights), fmt % lo, fmt % hi,
             'gradient Z' if mode == 1 else 'per building'))
# ---------- end urbgen_height_colors ----------
custom_preview = CustomPreview(Geometry=urbgen_height_colors.buildingGeo, Material=urbgen_height_colors.buildingColors)
