# Grasshopper definition UrbGEN_example_v0.1.11beta.gh (Grasshopper 1.0.8)
# plug-ins: Pufferfish, UrbGEN.Components

# URBGEN — Generative Urban Massing Tool
# 
# URBGEN is a GhPython-based generative urban
# massing tool for Grasshopper/Rhino that
# automatically generates 3D building
# configurations from site boundaries and planning
# constraints. The tool enables rapid exploration of
# seven building typologies while targeting FAR
# and BCR requirements, supporting early-stage
# urban design and design-space exploration.
# 
# 
# Developed by: Trong-Tin Tran, Ying-Chieh Chan
# 
# Email: trongtintr@outlook.com/ D14521024@ntu.edu.tw
# 
# Lab: Ying-Chieh Chan's Lab, National Taiwan University
image_sampler = ImageSampler(
    FilePath="C:\Users\trongtintr\OneDrive\PhD_Journey\04_Publications\UrbGEN\UrbGEN\rh8\images\urbgen-logo.jpg",
    Filter="Colour",
    Interpolate=False,
    Umax=1,
    Umin=0,
    Vmax=1,
    Vmin=0,
    Wrap=1)
# Note:
# 
# The computation and generative process time
# depends on the number of sites being processed.
# With the current template, running the full workflow
# for multiple sites takes approximately 1 minutes.
# Processing a single site will generally be faster.
# 
# For quick testing, you can reduce the number of
# siteCrv inputs to decrease the computation time.
mode = Slider(3, range=0..10)
# citation: Tran, T. T., & Chan, Y. C. (2026). UrbGEN - Generative Urban Massing Tool (Version v0.1.11beta) [Computer software]. Zenodo. https://doi.org/10.5281/zenodo.23004407
number_slider = Slider(5, range=0..10)
count = Slider(0, range=0..10000)
jitter = Slider(0, range=0..1)
angle = Slider(83, range=0..100)

curve = Curve(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)
curve_2 = Curve(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)
curve_3 = Curve(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)
curve_4 = Curve(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)
# INPUT SITE BOUNDARY
curve_5 = Curve(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)
curve_6 = Curve(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)
curve_7 = Curve(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)
curve_8 = Curve(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)
curve_9 = Curve(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)
curve_10 = Curve(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)
curve_11 = Curve(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)
merge = Merge(
    Data1=curve_5,
    Data2=curve_6,
    Data3=curve_7,
    Data4=curve_8,
    Data5=curve,
    Data6=curve_9,
    Data7=curve_2,
    Data8=curve_3,
    Data9=curve_10,
    Data10=curve_11,
    Data11=curve_4)

# ----
# FAR
far = GenePool(Decimals=0, Maximum=7, Minimum=1, Value=[1, 2, 3, 4, 5, 6, 7, 6, 5, 4, 3])
# BCR
bcr = GenePool(Decimals=1, Maximum=0.6, Minimum=0.3, Value=[0.4, 0.6, 0.5, 0.4, 0.4, 0.6, 0.6, 0.5, 0.45, 0.4, 0.45])
# TYPOLOGY
typologies = GenePool(Decimals=0, Maximum=7, Minimum=0, Value=[7, 0, 3.5, 2, 3.5, 5, 3, 3.5, 3.5, 3.5, 7])
# HEIGHT VARIATION
height_variation = GenePool(Decimals=1, Maximum=0.7, Minimum=0.1, Value=[0.1, 0.4, 0.5, 0.3, 0.3, 0.7, 0.7, 0.5, 0.4, 0.3, 0.4])

# ---- group: Run it...
boolean_toggle = BooleanToggle(False)

# ----
curve_12 = Curve(merge)
urbgen_populateregion = UrbGEN_PopulateRegion(Crv=curve_12, Count=count, Mode=mode, Jitter=jitter, Angle=angle, MinDist=number_slider)
boundary_surfaces = BoundarySurfaces(Edges=merge)
area = Area(Geometry=merge)  # -> Area, Centroid
list_indices = ListIndices(List=merge)
upperfar = Slider(2, range=0..10)
minwidth = Slider(20, range=0..100)
podiumminoffset = Slider(1, range=0..20)

uniformrotationdeg = Slider(98, range=0..180)
globalrotationmode = Slider(0, range=0..2)

courtyardbreakcount = Slider(5, range=0..10)
courtyardbreakwidth = Slider(5, range=0..30)
enforceheightregulation = BooleanToggle(False)
heightregulationmode = ValueList({"No limit": 0, "Strict": 1, "70% Flexible": 2}, selected="Strict")
movetoboundary = BooleanToggle(True)
movealltosetback = BooleanToggle(True)
aligntowerstoedge = BooleanToggle(True)
edgealignbothorientations = BooleanToggle(True)
movetowertopodiumedge = BooleanToggle(True)
setback = Slider(5, range=0..10)
upperbcr = Slider(0.3, range=0.3..0.6)
towersizemode = Slider(3, range=0..3)
minfootprintpertower = Slider(500, range=0..2000)
maxfootprintpertower = Slider(4000, range=0..10000)
maxlengthwidthratio = Slider(3, range=2..4)
mintowerdistance = Slider(15, range=0..100)
towerbcrpriority = Slider(0.7, range=0..1)
towergrowstep = Slider(10, range=0..10)
towergrowiterations = Slider(100, range=0..100)
seed = Slider(20, range=0..1000)
towertypologymode = Slider(0, range=0..7)
armlengthratio = Slider(1, range=0.4..1.6)
podiumfloors = Slider(1, range=0..10)
podiummaxoffset = Slider(7, range=0..20)
floorheight = Slider(3.6, range=0..10)
courtyardcount = Slider(1, range=0..3)
courtyardzonegap = Slider(9, range=0..10)
splitangle = Slider(0, range=-45..45)
shift = Slider(50, range=0..360)
courtyardlayoutmode = Slider(1, range=0..1)
heightvariation = Slider(0.1, range=0..1)
maxbuildingheight = Slider(100, range=0..100)
minbuildingheight = Slider(10, range=0..10)
text_tag = TextTag(Location=area.Centroid, Text=list_indices)
urbgen_generator = UrbGENGenerator(
    SiteCrv=curve_12,
    Centroids=urbgen_populateregion,
    Setback=setback,
    FAR=far,
    BCR=bcr,
    UpperBCR=bcr,
    MinWidth=minwidth,
    TowerSizeMode=towersizemode,
    MinFootprintPerTower=minfootprintpertower,
    MaxFootprintPerTower=maxfootprintpertower,
    MaxLengthWidthRatio=maxlengthwidthratio,
    MinTowerDistance=mintowerdistance,
    TowerBCRPriority=towerbcrpriority,
    TowerGrowStep=towergrowstep,
    TowerGrowIterations=towergrowiterations,
    Seed=seed,
    TowerTypologyMode=typologies,
    ArmLengthRatio=armlengthratio,
    PodiumFloors=podiumfloors,
    PodiumMinOffset=podiumminoffset,
    PodiumMaxOffset=podiummaxoffset,
    FloorHeight=floorheight,
    GlobalRotationMode=globalrotationmode,
    UniformRotationDeg=uniformrotationdeg,
    CourtyardCount=courtyardcount,
    CourtyardBreakCount=courtyardbreakcount,
    CourtyardBreakWidth=courtyardbreakwidth,
    CourtyardZoneGap=courtyardzonegap,
    CourtyardSplitAngle=splitangle,
    CourtyardBreakShift=shift,
    CourtyardLayoutMode=courtyardlayoutmode,
    HeightVariation=height_variation,
    EnforceHeightRegulation=enforceheightregulation,
    HeightRegulationMode=heightregulationmode,
    MaxBuildingHeight=maxbuildingheight,
    MinBuildingHeight=minbuildingheight,
    MoveToBoundary=movetoboundary,
    MoveAllToSetback=movealltosetback,
    AlignTowersToEdge=aligntowerstoedge,
    EdgeAlignBothOrientations=edgealignbothorientations,
    MoveTowerToPodiumEdge=movetowertopodiumedge,
    Run=boolean_toggle)  # -> port, TowerFootprints, TowerMasses, PodiumFootprints, PodiumMasses, UnionFootprint, BuildableSite, SiteOriginal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

geometry = Geometry([urbgen_generator.TowerMasses, urbgen_generator.PodiumMasses])
bounding_box = BoundingBox(Content=geometry, Plane=PlaneXY(0, 0, 0))  # -> Box, Box_2
deconstruct_box = DeconstructBox(Box=bounding_box.Box)  # -> Plane, X, Y, Z
gradient = Gradient(
    LowerLimit="0",
    UpperLimit="70",
    Parameter=deconstruct_box.Z,
    stops=[0: RGB(48, 18, 59), 0.0294: RGB(56, 40, 112), 0.0588: RGB(63, 62, 156), 0.0882: RGB(68, 82, 193), 0.118: RGB(70, 102, 221), 0.147: RGB(71, 122, 241)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])
custom_preview = CustomPreview(Geometry=geometry, Material=gradient)

unit_z = UnitZ(Factor="200")
unit_z_2 = UnitZ(Factor="180")
number = Number(expr("round(x,1)", bcr))
number_2 = Number(expr("round(x,1)", urbgen_generator.ActualBCR))
move = Move(Geometry=area.Centroid, Motion=unit_z)  # -> Geometry, Transform
move_2 = Move(Geometry=area.Centroid, Motion=unit_z_2)  # -> Geometry, Transform
concatenate = Concatenate(FragmentA="upperBCR: ", FragmentB=number)
colour_swatch = ColourSwatch(SwatchColor=RGB(255, 255, 255))
concatenate_2 = Concatenate(FragmentA="actualBCR: ", FragmentB=number_2)
text_tag_2 = TextTag(Location=move.Geometry, Text=flatten(concatenate), Colour=colour_swatch)
text_tag_3 = TextTag(Location=move_2.Geometry, Text=flatten(concatenate_2), Colour=colour_swatch)
